# Grasshopper definition 241195_configurator.gh (Grasshopper 1.0.8)
# plug-ins: Pufferfish, LunchBox, Sasquatch, NGon_RH8

number_slider = Slider(5000, range=0..10000)
number_slider_2 = Slider(5000, range=0..10000)
number_slider_3 = Slider(5000, range=0..8000)
x_size = GetNumber("5000", AtLeast=1, AtMost=2147483647, Maximum=1.797693135e+308, Minimum=-1.797693135e+308, TreeAccess=False)
y_size = GetNumber("5000", AtLeast=1, AtMost=2147483647, Maximum=1.797693135e+308, Minimum=-1.797693135e+308, TreeAccess=False)
z_size = GetNumber("3000", AtLeast=1, AtMost=2147483647, Maximum=1.797693135e+308, Minimum=-1.797693135e+308, TreeAccess=False)
rectangle = Rectangle(Plane=PlaneXY(0, 0, 0), XSize=x_size, YSize=y_size, Radius=0)  # -> Rectangle, Length
pt = ConstructPoint(XCoordinate=0, YCoordinate=0, ZCoordinate=0)
area = Area(Geometry=rectangle.Rectangle)  # -> Area, Centroid
adjustheatmap = Slider(3, range=0..5)  # disabled
visualizeheatmap = BooleanToggle(False)
additionalsecondlayerspeakers = BooleanToggle(False)  # disabled
vector_2pt = Vector2Pt(PointA=pt, PointB=area.Centroid, Unitize=False)  # -> Vector, Length
additionalsecondlayerspeakers_2 = BooleanToggle(True)
additionalfirstlayerspeakers = BooleanToggle(True)
# Additional first layer speakers
number_slider_4 = Slider(2, range=1..4)
# Wall to add absorbers
number_slider_5 = Slider(13, range=0..50)
addabsorbers = BooleanToggle(True)
issquare = BooleanToggle(False)
issquare_2 = BooleanToggle(True)
number_slider_6 = Slider(1, range=1..5)  # disabled
# Wall to add absorbers
addabsorbers_2 = BooleanToggle(True)
frontspeakerangle = Slider(33, range=22..40)
reverse = Reverse(Vector=vector_2pt.Vector)
adjustoverheadspeakers = Slider(-289.7, range=-1000..500)
# Positioning angle of  side speakers
sidespeakerangle = Slider(106, range=90..110)
# Positioning angle of  rear speakers
# possible placement of overhead speakers
rearspeakerangle = Slider(150, range=120..150)
# Visualise heatmap
visualizeheatmap_2 = GetBoolean(visualizeheatmap, AtLeast=1, AtMost=1, FalseValue="False", TreeAccess=False, TrueValue="True")
# Heatmap on Wall
adjustheatmap_2 = GetNumber(adjustheatmap, AtLeast=1, AtMost=2147483647, Maximum=1.797693135e+308, Minimum=-1.797693135e+308, TreeAccess=False)  # disabled
stereosetup = GetBoolean(issquare, AtLeast=1, AtMost=1, FalseValue="False", TreeAccess=False, TrueValue="True")
changespeakerorientationtoorthogonal = GetBoolean(issquare_2, AtLeast=1, AtMost=1, FalseValue="False", TreeAccess=False, TrueValue="True")
# Visualise rays
visualizefirstreflections = GetBoolean(additionalsecondlayerspeakers, AtLeast=1, AtMost=1, FalseValue="False", TreeAccess=False, TrueValue="True")  # disabled
move = Move(Geometry=rectangle.Rectangle, Motion=reverse)  # -> Geometry, Transform
# Additional second layer speakers
# Positioning angle of  front speakers
additionalsecondlayerspeakers_3 = GetBoolean(additionalsecondlayerspeakers_2, AtLeast=1, AtMost=1, FalseValue="False", TreeAccess=False, TrueValue="True")
additionalfirstlayerspeakers_2 = GetBoolean(additionalfirstlayerspeakers, AtLeast=1, AtMost=1, FalseValue="False", TreeAccess=False, TrueValue="True")
adjustabsorberamount = GetNumber(number_slider_5, AtLeast=1, AtMost=2147483647, Maximum=1.797693135e+308, Minimum=-1.797693135e+308, TreeAccess=False)
speakerwalloffset = GetNumber(
    Slider(350, range=250..1000),
    AtLeast=1,
    AtMost=2147483647,
    Maximum=1.797693135e+308,
    Minimum=-1.797693135e+308,
    TreeAccess=False)
# Orientation
speakerorientation = GetNumber(number_slider_4, AtLeast=1, AtMost=2147483647, Maximum=1.797693135e+308, Minimum=-1.797693135e+308, TreeAccess=False)
listenerposition = GetNumber(
    Slider(930, range=800..1500),
    AtLeast=1,
    AtMost=2147483647,
    Maximum=1.797693135e+308,
    Minimum=-1.797693135e+308,
    TreeAccess=False)
addabsorberstoceiling = GetBoolean(addabsorbers, AtLeast=1, AtMost=1, FalseValue="False", TreeAccess=False, TrueValue="True")
adjustabsorberamountceiling = GetNumber(
    Slider(3, range=0..30),
    AtLeast=1,
    AtMost=2147483647,
    Maximum=1.797693135e+308,
    Minimum=-1.797693135e+308,
    TreeAccess=False)
selectabsorbertype = GetNumber(number_slider_6, AtLeast=1, AtMost=2147483647, Maximum=1.797693135e+308, Minimum=-1.797693135e+308, TreeAccess=False)  # disabled
addabsorbers_3 = GetBoolean(addabsorbers_2, AtLeast=1, AtMost=1, FalseValue="False", TreeAccess=False, TrueValue="True")
frontspeakerangle_2 = GetNumber(frontspeakerangle, AtLeast=1, AtMost=2147483647, Maximum=1.797693135e+308, Minimum=-1.797693135e+308, TreeAccess=False)
sidespeakerangle_2 = GetNumber(sidespeakerangle, AtLeast=1, AtMost=2147483647, Maximum=1.797693135e+308, Minimum=-1.797693135e+308, TreeAccess=False)
rearspeakerangle_2 = GetNumber(rearspeakerangle, AtLeast=1, AtMost=2147483647, Maximum=1.797693135e+308, Minimum=-1.797693135e+308, TreeAccess=False)
adjustoverheadspeakers_2 = GetNumber(
    adjustoverheadspeakers,
    AtLeast=1,
    AtMost=2147483647,
    Maximum=1.797693135e+308,
    Minimum=-1.797693135e+308,
    TreeAccess=False)
num = Number(visualizeheatmap_2)
num_2 = Number(stereosetup)
multiplication = Multiplication(A=speakerorientation, B=90)
num_3 = Number(changespeakerorientationtoorthogonal)
numberofdoors = GetNumber(Slider(1, range=1..3), AtLeast=1, AtMost=1, Maximum=1.797693135e+308, Minimum=-1.797693135e+308, TreeAccess=False)
doorposition_1 = GetNumber(Slider(477, range=36..1000), AtLeast=1, AtMost=1, Maximum=1.797693135e+308, Minimum=-1.797693135e+308, TreeAccess=False)
doorposition_2 = GetNumber(Slider(847, range=36..1000), AtLeast=1, AtMost=1, Maximum=1.797693135e+308, Minimum=-1.797693135e+308, TreeAccess=False)
box_rectangle = BoxRectangle(Rectangle=move.Geometry, Height=z_size)
doorposition_3 = GetNumber(Slider(1000, range=36..1000), AtLeast=1, AtMost=1, Maximum=1.797693135e+308, Minimum=-1.797693135e+308, TreeAccess=False)
number = Number(addabsorberstoceiling)
num_4 = Number(visualizefirstreflections)  # disabled
number_2 = Number(selectabsorbertype)  # disabled
number_3 = Number(addabsorbers_3)
numberofwindows = GetNumber(Slider(1, range=1..3), AtLeast=1, AtMost=1, Maximum=1.797693135e+308, Minimum=-1.797693135e+308, TreeAccess=False)
windowposition_1 = GetNumber(Slider(537, range=36..1000), AtLeast=1, AtMost=1, Maximum=1.797693135e+308, Minimum=-1.797693135e+308, TreeAccess=False)
windowposition_2 = GetNumber(Slider(556, range=0..1000), AtLeast=1, AtMost=1, Maximum=1.797693135e+308, Minimum=-1.797693135e+308, TreeAccess=False)
windowposition_3 = GetNumber(Slider(77, range=0..1000), AtLeast=1, AtMost=1, Maximum=1.797693135e+308, Minimum=-1.797693135e+308, TreeAccess=False)
num_5 = Number(additionalsecondlayerspeakers_3)
num_6 = Number(additionalfirstlayerspeakers_2)
deconstruct_brep = DeconstructBrep(Brep=box_rectangle)  # -> Faces, Edges, Vertices
debox = DeconstructBox(Box=box_rectangle)  # -> Plane, X, Y, Z
panel = Panel(doorposition_1)
panel_2 = Panel("4")
panel_3 = Panel("""0
1
2
3""")
dedomain = DeconstructDomain(Domain=debox.Z)  # -> Start, End
dedomain_2 = DeconstructDomain(Domain=debox.Y)  # -> Start, End
dedomain_3 = DeconstructDomain(Domain=debox.X)  # -> Start, End
list_item = ListItem(List=deconstruct_brep.Faces, Index=panel_3, Wrap=True)
list_item_2 = ListItem(List=deconstruct_brep.Faces, Index="4", Wrap=True)
list_item_3 = ListItem(List=deconstruct_brep.Faces, Index=Slider(5, range=0..10), Wrap=True)
multiplication_2 = Multiplication(A=dedomain.End, B=Slider(0.71, range=0..1))
deconstruct_brep_2 = DeconstructBrep(Brep=box_rectangle)  # -> Faces, Edges, Vertices
python = GhPythonScript(x=dedomain_3.End, y=dedomain_2.End)  # -> out
# ---------- python: Python ----------
if x < y :
    print(x)
else:
    print(y)
# ---------- end python ----------
mesh = Mesh(list_item)

number_slider_7 = Slider(9.926, range=0..10)
number_slider_8 = Slider(1, range=0..1)

offset_mesh = OffsetMesh(Mesh=list_item_2, Distance=Slider(100, range=0..100), BothSides=0, CreateSolid=True)
list_item_4 = ListItem(List=deconstruct_brep_2.Faces, Index=Slider(4, range=0..10), Wrap=True)
division = Division(A=python, B="2")
X = UnitX(Factor=1)
list_item_5 = ListItem(List=deconstruct_brep_2.Faces, Index=Slider(5, range=0..100), Wrap=True)
panel_4 = Panel("""0
2""")
xy = XYPlane(Origin=Point(0, 0, 0))
Z = UnitZ(Factor=listenerposition)
panel_5 = Panel("""1
3""")
rad = Radians(Degrees=frontspeakerangle_2)
division_2 = Division(A=python, B=number_slider_7)
division_3 = Division(A=division, B=number_slider_7)
multiplication_3 = Multiplication(A=division_3, B="1.5")
deconstruct_brep_3 = DeconstructBrep(Brep=list_item_4)  # -> Faces, Edges, Vertices
panel_6 = Panel("600")
rad_2 = Radians(Degrees=sidespeakerangle_2)
rad_3 = Radians(Degrees=rearspeakerangle_2)
filter = StreamFilter(
    Gate=speakerorientation,
    Stream1=Slider(2, range=0..10),
    Stream2=Slider(3, range=0..10),
    Stream3=Slider(0, range=0..10),
    Stream4=Slider(1, range=0..10))
filter_2 = StreamFilter(Gate=speakerorientation, Stream1=panel_5, Stream2=panel_4, Stream3=panel_5, Stream4=panel_4)
move_2 = Move(Geometry=xy, Motion=Z)  # -> Geometry, Transform
rotate = Rotate(Geometry=move_2.Geometry, Angle=degrees(multiplication), Plane=PlaneXY(0, 0, 0))  # -> Geometry, Transform
join = JoinCurves(Curves=deconstruct_brep_3.Edges, Preserve=False)
filter_3 = StreamFilter(Gate=number, Stream1=list_item_5)
arc = Arc(Plane=rotate.Geometry, Radius=Slider(717, range=0..1000), Angle=rad)  # -> Arc, Length

# ---- group: Center
line = LineSDL(Start=move_2.Geometry, Direction=X, Length=multiplication_3)

# ----
join_2 = JoinCurves(Curves=deconstruct_brep_3.Edges, Preserve=False)
offset = OffsetCurve(Curve=join_2, Distance=expr("-x", Slider(446, range=0..1000)), Corners=1)
arc_2 = Arc(Plane=rotate.Geometry, Radius=Slider(1683, range=0..2000), Angle=rad_3)  # -> Arc, Length
arc_3 = Arc(Plane=rotate.Geometry, Radius=Slider(1142, range=0..2000), Angle=rad_2)  # -> Arc, Length
list_item_6 = ListItem(List=deconstruct_brep_2.Faces, Index=filter, Wrap=True)
rectangle_2 = Rectangle(Plane=move_2.Geometry, XSize=division_2, YSize=division_2, Radius=0)  # -> Rectangle, Length
arc_dimension = AngleDimensionArc(Arc=arc.Arc)  # -> AngleDimension, Arc, Offset
panel_7 = Panel("""0
1
2
3""")
offset_2 = OffsetCurve(Curve=join, Distance=expr("-x", Slider(446, range=0..1000)), Corners=1)
circle = CircleCNR(Center=move_2.Geometry, Normal=Vector(0, 0, 1), Radius=division_3)
rotate_2 = Rotate(Geometry=line, Angle=degrees(multiplication), Plane=PlaneXY(0, 0, 0))  # -> Geometry, Transform
arc_dimension_2 = AngleDimensionArc(Arc=arc_3.Arc)  # -> AngleDimension, Arc, Offset
arc_dimension_3 = AngleDimensionArc(Arc=arc_2.Arc)  # -> AngleDimension, Arc, Offset
gate = StreamGate(Stream=offset, Gate=numberofdoors)  # -> Target0, Target1, Target2, Target3
area_2 = Area(Geometry=list_item_6)  # -> Area, Centroid
offset_curve = OffsetCurve(Curve=filter_3, Distance=expr("-x", Slider(929, range=0..2000)), Corners=1)
area_3 = Area(Geometry=rectangle_2.Rectangle)  # -> Area, Centroid
vec2pt = Vector2Pt(PointA=area_3.Centroid, PointB=move_2.Geometry, Unitize=False)  # -> Vector, Length
list_item_7 = ListItem(List=deconstruct_brep_2.Faces, Index=filter_2, Wrap=True)
gate_2 = StreamGate(Stream=offset_2, Gate=numberofwindows)  # -> Target0, Target1, Target2, Target3
crv = Curve(circle)
neg = Negative(Value=sidespeakerangle_2)
neg_2 = Negative(Value=rearspeakerangle_2)
divide_surface = DivideSurface(Surface=offset_curve, UCount=Slider(4, range=0..10), VCount=Slider(3.5, range=0..10))  # -> Points, Normals, Parameters
neg_3 = Negative(Value=frontspeakerangle_2)
filter_4 = StreamFilter(
    Gate=num_2,
    Stream0=[arc_dimension_3.AngleDimension, arc_dimension_2.AngleDimension, arc_dimension.AngleDimension],
    Stream1=arc_dimension.AngleDimension)
subtraction = Subtraction(A=90, B=frontspeakerangle_2)
rotate_3 = Rotate(Geometry=rotate_2.Geometry, Angle=degrees([rearspeakerangle_2, neg_2]), Plane=PlaneXY(0, 0, 0))  # -> Geometry, Transform
rotate_4 = Rotate(Geometry=rotate_2.Geometry, Angle=degrees([neg, sidespeakerangle_2]), Plane=PlaneXY(0, 0, 0))  # -> Geometry, Transform
len = Length(Curve=gate.Target1)
len_2 = Length(Curve=gate.Target2)
len_3 = Length(Curve=gate.Target2)
len_4 = Length(Curve=gate.Target3)
len_5 = Length(Curve=gate.Target3)
len_6 = Length(Curve=gate.Target3)
a_style = AnnotationStyleOverrides(Annotation=filter_4, ModelScale=Slider(50, range=0..100))  # -> Annotation, Style, ModelScale, TextSettings, DimensionSettings, ArrowSettings, UnitsSettings, LeaderSettings, ToleranceSettings
offset_curve_2 = OffsetCurve(Curve=list_item_7, Distance=expr("-x", Slider(1000, range=0..1000)), Corners=1)
number_slider_9 = Slider(705, range=0..1000)
area_4 = Area(Geometry=offset_curve)  # -> Area, Centroid
move_3 = Move(Geometry=rectangle_2.Rectangle, Motion=vec2pt.Vector)  # -> Geometry, Transform
crv_2 = Curve(move_3.Geometry)
division_4 = Division(A=subtraction, B=2)
neg_4 = Negative(Value=division_4)
addition = Addition(A=neg_3, B=neg_4)
addition_2 = Addition(A=frontspeakerangle_2, B=division_4)
Z_2 = UnitZ(Factor=multiplication_2)
yz_plane = YZPlane(Origin=Point(0, 0, 0))
filter_5 = StreamFilter(
    Gate=num_6,
    Stream0=flatten([neg_3, frontspeakerangle_2]),
    Stream1=flatten([frontspeakerangle_2, neg_3, addition_2, addition]))

panel_8 = Panel("1")

concat = Concatenate(FragmentA=frontspeakerangle_2, FragmentB="°")
dom = ConstructDomain(DomainStart=0, DomainEnd=len)
dom_2 = ConstructDomain(DomainStart=0, DomainEnd=len_2)
Z_3 = UnitZ(Factor=adjustoverheadspeakers_2)
dom_3 = ConstructDomain(DomainStart=0, DomainEnd=len_3)
dom_4 = ConstructDomain(DomainStart=0, DomainEnd=len_4)
dom_5 = ConstructDomain(DomainStart=0, DomainEnd=len_5)
dom_6 = ConstructDomain(DomainStart=0, DomainEnd=len_6)
filter_6 = StreamFilter(Gate=num_3, Stream0=crv, Stream1=crv_2)
move_4 = Move(Geometry=rotate_2.Geometry, Motion=Z_2)  # -> Geometry, Transform
concat_2 = Concatenate(FragmentA=sidespeakerangle_2, FragmentB="°")
concat_3 = Concatenate(FragmentA=rearspeakerangle_2, FragmentB="°")
explode = ExplodeObject(Object=a_style.Annotation, Recursive=False)
len_7 = Length(Curve=gate_2.Target1)
len_8 = Length(Curve=gate_2.Target2)
len_9 = Length(Curve=gate_2.Target2)
len_10 = Length(Curve=gate_2.Target3)
len_11 = Length(Curve=gate_2.Target3)
len_12 = Length(Curve=gate_2.Target3)
divide_surface_2 = DivideSurface(Surface=offset_curve_2, UCount=Slider(0.8, range=0..10), VCount=Slider(3.5, range=0..10))  # -> Points, Normals, Parameters
division_5 = Division(A=doorposition_1, B=Slider(1000, range=0..1000))
division_6 = Division(A=doorposition_1, B=Slider(1000, range=0..1000))
division_7 = Division(A=doorposition_2, B=Slider(1000, range=0..1000))
division_8 = Division(A=doorposition_1, B=Slider(1000, range=0..1000))
division_9 = Division(A=doorposition_2, B=Slider(1000, range=0..1000))
division_10 = Division(A=doorposition_3, B=Slider(1000, range=0..1000))
move_5 = Move(Geometry=move_4.Geometry, Motion=Z_3)  # -> Geometry, Transform
rotate_5 = Rotate(Geometry=rotate_2.Geometry, Angle=degrees([frontspeakerangle_2, neg_3]), Plane=PlaneXY(0, 0, 0))  # -> Geometry, Transform
rectangle_3 = Rectangle(Plane=yz_plane, XSize=number_slider_9, YSize=number_slider_9, Radius=0)  # -> Rectangle, Length
area_5 = Area(Geometry=rectangle_3.Rectangle)  # -> Area, Centroid
vector_2pt_2 = Vector2Pt(PointA=area_5.Centroid, PointB=divide_surface.Points, Unitize=False)  # -> Vector, Length
move_6 = Move(Geometry=rectangle_3.Rectangle, Motion=vector_2pt_2.Vector)  # -> Geometry, Transform

# ---- group: Front
rotate_6 = Rotate(Geometry=rotate_2.Geometry, Angle=degrees(filter_5), Plane=PlaneXY(0, 0, 0))  # -> Geometry, Transform

# ----
crv_3 = Curve([rotate_2.Geometry, rotate_6.Geometry, rotate_4.Geometry, rotate_3.Geometry])
filter_7 = StreamFilter(Gate=num_2, Stream0=crv_3, Stream1=[rotate_5.Geometry, rotate_2.Geometry])
trim = TrimWithBrep(Curve=filter_7, Brep=box_rectangle)  # -> Inside, Outside
rotate_7 = Rotate(Geometry=filter_6, Angle=degrees(multiplication), Plane=PlaneXY(0, 0, 0))  # -> Geometry, Transform
division_11 = Division(A=division_2, B=Slider(98.493, range=0..100))
crv_4 = Curve(trim.Inside)
area_6 = Area(Geometry=rectangle_3.Rectangle)  # -> Area, Centroid
unit_z = UnitZ(Factor=listenerposition)
slideindom = SlideWithinDomain(Domain=dom, Factor=division_5)
slideindom_2 = SlideWithinDomain(Domain=dom_2, Factor=division_6)
neg_5 = Negative(Value=speakerwalloffset)
filter_8 = StreamFilter(
    Gate=num_2,
    Stream0=[rotate_2.Geometry, rotate_6.Geometry, rotate_4.Geometry, rotate_3.Geometry],
    Stream1=rotate_5.Geometry)
slideindom_3 = SlideWithinDomain(Domain=dom_3, Factor=division_7)
slideindom_4 = SlideWithinDomain(Domain=dom_4, Factor=division_8)
slideindom_5 = SlideWithinDomain(Domain=dom_5, Factor=division_9)
slideindom_6 = SlideWithinDomain(Domain=dom_6, Factor=division_10)
dom_7 = ConstructDomain(DomainStart=0, DomainEnd=len_7)
dom_8 = ConstructDomain(DomainStart=0, DomainEnd=len_8)
dom_9 = ConstructDomain(DomainStart=0, DomainEnd=len_9)
dom_10 = ConstructDomain(DomainStart=0, DomainEnd=len_10)
dom_11 = ConstructDomain(DomainStart=0, DomainEnd=len_11)
dom_12 = ConstructDomain(DomainStart=0, DomainEnd=len_12)
end = EndPoints(Curve=move_5.Geometry)  # -> Start, End
rectangle_4 = Rectangle(Plane=PlaneXY(0, 0, 0), XSize=division_11, YSize=division_11, Radius=0)  # -> Rectangle, Length
meshpipe = MeshPipe(Curve=flatten(crv_4), Radius=0.1, Sides=6, Tolerance=10, Ending=0)
meshpipe_2 = MeshPipe(Curve=flatten(explode), Radius=0.1, Sides=6, Tolerance=10, Ending=0)
eval = EvaluateCurve(Curve=gate.Target1, Parameter=slideindom)  # -> Point, Tangent, Angle
eval_2 = EvaluateCurve(Curve=gate.Target2, Parameter=slideindom_2)  # -> Point, Tangent, Angle
area_7 = Area(Geometry=move_6.Geometry)  # -> Area, Centroid
eval_3 = EvaluateCurve(Curve=gate.Target2, Parameter=slideindom_3)  # -> Point, Tangent, Angle
eval_4 = EvaluateCurve(Curve=gate.Target3, Parameter=slideindom_4)  # -> Point, Tangent, Angle
eval_5 = EvaluateCurve(Curve=gate.Target3, Parameter=slideindom_5)  # -> Point, Tangent, Angle
eval_6 = EvaluateCurve(Curve=gate.Target3, Parameter=slideindom_6)  # -> Point, Tangent, Angle
division_12 = Division(A=windowposition_1, B=Slider(1000, range=0..1000))
division_13 = Division(A=windowposition_1, B=Slider(1000, range=0..1000))
division_14 = Division(A=windowposition_2, B=Slider(1000, range=0..1000))
division_15 = Division(A=windowposition_1, B=Slider(1000, range=0..1000))
division_16 = Division(A=windowposition_2, B=Slider(1000, range=0..1000))
division_17 = Division(A=windowposition_3, B=Slider(1000, range=0..1000))
area_8 = Area(Geometry=rectangle_4.Rectangle)  # -> Area, Centroid
xy_plane = XYPlane(Origin=area_8.Centroid)
offset_3 = OffsetCurve(Curve=rotate_7.Geometry, Distance=neg_5, Corners=1)
ccx = CurveCurve(CurveA=offset_3, CurveB=filter_8)  # -> flatten(Points), ParamsA, ParamsB
vector_2pt_3 = Vector2Pt(PointA=area_6.Centroid, PointB=divide_surface_2.Points, Unitize=False)  # -> Vector, Length
move_7 = Move(Geometry=rectangle_3.Rectangle, Motion=vector_2pt_3.Vector)  # -> Geometry, Transform
brep_closest_point = BrepClosestPoint(Point=area_7.Centroid, Brep=move_6.Geometry)  # -> Point, Normal, Distance
mcol = MeshColours(Mesh=meshpipe, Colours=ColourSwatch(SwatchColor=RGBA(33, 45, 48, 100)))
brep = Brep(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)
mcol_2 = MeshColours(Mesh=meshpipe_2, Colours=ColourSwatch(SwatchColor=RGBA(0, 0, 0, 145)))
slideindom_7 = SlideWithinDomain(Domain=dom_7, Factor=division_12)
slideindom_8 = SlideWithinDomain(Domain=dom_8, Factor=division_13)
slideindom_9 = SlideWithinDomain(Domain=dom_9, Factor=division_14)
slideindom_10 = SlideWithinDomain(Domain=dom_10, Factor=division_15)
slideindom_11 = SlideWithinDomain(Domain=dom_11, Factor=division_16)
slideindom_12 = SlideWithinDomain(Domain=dom_12, Factor=division_17)
vec2pt_2 = Vector2Pt(PointA=area_8.Centroid, PointB=end.Start, Unitize=False)  # -> Vector, Length
rotate_8 = Rotate(Geometry=rectangle_4.Rectangle, Angle=degrees(multiplication), Plane=xy_plane)  # -> Geometry, Transform
eval_7 = EvaluateCurve(Curve=gate_2.Target1, Parameter=slideindom_7)  # -> Point, Tangent, Angle
eval_8 = EvaluateCurve(Curve=gate_2.Target2, Parameter=slideindom_8)  # -> Point, Tangent, Angle
eval_9 = EvaluateCurve(Curve=gate_2.Target2, Parameter=slideindom_9)  # -> Point, Tangent, Angle
eval_10 = EvaluateCurve(Curve=gate_2.Target3, Parameter=slideindom_10)  # -> Point, Tangent, Angle
eval_11 = EvaluateCurve(Curve=gate_2.Target3, Parameter=slideindom_11)  # -> Point, Tangent, Angle
eval_12 = EvaluateCurve(Curve=gate_2.Target3, Parameter=slideindom_12)  # -> Point, Tangent, Angle
panel_9 = Panel("""90
180
270
360""")
panel_10 = Panel("""90
180
225
270
360
405""")
area_9 = Area(Geometry=brep)  # -> Area, Centroid
area_10 = Area(Geometry=move_7.Geometry)  # -> Area, Centroid
move_8 = Move(Geometry=rectangle_4.Rectangle, Motion=vec2pt_2.Vector)  # -> Geometry, Transform
data = Data([eval.Point, eval_2.Point, eval_3.Point, eval_4.Point, eval_5.Point, eval_6.Point])
area_11 = Area(Geometry=move_8.Geometry)  # -> Area, Centroid
flip = Flip(Surface=list_item_2)  # -> Surface, Result
area_12 = Area(Geometry=brep)  # -> Area, Centroid
number_slider_10 = Slider(900, range=0..1000)
rotate_9 = Rotate(Geometry=move_5.Geometry, Angle=degrees("45"), Plane=PlaneXY(0, 0, 0))  # -> Geometry, Transform
filter_9 = StreamFilter(Gate=num_5, Stream0=panel_9, Stream1=panel_10)
brep_closest_point_2 = BrepClosestPoint(Point=area_10.Centroid, Brep=move_7.Geometry)  # -> Point, Normal, Distance
scale = Scale(Geometry=move_8.Geometry, Center=area_11.Centroid, Factor="0.75")  # -> Geometry, Transform
rotate_direction = RotateDirection(Geometry=move_6.Geometry, Center=area_7.Centroid, From=brep_closest_point.Normal, To=divide_surface.Normals)  # -> flatten(Geometry), Transform
vec2pt_3 = Vector2Pt(PointA=area_9.Centroid, PointB=ccx.Points, Unitize=False)  # -> Vector, Length
filter_10 = StreamFilter(Gate=num_2, Stream0=[concat, concat_2, concat_3], Stream1=concat)
data_2 = Data([eval_7.Point, eval_8.Point, eval_9.Point, eval_10.Point, eval_11.Point, eval_12.Point])
filter_11 = StreamFilter(Gate=num_2, Stream0=[arc_dimension.Arc, arc_dimension_2.Arc, arc_dimension_3.Arc], Stream1=arc_dimension.Arc)
rotate_10 = Rotate(Geometry=rotate_9.Geometry, Angle=degrees(filter_9), Plane=PlaneXY(0, 0, 0))  # -> Geometry, Transform
rectangle_5 = Rectangle(Plane=data, XSize=number_slider_10, YSize=number_slider_10, Radius=0)  # -> Rectangle, Length
rotate_11 = Rotate(Geometry=scale.Geometry, Angle=degrees(multiplication), Plane=PlaneXY(0, 0, 0))  # -> Geometry, Transform
move_9 = Move(Geometry=brep, Motion=vec2pt_3.Vector)  # -> Geometry, Transform
area_13 = Area(Geometry=rotate_direction.Geometry)  # -> Area, Centroid
textsrf = TextOnSurface(
    Text=filter_10,
    Font="Sans Bold:no Italic:no",
    Height=Slider(70, range=0..100),
    Depth=0.4,
    BaseLine=filter_11,
    BaseSurface=flip.Surface)
number_slider_11 = Slider(900, range=0..1000)
filter_12 = StreamFilter(Gate=num_2, Stream0=rotate_10.Geometry)
rotate_direction_2 = RotateDirection(Geometry=move_7.Geometry, Center=area_10.Centroid, From=brep_closest_point_2.Normal, To=divide_surface_2.Normals)  # -> Geometry, Transform
dist = Distance(PointA=area_4.Centroid, PointB=area_13.Centroid)
area_14 = Area(Geometry=rectangle_5.Rectangle)  # -> Area, Centroid
sort = SortList(Keys=dist, ValuesA=rotate_direction.Geometry)  # -> Keys, ValuesA
debrep = DeconstructBrep(Brep=move_9.Geometry)  # -> Faces, Edges, Vertices
series = Series(Start=0, Step=1, Count=adjustabsorberamountceiling)
ccx_2 = CurveCurve(CurveA=rotate_11.Geometry, CurveB=filter_12)  # -> flatten(Points), ParamsA, ParamsB
vec2pt_4 = Vector2Pt(PointA=area_14.Centroid, PointB=data, Unitize=False)  # -> Vector, Length
area_15 = Area(Geometry=move_9.Geometry)  # -> Area, Centroid
mcol_3 = MeshColours(Mesh=textsrf, Colours=ColourSwatch(SwatchColor=RGBA(0, 0, 0, 86)))
filter_13 = StreamFilter(Gate=number_3, Stream0="0", Stream1=adjustabsorberamount)
rectangle_6 = Rectangle(Plane=data_2, XSize=number_slider_11, YSize=number_slider_11, Radius=0)  # -> Rectangle, Length
item = ListItem(List=debrep.Faces, Index=Slider(1, range=0..10), Wrap=True)
brep_2 = Brep(flatten(rotate_direction_2.Geometry))
move_10 = Move(Geometry=rectangle_5.Rectangle, Motion=vec2pt_4.Vector)  # -> Geometry, Transform
item_2 = ListItem(List=sort.ValuesA, Index=series, Wrap=True)
vec2pt_5 = Vector2Pt(PointA=area_12.Centroid, PointB=ccx_2.Points, Unitize=False)  # -> Vector, Length
area_16 = Area(Geometry=rectangle_6.Rectangle)  # -> Area, Centroid
brep_cp = BrepClosestPoint(Point=area_15.Centroid, Brep=item)  # -> Point, Normal, Distance
series_2 = Series(Start=0, Step=1, Count=filter_13)
move_11 = Move(Geometry=brep, Motion=vec2pt_5.Vector)  # -> Geometry, Transform
viewer = ParamViewer(brep_cp.Normal)
number_slider_12 = Slider(7, range=0..10)  # disabled
vec2pt_6 = Vector2Pt(PointA=area_16.Centroid, PointB=data_2, Unitize=False)  # -> Vector, Length
boxrec = BoxRectangle(Rectangle=move_10.Geometry, Height=Slider(2100, range=0..10000))
Z_4 = UnitZ(Factor=Slider(900, range=0..1000))
move_12 = Move(Geometry=rectangle_6.Rectangle, Motion=vec2pt_6.Vector)  # -> Geometry, Transform
number_slider_13 = Slider(7, range=0..10)  # disabled
debrep_2 = DeconstructBrep(Brep=move_11.Geometry)  # -> Faces, Edges, Vertices
mcol_4 = MeshColours(
    Mesh=boxrec,
    Colours=[RGB(127, 255, 0), RGB(0, 100, 0), RGB(34, 139, 34), RGB(124, 252, 0), RGB(154, 205, 50), RGB(173, 255, 47), RGB(50, 205, 50), RGB(152, 251, 152)])
move_13 = Move(Geometry=move_12.Geometry, Motion=Z_4)  # -> Geometry, Transform
pt_2 = Point(area_2.Centroid)
boxrec_2 = BoxRectangle(Rectangle=move_13.Geometry, Height=Slider(1200, range=0..10000))
item_3 = ListItem(List=viewer, Index=Slider(8, range=0..10), Wrap=True)
item_4 = ListItem(List=debrep_2.Faces, Index=Slider(1, range=0..10), Wrap=True)
num_7 = Number("1000000")
area_17 = Area(Geometry=item_4)  # -> Area, Centroid
mcol_5 = MeshColours(
    Mesh=boxrec_2,
    Colours=[RGB(127, 255, 0), RGB(0, 100, 0), RGB(34, 139, 34), RGB(124, 252, 0), RGB(154, 205, 50), RGB(173, 255, 47), RGB(50, 205, 50), RGB(152, 251, 152)])
branch = TreeBranch(Tree=brep_cp.Normal, Path=item_3, MaintainPaths=True)
rotate_direction_3 = RotateDirection(Geometry=move_9.Geometry, Center=area_15.Centroid, From=branch, To=vec2pt_3.Vector)  # -> Geometry, Transform
deconstruct_brep_4 = DeconstructBrep(Brep=rotate_direction_3.Geometry)  # -> Faces, Edges, Vertices; disabled
list_item_8 = ListItem(List=deconstruct_brep_4.Faces, Index=number_slider_13, Wrap=True)  # -> flatten(Item); disabled
area_18 = Area(Geometry=list_item_8)  # -> Area, flatten(Centroid); disabled
mesh_2 = Mesh(flatten(rotate_direction_3.Geometry))
brep_cp_2 = BrepClosestPoint(Point=area_17.Centroid, Brep=item_4)  # -> Point, Normal, Distance
number_slider_14 = Slider(500, range=0..1000)  # disabled
rotate_direction_4 = RotateDirection(
    Geometry=flatten(move_11.Geometry),
    Center=flatten(brep_cp_2.Point),
    From=flatten(brep_cp_2.Normal),
    To=flatten(vec2pt_5.Vector))  # -> Geometry, Transform
deconstruct_brep_5 = DeconstructBrep(Brep=rotate_direction_4.Geometry)  # -> Faces, Edges, Vertices; disabled
list_item_9 = ListItem(List=deconstruct_brep_5.Faces, Index=number_slider_12, Wrap=True)  # -> flatten(Item); disabled
area_19 = Area(Geometry=list_item_9)  # -> Area, flatten(Centroid); disabled
number_slider_15 = Slider(80, range=0..100)  # disabled
brep_cp_3 = BrepClosestPoint(Point=area_19.Centroid, Brep=list_item_9)  # -> Point, Normal, Distance; disabled
mjoin = MeshJoin(Meshes=mesh_2)
brep_cp_4 = BrepClosestPoint(Point=area_18.Centroid, Brep=list_item_8)  # -> Point, Normal, Distance; disabled
panel_11 = Panel(brep_cp_4.Point)
pl = PlaneNormal(Origin=brep_cp_4.Point, ZAxis=brep_cp_4.Normal)  # disabled
sph = Sphere(Base=brep_cp_4.Point, Radius=number_slider_14)  # disabled
panel_12 = Panel(branch)
pl_2 = PlaneNormal(Origin=brep_cp_3.Point, ZAxis=brep_cp_3.Normal)  # disabled
sph_2 = Sphere(Base=brep_cp_3.Point, Radius=number_slider_14)  # disabled
mesh_3 = Mesh(flatten(rotate_direction_4.Geometry))
trimpl = TrimWithPlane(Brep=sph, Plane=pl, PlaneDirection=True, Cap=False, Tolerance=0.001)  # disabled
number_slider_16 = Slider(50, range=0..100)  # disabled
mjoin_2 = MeshJoin(Meshes=mesh_3)
trimpl_2 = TrimWithPlane(Brep=sph_2, Plane=pl_2, PlaneDirection=True, Cap=False, Tolerance=0.001)  # disabled
popgeo = PopulateGeometry(Geometry=trimpl, Count=number_slider_15, Seed=1)  # disabled
offset_4 = OffsetSurface(Surface=brep_2, Distance=Slider(20, range=0..100), Retrim=True)
dup = DuplicateData(Data=graft(brep_cp_4.Point), Number=number_slider_15, Order=True)  # disabled
dup_2 = DuplicateData(Data=graft(brep_cp_3.Point), Number=number_slider_16, Order=True)  # disabled
popgeo_2 = PopulateGeometry(Geometry=trimpl_2, Count=number_slider_16, Seed=1)  # disabled
number_slider_17 = Slider(50, range=0..100)
vec2pt_7 = Vector2Pt(PointA=dup, PointB=popgeo, Unitize=True)  # -> Vector, Length; disabled
debrep_3 = DeconstructBrep(Brep=offset_4)  # -> Faces, Edges, Vertices
vec2pt_8 = Vector2Pt(PointA=dup_2, PointB=popgeo_2, Unitize=False)  # -> Vector, Length; disabled
number_slider_18 = Slider(6000, range=0..10000)
line_2 = LineSDL(Start=graft(brep_cp_4.Point), Direction=vec2pt_7.Vector, Length=number_slider_18)  # disabled
brep_3 = Brep(box_rectangle)  # disabled
line_3 = LineSDL(Start=graft(brep_cp_3.Point), Direction=vec2pt_8.Vector, Length=number_slider_18)  # disabled
deconstruct_brep_6 = DeconstructBrep(Brep=brep_3)  # -> Faces, Edges, Vertices; disabled
list_item_10 = ListItem(List=deconstruct_brep_6.Faces, Index=adjustheatmap_2, Wrap=True)  # disabled
number_slider_19 = Slider(50, range=0..100)  # disabled
quad_panels = QuadPanels(Surface=list_item_10, UDivisions=10, VDivisions=10)  # disabled
construct_point = ConstructPoint(XCoordinate=0, YCoordinate=0, ZCoordinate=0)  # disabled
number_slider_20 = Slider(0.01, range=0..0.01)  # disabled
number_slider_21 = Slider(0.5, range=0..1)  # disabled
mesh_4 = Mesh(quad_panels)  # disabled
trim_2 = TrimWithBrep(Curve=[line_2, line_3], Brep=brep_3)  # -> Inside, Outside; disabled
xy_plane_2 = XYPlane(Origin=Point(0, 0, 0))  # disabled
offset_mesh_2 = OffsetMesh(Mesh=mesh_4, Distance=number_slider_19, BothSides=expr("-x", number_slider_19), CreateSolid=True)  # -> flatten(Offset); disabled
end_points = EndPoints(Curve=trim_2.Inside)  # -> Start, End; disabled
offmsh = OffsetMesh(Mesh=mesh_4, Distance=expr("-x", number_slider_19), BothSides=0, CreateSolid=False)  # disabled
line_sdl = LineSDL(Start=xy_plane_2, Direction=Vector(0, 0, 1), Length=number_slider_21)  # disabled
flatten_tree = FlattenTree(Tree=end_points.End, Path="{0}")  # disabled
filter_14 = StreamFilter(Gate=num, Stream0=construct_point, Stream1=flatten_tree)  # disabled
graft_tree = GraftTree(Tree=offset_mesh_2, IncludeEmptyLists=True, IncludeNullItems=True)  # disabled
mesh_inclusion = MeshInclusion(Mesh=graft_tree, Point=filter_14, Strict=False)  # disabled
cull_pattern = CullPattern(List=flatten_tree, CullPattern=mesh_inclusion)  # disabled
stream_filter = StreamFilter(Gate=num_4, Stream0=line_sdl, Stream1=trim_2.Inside)  # disabled
list_length = ListLength(List=cull_pattern)  # disabled
panel_13 = Panel(graft_tree)  # disabled
panel_14 = Panel("0")  # disabled
panel_15 = Panel("7")  # disabled
meshpipe_3 = MeshPipe(Curve=stream_filter, Radius=Slider(0.5, range=0..1), Sides=6, Tolerance=10, Ending=0)
gradient = Gradient(
    LowerLimit=panel_14,
    UpperLimit=panel_15,
    Parameter=list_length,
    stops=[0: RGB(234, 38, 0), 0.176: RGB(234, 126, 0), 0.491: RGB(254, 244, 84), 0.84: RGB(173, 203, 249), 1: RGB(75, 107, 169)])  # disabled
mesh_join = MeshJoin(Meshes=flatten(meshpipe_3))
mesh_colours = MeshColours(Mesh=mesh_join, Colours=ColourSwatch(SwatchColor=RGBA(8, 255, 0, 176)))
mesh_colours_2 = MeshColours(Mesh=graft(offmsh), Colours=gradient)
area_20 = Area(Geometry=list_item)  # -> Area, Centroid
volume = Volume(Geometry=box_rectangle)  # -> Volume, Centroid
area_21 = Area(Geometry=list_item_3)  # -> Area, Centroid
area_22 = Area(Geometry=list_item_2)  # -> Area, Centroid
division_18 = Division(A=area_20.Area, B="1000000")
division_19 = Division(A=volume.Volume, B="1000000000")
mesh_join_2 = MeshJoin(Meshes=flatten(mesh_colours_2))
division_20 = Division(A=area_21.Area, B="1000000")
ma = MassAddition(Input=division_18)  # -> Result, PartialResults
division_21 = Division(A=area_22.Area, B="1000000")
mesh_5 = Mesh(mjoin)
mesh_6 = Mesh(mjoin_2)
roundd = RoundToDecimalPlace(NumberX=division_19, DecimalPlace="2", RoundType=0)  # -> Rounded, Difference
roundd_2 = RoundToDecimalPlace(NumberX=division_20, DecimalPlace="2", RoundType=0)  # -> Rounded, Difference
roundd_3 = RoundToDecimalPlace(NumberX=division_21, DecimalPlace="2", RoundType=0)  # -> Rounded, Difference
roundd_4 = RoundToDecimalPlace(NumberX=ma.Result, DecimalPlace="2", RoundType=0)  # -> Rounded, Difference
mesh_7 = Mesh(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)
concat_4 = Concatenate(FragmentA="Total Volume :", FragmentB=roundd.Rounded, FragmentC=" Cu M.")
concat_5 = Concatenate(FragmentA="Ceiling Area :", FragmentB=roundd_2.Rounded, FragmentC=" Sq M.")
concat_6 = Concatenate(FragmentA="Room Area :", FragmentB=roundd_3.Rounded, FragmentC=" Sq M.")
mesh_colours_3 = MeshColours(Mesh=mesh_7, Colours=ColourSwatch(SwatchColor=RGBA(230, 202, 92, 139)))
mjoin_3 = MeshJoin(Meshes=[mesh, offset_mesh, mesh_5, mesh_6])
mcol_6 = MeshColours(Mesh=mesh, Colours=ColourSwatch(SwatchColor=RGBA(92, 195, 230, 139)))
mjoin_4 = MeshJoin(Meshes=mcol_6)
msplit = MeshSplit(Mesh=mjoin_4, Splitters=flatten([mcol_4, mcol_5]))
item_5 = ListItem(List=msplit, Index=0, Wrap=True)
offmsh_2 = OffsetMesh(Mesh=item_5, Distance=number_slider_17, BothSides=expr("-x", number_slider_17), CreateSolid=True)  # -> flatten(Offset)
minc = MeshInclusion(Mesh=offmsh_2, Point=debrep_3.Vertices, Strict=True)
cull = CullPattern(List=debrep_3.Vertices, CullPattern=minc)
lng = ListLength(List=cull)
larger = LargerThan(FirstNumber=lng, SecondNumber="3")  # -> LargerThan, OrEqualTo
cull_2 = CullPattern(List=cull, CullPattern=larger.LargerThan)
panel_16 = Panel(cull_2)
clean = CleanTree(RemoveNulls=True, RemoveInvalid=True, RemoveEmpty=True, Tree=cull_2)
pline = PolyLine(Vertices=clean, Closed=True)  # -> flatten(Polyline)
srf = Surface(pline)
list_length_2 = ListLength(List=srf)
construct_domain = ConstructDomain(DomainStart=0, DomainEnd=list_length_2)
random = Random(Range=construct_domain, Number=filter_13, Seed=2)
area_23 = Area(Geometry=srf)  # -> Area, Centroid
dist_2 = Distance(PointA=area_2.Centroid, PointB=area_23.Centroid)
sort_2 = SortList(Keys=dist_2, ValuesA=srf)  # -> Keys, ValuesA
list_item_11 = ListItem(List=sort_2.ValuesA, Index=series_2, Wrap=True)
area_24 = Area(Geometry=[list_item_11, item_2])  # -> Area, Centroid
mass_addition = MassAddition(Input=area_24.Area)  # -> Result, PartialResults
mesh_colours_4 = MeshColours(Mesh=[list_item_11, item_2], Colours=RGB(213, 0, 255))
division_22 = Division(A=mass_addition.Result, B=num_7)
list_length_3 = ListLength(List=mesh_colours_4)
panel_17 = Panel(division_22)
bang = ExplodeTree(Data=list_length_3)  # -> Branch0, Branch1
mesh_join_3 = MeshJoin(Meshes=flatten(mesh_colours_4))
subtraction_2 = Subtraction(A=roundd_4.Rounded, B=division_22)
addition_3 = Addition(A=bang.Branch0, B=bang.Branch1)
mcol_7 = MeshColours(Mesh=offset_mesh, Colours=ColourSwatch(SwatchColor=RGBA(230, 202, 92, 139)))
mcol_8 = MeshColours(Mesh=mesh_5, Colours=ColourSwatch(SwatchColor=RGBA(230, 112, 92, 218)))
mcol_9 = MeshColours(Mesh=mesh_6, Colours=ColourSwatch(SwatchColor=RGBA(140, 92, 230, 218)))
merge = Merge(Data1=[mcol_7, mcol_8, mcol_9])  # -> flatten(Result)
mesh_join_4 = MeshJoin(Meshes=flatten(merge))
mesh_join_5 = MeshJoin(Meshes=flatten([merge, mesh_join_2]))
concat_7 = Concatenate(FragmentA="Wall Area :", FragmentB=subtraction_2, FragmentC=" Sq M.")
multiplication_4 = Multiplication(A=number_2, B="50")
filter_15 = StreamFilter(Gate=num, Stream0=mesh_join_4, Stream1=mesh_join_5)
number_slider_22 = Slider(0.2, range=0..1)
filter_16 = StreamFilter(Gate=number_3, Stream0=mesh_colours_3, Stream1=mesh_join_3)
mesh_8 = Mesh([mcol, mcol_2, mcol_3])
multiplication_5 = Multiplication(A=multiplication_4, B=addition_3)
ceiling_ab_coef = Slider(0.5, range=0..1)
mesh_join_6 = MeshJoin(Meshes=flatten([filter_16, filter_15, mesh_colours, item_5, mesh_8]))
multiplication_6 = Multiplication(A=division_21, B=Slider(0.04, range=0..0.1))
multiplication_7 = Multiplication(A=ma.Result, B=number_slider_22)
multiplication_8 = Multiplication(A=division_20, B=number_slider_22)
concat_8 = Concatenate(FragmentA="No of Absorbers added (Walls): ", FragmentB=bang.Branch0)
concat_9 = Concatenate(FragmentA="No of Absorbers added (Ceiling): ", FragmentB=bang.Branch1)
concat_10 = Concatenate(FragmentA=multiplication_5, FragmentB=" €")
concat_11 = Concatenate(FragmentA="Absorber Material :", FragmentB=number_2)
concat_12 = Concatenate(FragmentA="Cost of Absorbers :", FragmentB=concat_10)
multiplication_9 = Multiplication(A=division_22, B=ceiling_ab_coef)
ma_2 = MassAddition(Input=flatten([multiplication_6, multiplication_7, multiplication_8, multiplication_9]))  # -> Result, PartialResults

# ---- group: RH_OUT:meshout
mesh_9 = Mesh(mesh_join_6)

# ----
panel_18 = Panel(concat_9)
concat_13 = Concatenate(FragmentA="Total Absorption (A) : ", FragmentB=ma_2.Result)
multiplication_10 = Multiplication(A="0.161", B=division_19)
multiplication_11 = Multiplication(A=ma_2.Result, B=Slider(1000, range=0..1000))
division_23 = Division(A=multiplication_10, B=multiplication_11)
concat_14 = Concatenate(FragmentA="Reverberation Time", FragmentC="(T 60) :", FragmentB=division_23, FragmentD=" s")
merge_2 = Merge(
    Data2=flatten(concat_6),
    Data6=flatten(concat_14),
    Data7=flatten(concat_8),
    Data8=flatten(concat_9),
    Data9=flatten(concat_11),
    Data10=flatten(concat_12))
panel_19 = Panel(merge_2)
panel_20 = Panel(ma_2.Result)
bang_2 = ExplodeTree(Data=division_22)  # -> Branch0, Branch1
flatten = FlattenTree(Tree=roundd_4.Rounded, Path="{0}")
flatten_2 = FlattenTree(Tree=roundd_3.Rounded, Path="{0}")
flatten_3 = FlattenTree(Tree=roundd_2.Rounded, Path="{0}")
flatten_4 = FlattenTree(Tree=roundd.Rounded, Path="{0}")
flatten_5 = FlattenTree(Tree=bang.Branch0, Path="{0}")
flatten_6 = FlattenTree(Tree=bang.Branch1, Path="{0}")
flatten_7 = FlattenTree(Tree=bang_2.Branch1, Path="{0}")
flatten_8 = FlattenTree(Tree=bang_2.Branch0, Path="{0}")

# ---- group: RH_OUT:data_absorberArea_wall
txt = Text(flatten_8)

# ---- group: RH_OUT:data_absorberArea_ceiling
txt_2 = Text(flatten_7)

# ---- group: RH_OUT:data_wallArea
txt_3 = Text(flatten)

# ---- group: RH_OUT:data_floorArea
txt_4 = Text(flatten_2)

# ---- group: RH_OUT:data_ceilingArea
txt_5 = Text(flatten_3)

# ---- group: RH_OUT:data_totalVolume
txt_6 = Text(flatten_4)

# ---- group: RH_OUT:data_noOfAbs_wall
txt_7 = Text(flatten_5)

# ---- group: RH_OUT:data_noOfAbs_ceiling
txt_8 = Text(flatten_6)

# ----
panel_21 = Panel(txt)
panel_22 = Panel(txt_2)
panel_23 = Panel(txt_3)
panel_24 = Panel(txt_4)
panel_25 = Panel(txt_5)
panel_26 = Panel(txt_6)
panel_27 = Panel(txt_7)
panel_28 = Panel(txt_8)
