# Grasshopper definition form_io_main_003.gh (Grasshopper 1.0.8)
# plug-ins: ShapeDiverForGrasshopper

sddp = ShapeDiverDocumentPayload({AbsoluteTolerance=0, AngleTolerance=0, DistanceDisplayPrecision=0, GltfVersion="Gltf2", GrasshopperVersion="1.0.0008", InputGroups="{}", OutputGroups="{}", RelativeTolerance=0, RhinoVersion="8.14.24345.15001", UnitSystem=0, VersionCreated="1.22.0.0", VersionSaved="1.26.0.0"})
podium_lenght = GetNumber(
    Slider(33.596, range=20..120),
    AtLeast=1,
    AtMost=1,
    Maximum=1.797693135e+308,
    Minimum=-1.797693135e+308,
    TreeAccess=False)
building_type = GetInteger(Slider(0, range=0..5), AtLeast=1, AtMost=1, Maximum=2147483647, Minimum=-2147483648, TreeAccess=False)
tower_num_floors = GetInteger(Slider(9, range=0..100), AtLeast=1, AtMost=1, Maximum=2147483647, Minimum=-2147483648, TreeAccess=False)
courtyard_offset = GetNumber(Slider(2, range=0..10), AtLeast=1, AtMost=1, Maximum=1.797693135e+308, Minimum=-1.797693135e+308, TreeAccess=False)
podium_width = GetNumber(
    Slider(22.763, range=20..120),
    AtLeast=1,
    AtMost=1,
    Maximum=1.797693135e+308,
    Minimum=-1.797693135e+308,
    TreeAccess=False)
podium_no_of_floors = GetInteger(Slider(2, range=0..100), AtLeast=1, AtMost=1, Maximum=2147483647, Minimum=-2147483648, TreeAccess=False)
staggered_offset = GetNumber(Slider(2.5, range=0..10), AtLeast=1, AtMost=1, Maximum=1.797693135e+308, Minimum=-1.797693135e+308, TreeAccess=False)
polyline_offset = GetNumber(Slider(2, range=0..10), AtLeast=1, AtMost=1, Maximum=1.797693135e+308, Minimum=-1.797693135e+308, TreeAccess=False)
floor_height = GetNumber(Slider(3.5, range=3..5), AtLeast=1, AtMost=1, Maximum=1.797693135e+308, Minimum=-1.797693135e+308, TreeAccess=False)
detail_mode = GetNumber(Slider(0, range=0..1), AtLeast=1, AtMost=1, Maximum=1.797693135e+308, Minimum=-1.797693135e+308, TreeAccess=False)
xy = XYPlane(Origin=Point(0, 0, 0))
podium_no_of_floors_2 = Number(podium_no_of_floors)
podium_lenght_2 = Number(podium_lenght)
building_type_2 = Number(building_type)
tower_num_floors_2 = Number(tower_num_floors)
podium_width_2 = Number(podium_width)
staggered_offset_2 = Number(staggered_offset)
courtyard_offset_2 = Number(courtyard_offset)
floor_height_2 = Number(floor_height)
floor_height_3 = Number(floor_height)
polyline_offset_2 = Number(polyline_offset)
xy_2 = XYPlane(Origin=Point(0, 0, 0))
multiplication = Multiplication(A=podium_no_of_floors_2, B=floor_height_2)
rectangle = Rectangle(Plane=xy_2, XSize=podium_lenght_2, YSize=podium_width_2, Radius=0)  # -> Rectangle, Length
area = Area(Geometry=rectangle.Rectangle)  # -> Area, Centroid
vec2pt = Vector2Pt(PointA=area.Centroid, PointB=xy_2, Unitize=False)  # -> Vector, Length
move = Move(Geometry=rectangle.Rectangle, Motion=vec2pt.Vector)  # -> Geometry, Transform
Z = UnitZ(Factor=multiplication)
series = Series(Start=0, Step=floor_height_2, Count=podium_no_of_floors_2)
area_2 = Area(Geometry=move.Geometry)  # -> Area, Centroid
move_2 = Move(Geometry=move.Geometry, Motion=Z)  # -> Geometry, Transform
Z_2 = UnitZ(Factor=series)
offset = OffsetCurve(Curve=move.Geometry, Distance=Slider(9, range=0..10), Corners=1)
offset_2 = OffsetCurve(Curve=move.Geometry, Distance=Slider(30, range=0..100), Corners=1)
move_3 = Move(Geometry=move.Geometry, Motion=Z_2)  # -> Geometry, Transform
loft = Loft(
    Curves=flatten([offset, offset_2]),
    Options={Adjust=False, Closed=False, LoftEnds=0, LoftSimp=0, LoftType=0, Rebuild=10, Refit=0.01})
number_slider = Slider(20, range=0..100)
cull_i = CullIndex(List=move_3.Geometry, Indices=Slider(0, range=0..100), Wrap=True)
loft_2 = Loft(
    Curves=flatten([offset_2, move.Geometry]),
    Options={Adjust=False, Closed=False, LoftEnds=0, LoftSimp=0, LoftType=0, Rebuild=10, Refit=0.01})
polyline_for_tower = Curve(move_2.Geometry)
gate = StreamGate(Stream=polyline_for_tower, Gate=building_type_2)  # -> Target0, Target1, Target2, Target3, Target4, Target5
popgeo = PopulateGeometry(Geometry=loft, Count=number_slider, Seed=1)
random = Random(Range="3 To 5", Number=number_slider, Seed=2)
srf = Surface([move_3.Geometry, move_2.Geometry])
Z_3 = UnitZ(Factor=random)
number_slider_2 = Slider(80, range=0..1000)
move_4 = Move(Geometry=popgeo, Motion=Z_3)  # -> Geometry, Transform
random_2 = Random(Range="1.5 To 3", Number=number_slider, Seed=2)
cyl = Cylinder(Base=popgeo, Radius=Slider(0.01, range=0..0.01), Length=random)
msphere = MeshSphere(Base=move_4.Geometry, Radius=random_2, UCount=10, VCount=20)

# ---- group: staggered
neg = Negative(Value=polyline_offset_2)
offset_3 = OffsetCurve(Curve=gate.Target3, Distance=neg, Corners=1)
series_2 = Series(Start=0, Step=floor_height_3, Count=tower_num_floors_2)
Z_4 = UnitZ(Factor=series_2)
division = Division(A=tower_num_floors_2, B="2")
series_3 = Series(Start=0, Step="2", Count=division)
move_5 = Move(Geometry=offset_3, Motion=Z_4)  # -> Geometry, Transform
X = UnitX(Factor=staggered_offset_2)
Y = UnitY(Factor=staggered_offset_2)
item = ListItem(List=move_5.Geometry, Index=series_3, Wrap=True)
cull_i_2 = CullIndex(List=move_5.Geometry, Indices=series_3, Wrap=True)
move_6 = Move(Geometry=item, Motion=X)  # -> Geometry, Transform
move_7 = Move(Geometry=cull_i_2, Motion=Y)  # -> Geometry, Transform
srf_2 = Surface([move_6.Geometry, move_7.Geometry])

# ----
trees = ColourSwatch(SwatchColor=RGBA(35, 54, 26, 195))
grass = ColourSwatch(SwatchColor=RGB(106, 133, 78))
trees_2 = Data([msphere, cyl])
custom_preview = CustomPreview(Geometry=trees_2, Material=trees)
mcol = MeshColours(Mesh=trees_2, Colours=trees)
mcol_2 = MeshColours(Mesh=loft_2, Colours=grass)

Z_5 = UnitZ(Factor=floor_height_3)
number_slider_3 = Slider(8.2, range=0..10)
mullions = Mesh([<mesh referenced from the Rhino model> x5])
balcony = Mesh(<mesh referenced from the Rhino model>)
glass = Mesh([<mesh referenced from the Rhino model> x4])
yz = YZPlane(Origin=Point(0, 0, 0))
division_2 = Division(A=podium_lenght_2, B=number_slider_3)
Y_2 = UnitY(Factor=division_2)
division_3 = Division(A=podium_width_2, B=number_slider_3)
mcol_3 = MeshColours(Mesh=balcony, Colours=ColourSwatch(SwatchColor=RGBA(107, 107, 107, 169)))
mcol_4 = MeshColours(Mesh=glass, Colours=ColourSwatch(SwatchColor=RGBA(139, 154, 158, 106)))
mcol_5 = MeshColours(Mesh=mullions, Colours=ColourSwatch(SwatchColor=RGBA(0, 0, 0, 144)))
move_8 = Move(Geometry=yz, Motion=Y_2)  # -> Geometry, Transform
srf_3 = Surface([cull_i, move_2.Geometry])
debrep = DeconstructBrep(Brep=srf_3)  # -> Faces, Edges, Vertices
item_2 = ListItem(List=debrep.Edges, Index=Slider(0, range=0..10), Wrap=True)
X_2 = UnitX(Factor=number_slider_3)
xz = XZPlane(Origin=Point(0, 0, 0))
mjoin = MeshJoin(Meshes=[mcol_4, mcol_5, mcol_3])
mjoin_2 = MeshJoin(Meshes=[mcol_4, mcol_5])
xy_3 = XYPlane(Origin=Point(0, 0, 0))
item_3 = ListItem(List=debrep.Edges, Index=Slider(1, range=0..10), Wrap=True)
multiplication_2 = Multiplication(A=X_2, B=Slider(0.8, range=0..10))
move_9 = Move(Geometry=item_2, Motion=multiplication_2)  # -> Geometry, Transform
Y_3 = UnitY(Factor=number_slider_3)
item_4 = ListItem(List=debrep.Edges, Index=Slider(3, range=0..10), Wrap=True)
mirror = Mirror(Geometry=mjoin, Plane=xz)  # -> Geometry, Transform
rotate = Rotate(Geometry=mjoin_2, Angle=1.570796327, Plane=PlaneXY(0, 0, 0))  # -> Geometry, Transform
move_10 = Move(Geometry=item_3, Motion=Y_3)  # -> Geometry, Transform
Y_4 = UnitY(Factor=number_slider_3)
multiplication_3 = Multiplication(A=division_3, B=Slider(1.8, range=0..10))
multiplication_4 = Multiplication(A=Y_4, B=Slider(1, range=0..10))
move_11 = Move(Geometry=item_4, Motion=multiplication_4)  # -> Geometry, Transform
item_5 = ListItem(List=debrep.Edges, Index=Slider(2, range=0..10), Wrap=True)
Z_6 = UnitZ(Factor=floor_height_3)
multiplication_5 = Multiplication(A=X_2, B=Slider(0, range=0..10))
move_12 = Move(Geometry=item_5, Motion=multiplication_5)  # -> Geometry, Transform
divide = DivideCurve(Curve=[move_9.Geometry, move_12.Geometry], Count=multiplication_3, Kinks=False)  # -> Points, Tangents, Parameters
cull_i_3 = CullIndex(List=divide.Points, Indices=-1, Wrap=True)
vec2pt_2 = Vector2Pt(PointA=xy_3, PointB=cull_i_3, Unitize=False)  # -> Vector, Length
move_13 = Move(Geometry=mjoin_2, Motion=vec2pt_2.Vector)  # -> Geometry, Transform
number_slider_4 = Slider(1, range=0..1)

# ---- group: H-shaped
neg_2 = Negative(Value=polyline_offset_2)
offset_4 = OffsetCurve(Curve=gate.Target5, Distance=neg_2, Corners=1)
number_slider_5 = Slider(3, range=0..10)
sdivide = DivideSurface(Surface=offset_4, UCount=number_slider_5, VCount=number_slider_5)  # -> Points, Normals, Parameters
bang = ExplodeTree(Data=sdivide.Points)  # -> Branch0, Branch1, Branch2, Branch3
item_6 = ListItem(List=bang.Branch0, Index=0, Wrap=True)
item_7 = ListItem(List=bang.Branch0, Index=3, Wrap=True)
item_8 = ListItem(List=bang.Branch1, Index=3, Wrap=True)
item_9 = ListItem(List=bang.Branch1, Index=2, Wrap=True)
item_10 = ListItem(List=bang.Branch2, Index=3, Wrap=True)
item_11 = ListItem(List=bang.Branch2, Index=2, Wrap=True)
item_12 = ListItem(List=bang.Branch3, Index=0, Wrap=True)
item_13 = ListItem(List=bang.Branch3, Index=3, Wrap=True)
item_14 = ListItem(List=bang.Branch2, Index=0, Wrap=True)
item_15 = ListItem(List=bang.Branch1, Index=0, Wrap=True)
item_16 = ListItem(List=bang.Branch2, Index=1, Wrap=True)
item_17 = ListItem(List=bang.Branch1, Index=1, Wrap=True)
merge = Merge(
    Data1=flatten(item_6),
    Data2=flatten(item_7),
    Data3=flatten(item_8),
    Data4=flatten(item_9),
    Data5=flatten(item_11),
    Data6=flatten(item_10),
    Data7=flatten(item_13),
    Data8=flatten(item_12),
    Data9=flatten(item_14),
    Data10=flatten(item_16),
    Data11=flatten(item_17),
    Data12=flatten(item_15))
pline = PolyLine(Vertices=merge, Closed=True)
series_4 = Series(Start=0, Step=floor_height_3, Count=tower_num_floors_2)
Z_7 = UnitZ(Factor=series_4)
move_14 = Move(Geometry=pline, Motion=Z_7)  # -> Geometry, Transform

# ----
cull_i_4 = CullIndex(List=move_14.Geometry, Indices=0, Wrap=True)

# ---- group: H-shaped (continued)
srf_4 = Surface(cull_i_4)

# ---- group: L-shaped
neg_3 = Negative(Value=polyline_offset_2)
offset_5 = OffsetCurve(Curve=gate.Target4, Distance=neg_3, Corners=1)
debrep_2 = DeconstructBrep(Brep=offset_5)  # -> Faces, Edges, Vertices
item_18 = ListItem(List=debrep_2.Edges, Index=Slider(1, range=0..10), Wrap=True)
item_19 = ListItem(List=debrep_2.Edges, Index=Slider(2, range=0..10), Wrap=True)
area_3 = Area(Geometry=offset_5)  # -> Area, Centroid
midpt = CurveMiddle(Curve=item_18)
midpt_2 = CurveMiddle(Curve=item_19)
item_20 = ListItem(List=debrep_2.Vertices, Index=3, Wrap=True)
item_21 = ListItem(List=debrep_2.Vertices, Index=0, Wrap=True)
item_22 = ListItem(List=debrep_2.Vertices, Index=1, Wrap=True)
merge_2 = Merge(
    Data1=flatten(item_22),
    Data2=flatten(item_21),
    Data3=flatten(item_20),
    Data4=flatten(midpt_2),
    Data5=flatten(area_3.Centroid),
    Data6=flatten(midpt))
series_5 = Series(Start=0, Step=floor_height_3, Count=tower_num_floors_2)
pline_2 = PolyLine(Vertices=merge_2, Closed=True)
Z_8 = UnitZ(Factor=series_5)
move_15 = Move(Geometry=pline_2, Motion=Z_8)  # -> Geometry, Transform

# ----
cull_i_5 = CullIndex(List=move_15.Geometry, Indices=0, Wrap=True)

# ---- group: L-shaped (continued)
srf_5 = Surface(cull_i_5)

# ---- group: two towers
neg_4 = Negative(Value=polyline_offset_2)
offset_6 = OffsetCurve(Curve=gate.Target1, Distance=neg_4, Corners=1)
debrep_3 = DeconstructBrep(Brep=offset_6)  # -> Faces, Edges, Vertices
debrep_4 = DeconstructBrep(Brep=offset_6)  # -> Faces, Edges, Vertices
area_4 = Area(Geometry=offset_6)  # -> Area, Centroid
item_23 = ListItem(List=debrep_4.Vertices, Index=0, Wrap=True)
area_5 = Area(Geometry=offset_6)  # -> Area, Centroid
item_24 = ListItem(List=debrep_4.Edges, Index=0, Wrap=True)
item_25 = ListItem(List=debrep_4.Edges, Index=Slider(3, range=0..10), Wrap=True)
item_26 = ListItem(List=debrep_3.Edges, Index=Slider(2, range=0..10), Wrap=True)
item_27 = ListItem(List=debrep_3.Edges, Index=Slider(5, range=0..10), Wrap=True)
item_28 = ListItem(List=debrep_3.Vertices, Index=Slider(2, range=0..10), Wrap=True)
midpt_3 = CurveMiddle(Curve=item_25)
midpt_4 = CurveMiddle(Curve=item_27)
midpt_5 = CurveMiddle(Curve=item_24)
midpt_6 = CurveMiddle(Curve=item_26)
srf4pt = _4PointSurface(CornerA=area_4.Centroid, CornerB=midpt_5, CornerC=item_23, CornerD=midpt_3)
srf4pt_2 = _4PointSurface(CornerA=area_5.Centroid, CornerB=midpt_6, CornerC=item_28, CornerD=midpt_4)
series_6 = Series(Start=0, Step=floor_height_3, Count=tower_num_floors_2)
Z_9 = UnitZ(Factor=series_6)
move_16 = Move(Geometry=graft([srf4pt, srf4pt_2]), Motion=Z_9)  # -> Geometry, Transform

# ----
cull_i_6 = CullIndex(List=move_16.Geometry, Indices=0, Wrap=True)

# ---- group: two towers (continued)
srf_6 = Surface(cull_i_6)

# ---- group: courtyard
neg_5 = Negative(Value=polyline_offset_2)
offset_7 = OffsetCurve(Curve=gate.Target2, Distance=neg_5, Corners=1)
series_7 = Series(Start=0, Step=floor_height_3, Count=tower_num_floors_2)
Z_10 = UnitZ(Factor=series_7)
move_17 = Move(Geometry=offset_7, Motion=Z_10)  # -> Geometry, Transform
neg_6 = Negative(Value=courtyard_offset_2)
offset_8 = OffsetCurve(Curve=move_17.Geometry, Distance=expr("x+1", neg_6), Corners=1)  # -> flatten(Curve)

# ----
cull_i_7 = CullIndex(List=flatten(move_17.Geometry), Indices=0, Wrap=True)
cull_i_8 = CullIndex(List=offset_8, Indices=0, Wrap=True)
graft = GraftTree(Tree=cull_i_8, IncludeEmptyLists=True, IncludeNullItems=True)

# ---- group: courtyard (continued)
graft_2 = GraftTree(Tree=cull_i_7, IncludeEmptyLists=True, IncludeNullItems=True)
loft_3 = Loft(
    Curves=[graft_2, graft],
    Options={Adjust=False, Closed=False, LoftEnds=0, LoftSimp=0, LoftType=0, Rebuild=10, Refit=0.01})  # -> flatten(Loft)

# ---- group: single tower
neg_7 = Negative(Value=polyline_offset_2)
offset_9 = OffsetCurve(Curve=gate.Target0, Distance=neg_7, Corners=1)
series_8 = Series(Start=0, Step=floor_height_3, Count=tower_num_floors_2)
Z_11 = UnitZ(Factor=series_8)
move_18 = Move(Geometry=offset_9, Motion=Z_11)  # -> Geometry, Transform

# ----
cull_i_9 = CullIndex(List=move_18.Geometry, Indices=0, Wrap=True)

# ---- group: single tower (continued)
srf_7 = Surface(cull_i_9)

# ----
surfaces = Data([srf_7, srf_6, srf_2, srf_5, srf_4, loft_3])

podium_floors = Surface(srf)
tower_floors = Mesh(surfaces)
mcol_6 = MeshColours(Mesh=podium_floors, Colours=ColourSwatch(SwatchColor=RGBA(191, 33, 178, 98)))
mcol_7 = MeshColours(Mesh=tower_floors, Colours=ColourSwatch(SwatchColor=RGBA(33, 178, 191, 87)))

clean = CleanTree(RemoveNulls=True, RemoveInvalid=True, RemoveEmpty=Toggle(True), Tree=surfaces)
gate_2 = StreamGate(Stream=clean, Gate=detail_mode)  # -> Target0, Target1
extr = Extrude(Base=gate_2.Target1, Direction=expr("-x", Z_5))
debrep_5 = DeconstructBrep(Brep=extr)  # -> Faces, Edges, Vertices
item_29 = ListItem(List=debrep_5.Faces, Index="1", Wrap=True)
item_30 = ListItem(List=debrep_5.Faces, Index="3", Wrap=True)
item_31 = ListItem(List=debrep_5.Faces, Index="2", Wrap=True)
item_32 = ListItem(List=debrep_5.Faces, Index="0", Wrap=True)
debrep_6 = DeconstructBrep(Brep=item_29)  # -> Faces, Edges, Vertices
debrep_7 = DeconstructBrep(Brep=item_30)  # -> Faces, Edges, Vertices
debrep_8 = DeconstructBrep(Brep=item_32)  # -> Faces, Edges, Vertices
debrep_9 = DeconstructBrep(Brep=item_31)  # -> Faces, Edges, Vertices
item_33 = ListItem(List=debrep_6.Edges, Index=Slider(1, range=0..1), Wrap=True)
item_34 = ListItem(List=debrep_7.Edges, Index=Slider(2, range=0..10), Wrap=True)
divide_2 = DivideCurve(Curve=item_33, Count=division_2, Kinks=False)  # -> Points, Tangents, Parameters
divide_3 = DivideCurve(Curve=item_34, Count=division_2, Kinks=False)  # -> Points, Tangents, Parameters
item_35 = ListItem(List=debrep_9.Edges, Index=Slider(1, range=0..1), Wrap=True)
item_36 = ListItem(List=debrep_8.Edges, Index=Slider(4, range=0..10), Wrap=True)
cull_i_10 = CullIndex(List=divide_3.Points, Indices=-1, Wrap=True)
cull_i_11 = CullIndex(List=divide_2.Points, Indices=0, Wrap=True)
panel = Panel(cull_i_11)
divide_4 = DivideCurve(Curve=[item_36, move_11.Geometry], Count=division_3, Kinks=False)  # -> Points, Tangents, Parameters
divide_5 = DivideCurve(Curve=[item_35, move_10.Geometry], Count=division_3, Kinks=False)  # -> Points, Tangents, Parameters
vec2pt_3 = Vector2Pt(PointA=xy_3, PointB=cull_i_10, Unitize=False)  # -> Vector, Length
vec2pt_4 = Vector2Pt(PointA=xy_3, PointB=cull_i_11, Unitize=False)  # -> Vector, Length
cull_i_12 = CullIndex(List=divide_4.Points, Indices=0, Wrap=True)
cull_i_13 = CullIndex(List=divide_5.Points, Indices=-1, Wrap=True)
move_19 = Move(Geometry=mjoin, Motion=vec2pt_4.Vector)  # -> Geometry, Transform
move_20 = Move(Geometry=mirror.Geometry, Motion=vec2pt_3.Vector)  # -> Geometry, Transform
vec2pt_5 = Vector2Pt(PointA=xy_3, PointB=cull_i_12, Unitize=False)  # -> Vector, Length
vec2pt_6 = Vector2Pt(PointA=xy_3, PointB=cull_i_13, Unitize=False)  # -> Vector, Length

mesh_join = MeshJoin(Meshes=flatten([mcol_7, mcol_6, mcol, mcol_2]))

move_21 = Move(Geometry=rotate.Geometry, Motion=vec2pt_5.Vector)  # -> Geometry, Transform
move_22 = Move(Geometry=rotate.Geometry, Motion=vec2pt_6.Vector)  # -> Geometry, Transform
move_23 = Move(
    Geometry=[move_19.Geometry, move_20.Geometry, move_21.Geometry, move_22.Geometry, move_13.Geometry],
    Motion=expr("-x", Z_6))  # -> Geometry, Transform
mesh_join_2 = MeshJoin(Meshes=flatten([mcol_7, mcol_6, mcol, mcol_2, move_23.Geometry]))
filter = StreamFilter(Gate=detail_mode, Stream0=mesh_join, Stream1=mesh_join_2)
scale = Scale(Geometry=filter, Center=Point(0, 0, 0), Factor=Slider(5e-08, range=0..1e-07))  # -> Geometry, Transform

# ---- group: RH_OUT:meshout
mesh = Mesh(scale.Geometry)
