# Grasshopper definition form_io_main_140142025.gh (Grasshopper 1.0.8)

podium_lenght = GetNumber(
    Slider(50000, range=0..100000),
    AtLeast=1,
    AtMost=1,
    Maximum=1.797693135e+308,
    Minimum=-1.797693135e+308,
    TreeAccess=False)
building_type = GetInteger(Slider(0, range=0..5), AtLeast=1, AtMost=1, Maximum=2147483647, Minimum=-2147483648, TreeAccess=False)
tower_num_floors = GetInteger(Slider(15, range=0..100), AtLeast=1, AtMost=1, Maximum=2147483647, Minimum=-2147483648, TreeAccess=False)
courtyard_offset = GetNumber(
    Slider(21560, range=5000..50000),
    AtLeast=1,
    AtMost=1,
    Maximum=1.797693135e+308,
    Minimum=-1.797693135e+308,
    TreeAccess=False)
podium_width = GetNumber(
    Slider(50000, range=0..100000),
    AtLeast=1,
    AtMost=1,
    Maximum=1.797693135e+308,
    Minimum=-1.797693135e+308,
    TreeAccess=False)
podium_no_of_floors = GetInteger(Slider(15, range=0..100), AtLeast=1, AtMost=1, Maximum=2147483647, Minimum=-2147483648, TreeAccess=False)
floor_height = GetNumber(Slider(3500, range=0..10000), AtLeast=1, AtMost=1, Maximum=1.797693135e+308, Minimum=-1.797693135e+308, TreeAccess=False)
staggered_offset = GetNumber(Slider(2500, range=0..10000), AtLeast=1, AtMost=1, Maximum=1.797693135e+308, Minimum=-1.797693135e+308, TreeAccess=False)
polyline_offset = GetNumber(
    Slider(10000, range=0..10000),
    AtLeast=1,
    AtMost=1,
    Maximum=1.797693135e+308,
    Minimum=-1.797693135e+308,
    TreeAccess=False)
podium_no_of_floors_2 = Number(podium_no_of_floors)
podium_lenght_2 = Number(podium_lenght)
building_type_2 = Number(building_type)
tower_num_floors_2 = Number(tower_num_floors)
podium_width_2 = Number(podium_width)
staggered_offset_2 = Number(staggered_offset)
courtyard_offset_2 = Number(courtyard_offset)
floor_height_2 = Number(floor_height)
floor_height_3 = Number(floor_height)
polyline_offset_2 = Number(polyline_offset)
xy = XYPlane(Origin=Point(0, 0, 0))
rectangle = Rectangle(Plane=xy, XSize=podium_lenght_2, YSize=podium_width_2, Radius=0)  # -> Rectangle, Length
multiplication = Multiplication(A=podium_no_of_floors_2, B=floor_height_2)
area = Area(Geometry=rectangle.Rectangle)  # -> Area, Centroid
Z = UnitZ(Factor=multiplication)
series = Series(Start=0, Step=floor_height_2, Count=podium_no_of_floors_2)
move = Move(Geometry=rectangle.Rectangle, Motion=Z)  # -> Geometry, Transform
Z_2 = UnitZ(Factor=series)
move_2 = Move(Geometry=rectangle.Rectangle, Motion=Z_2)  # -> Geometry, Transform
srf = Surface([move_2.Geometry, move.Geometry])
polyline_for_tower = Curve(move.Geometry)
gate = StreamGate(Stream=polyline_for_tower, Gate=building_type_2)  # -> Target0, Target1, Target2, Target3, Target4, Target5

# ---- group: H-shaped
neg = Negative(Value=polyline_offset_2)
offset = OffsetCurve(Curve=gate.Target5, Distance=neg, Corners=1)
number_slider = Slider(3, range=0..10)
sdivide = DivideSurface(Surface=offset, UCount=number_slider, VCount=number_slider)  # -> Points, Normals, Parameters
bang = ExplodeTree(Data=sdivide.Points)  # -> Branch0, Branch1, Branch2, Branch3
item = ListItem(List=bang.Branch0, Index=0, Wrap=True)
item_2 = ListItem(List=bang.Branch0, Index=3, Wrap=True)
item_3 = ListItem(List=bang.Branch1, Index=3, Wrap=True)
item_4 = ListItem(List=bang.Branch1, Index=2, Wrap=True)
item_5 = ListItem(List=bang.Branch2, Index=3, Wrap=True)
item_6 = ListItem(List=bang.Branch2, Index=2, Wrap=True)
item_7 = ListItem(List=bang.Branch3, Index=0, Wrap=True)
item_8 = ListItem(List=bang.Branch3, Index=3, Wrap=True)
item_9 = ListItem(List=bang.Branch2, Index=0, Wrap=True)
item_10 = ListItem(List=bang.Branch1, Index=0, Wrap=True)
item_11 = ListItem(List=bang.Branch2, Index=1, Wrap=True)
item_12 = ListItem(List=bang.Branch1, Index=1, Wrap=True)
merge = Merge(
    Data1=flatten(item),
    Data2=flatten(item_2),
    Data3=flatten(item_3),
    Data4=flatten(item_4),
    Data5=flatten(item_6),
    Data6=flatten(item_5),
    Data7=flatten(item_8),
    Data8=flatten(item_7),
    Data9=flatten(item_9),
    Data10=flatten(item_11),
    Data11=flatten(item_12),
    Data12=flatten(item_10))
pline = PolyLine(Vertices=merge, Closed=True)
series_2 = Series(Start=0, Step=floor_height_3, Count=tower_num_floors_2)
Z_3 = UnitZ(Factor=series_2)
move_3 = Move(Geometry=pline, Motion=Z_3)  # -> Geometry, Transform
srf_2 = Surface(move_3.Geometry)

# ---- group: L-shaped
neg_2 = Negative(Value=polyline_offset_2)
offset_2 = OffsetCurve(Curve=gate.Target4, Distance=neg_2, Corners=1)
debrep = DeconstructBrep(Brep=offset_2)  # -> Faces, Edges, Vertices
item_13 = ListItem(List=debrep.Edges, Index=Slider(1, range=0..10), Wrap=True)
item_14 = ListItem(List=debrep.Edges, Index=Slider(2, range=0..10), Wrap=True)
area_2 = Area(Geometry=offset_2)  # -> Area, Centroid
midpt = CurveMiddle(Curve=item_13)
midpt_2 = CurveMiddle(Curve=item_14)
item_15 = ListItem(List=debrep.Vertices, Index=3, Wrap=True)
item_16 = ListItem(List=debrep.Vertices, Index=0, Wrap=True)
item_17 = ListItem(List=debrep.Vertices, Index=1, Wrap=True)
merge_2 = Merge(
    Data1=flatten(item_17),
    Data2=flatten(item_16),
    Data3=flatten(item_15),
    Data4=flatten(midpt_2),
    Data5=flatten(area_2.Centroid),
    Data6=flatten(midpt))
series_3 = Series(Start=0, Step=floor_height_3, Count=tower_num_floors_2)
pline_2 = PolyLine(Vertices=merge_2, Closed=True)
Z_4 = UnitZ(Factor=series_3)
move_4 = Move(Geometry=pline_2, Motion=Z_4)  # -> Geometry, Transform
srf_3 = Surface(move_4.Geometry)

# ---- group: two towers
neg_3 = Negative(Value=polyline_offset_2)
offset_3 = OffsetCurve(Curve=gate.Target1, Distance=neg_3, Corners=1)
debrep_2 = DeconstructBrep(Brep=offset_3)  # -> Faces, Edges, Vertices
debrep_3 = DeconstructBrep(Brep=offset_3)  # -> Faces, Edges, Vertices
area_3 = Area(Geometry=offset_3)  # -> Area, Centroid
item_18 = ListItem(List=debrep_3.Vertices, Index=0, Wrap=True)
area_4 = Area(Geometry=offset_3)  # -> Area, Centroid
item_19 = ListItem(List=debrep_3.Edges, Index=0, Wrap=True)
item_20 = ListItem(List=debrep_3.Edges, Index=Slider(3, range=0..10), Wrap=True)
item_21 = ListItem(List=debrep_2.Edges, Index=Slider(2, range=0..10), Wrap=True)
item_22 = ListItem(List=debrep_2.Edges, Index=Slider(5, range=0..10), Wrap=True)
item_23 = ListItem(List=debrep_2.Vertices, Index=Slider(2, range=0..10), Wrap=True)
midpt_3 = CurveMiddle(Curve=item_20)
midpt_4 = CurveMiddle(Curve=item_22)
midpt_5 = CurveMiddle(Curve=item_19)
midpt_6 = CurveMiddle(Curve=item_21)
srf4pt = _4PointSurface(CornerA=area_3.Centroid, CornerB=midpt_5, CornerC=item_18, CornerD=midpt_3)
srf4pt_2 = _4PointSurface(CornerA=area_4.Centroid, CornerB=midpt_6, CornerC=item_23, CornerD=midpt_4)
series_4 = Series(Start=0, Step=floor_height_3, Count=tower_num_floors_2)
Z_5 = UnitZ(Factor=series_4)
move_5 = Move(Geometry=graft([srf4pt, srf4pt_2]), Motion=Z_5)  # -> Geometry, Transform
srf_4 = Surface(move_5.Geometry)

# ---- group: courtyard
neg_4 = Negative(Value=polyline_offset_2)
offset_4 = OffsetCurve(Curve=gate.Target2, Distance=neg_4, Corners=1)
series_5 = Series(Start=0, Step=floor_height_3, Count=tower_num_floors_2)
Z_6 = UnitZ(Factor=series_5)
move_6 = Move(Geometry=offset_4, Motion=Z_6)  # -> Geometry, Transform
neg_5 = Negative(Value=courtyard_offset_2)
graft = GraftTree(Tree=move_6.Geometry, IncludeEmptyLists=True, IncludeNullItems=True)
offset_5 = OffsetCurve(Curve=move_6.Geometry, Distance=neg_5, Corners=1)
loft = Loft(
    Curves=[graft, offset_5],
    Options={Adjust=False, Closed=False, LoftEnds=0, LoftSimp=0, LoftType=0, Rebuild=10, Refit=0.01})  # -> flatten(Loft)

# ---- group: single tower
neg_6 = Negative(Value=polyline_offset_2)
offset_6 = OffsetCurve(Curve=gate.Target0, Distance=neg_6, Corners=1)
series_6 = Series(Start=0, Step=floor_height_3, Count=tower_num_floors_2)
Z_7 = UnitZ(Factor=series_6)
move_7 = Move(Geometry=offset_6, Motion=Z_7)  # -> Geometry, Transform
srf_5 = Surface(move_7.Geometry)

# ---- group: staggered
neg_7 = Negative(Value=polyline_offset_2)
offset_7 = OffsetCurve(Curve=gate.Target3, Distance=neg_7, Corners=1)
series_7 = Series(Start=0, Step=floor_height_3, Count=tower_num_floors_2)
Z_8 = UnitZ(Factor=series_7)
division = Division(A=tower_num_floors_2, B="2")
series_8 = Series(Start=0, Step="2", Count=division)
move_8 = Move(Geometry=offset_7, Motion=Z_8)  # -> Geometry, Transform
X = UnitX(Factor=staggered_offset_2)
Y = UnitY(Factor=staggered_offset_2)
item_24 = ListItem(List=move_8.Geometry, Index=series_8, Wrap=True)
cull_i = CullIndex(List=move_8.Geometry, Indices=series_8, Wrap=True)
move_9 = Move(Geometry=item_24, Motion=X)  # -> Geometry, Transform
move_10 = Move(Geometry=cull_i, Motion=Y)  # -> Geometry, Transform
srf_6 = Surface([move_9.Geometry, move_10.Geometry])

# ----
panel = Panel(loft)
podium_floors = Surface(srf)
tower_floors = Mesh([srf_5, srf_4, srf_6, srf_3, srf_2, loft])
mcol = MeshColours(Mesh=tower_floors, Colours=ColourSwatch(SwatchColor=RGBA(33, 178, 191, 132)))
mcol_2 = MeshColours(Mesh=podium_floors, Colours=ColourSwatch(SwatchColor=RGBA(191, 33, 178, 132)))
mesh_join = MeshJoin(Meshes=flatten([mcol, mcol_2]))

# ---- group: RH_OUT:meshout
mesh = Mesh(mesh_join)
