# Grasshopper definition test_main.gh (Grasshopper 1.0.8)

x_lenght = GetNumber(Slider(14, range=5..20), AtLeast=1, AtMost=1, Maximum=1.797693135e+308, Minimum=-1.797693135e+308, TreeAccess=False)
y_lenght = GetNumber(Slider(10, range=5..20), AtLeast=1, AtMost=1, Maximum=1.797693135e+308, Minimum=-1.797693135e+308, TreeAccess=False)
z_lenght = GetNumber(Slider(13, range=5..20), AtLeast=1, AtMost=1, Maximum=1.797693135e+308, Minimum=-1.797693135e+308, TreeAccess=False)
xy = XYPlane(Origin=Point(0, 0, 0))
rectangle = Rectangle(Plane=xy, XSize=x_lenght, YSize=y_lenght, Radius=0)  # -> Rectangle, Length
Z = UnitZ(Factor=z_lenght)
extr = Extrude(Base=rectangle.Rectangle, Direction=Z)
cap = CapHoles(Brep=extr)
mcol = MeshColours(Mesh=cap, Colours=ColourSwatch(SwatchColor=RGBA(72, 217, 193, 169)))

# ---- group: RH_OUT:meshout
mesh = Mesh(mcol)
