# Grasshopper definition test_main_2.gh (Grasshopper 1.0.8)

# ---- group: Handling site geometry
panel = Panel("0.000,0.000,0.000;21.358,76.880,0.000;95.524,57.799,0.000;73.303,-17.185,0.000;0.000,0.000,0.000")
envelope_vertices = GetString(panel, AtLeast=1, AtMost=1, TreeAccess=False)
envelope_setback = GetNumber(Slider(6, range=2..10), AtLeast=1, AtMost=1, Maximum=1.797693135e+308, Minimum=-1.797693135e+308, TreeAccess=False)
envelope_vertices_2 = Data(envelope_vertices)
envelope_setback_2 = Data(envelope_setback)
tmatch = MatchText(Text=envelope_vertices_2, Pattern="0", Case=True)
gate = StreamGate(Stream=envelope_vertices_2, Gate=tmatch)  # -> Target0, Target1
split = TextSplit(Text=gate.Target0, Separators=";")
pline = PolyLine(Vertices=split, Closed=True)
srf = Surface(pline)
offset = OffsetCurve(Curve=pline, Distance=expr("-x", envelope_setback_2), Corners=1)
srfsplit = SurfaceSplit(Surface=srf, Curves=offset)
mcol = MeshColours(Mesh=srf, Colours=ColourSwatch(SwatchColor=RGB(167, 232, 70)))

# ---- group: Getting all block vertices
panel_2 = Panel("66.565,-2.058,0.000;77.164,46.940,0.000/49.339,0.792,0.000;60.503,49.919,0.000;39.954,56.409,0.000")
block_vertices = GetString(panel_2, AtLeast=1, AtMost=1, TreeAccess=False)
block_vertices_2 = Data(block_vertices)
tmatch_2 = MatchText(Text=block_vertices_2, Pattern="0", Case=True)
gate_2 = StreamGate(Stream=block_vertices_2, Gate=tmatch_2)  # -> Target0, Target1
split_2 = TextSplit(Text=gate_2.Target0, Separators="/")
split_3 = TextSplit(Text=split_2, Separators=";")
pline_2 = PolyLine(Vertices=split_3, Closed=False)

# ----
bang = ExplodeTree(Data=pline_2)  # -> Branch0, Branch1, Branch2, Branch3, Branch4, Branch5, Branch6, Branch7, Branch8, Branch9

block1_curve = Data(bang.Branch0)
block1_width = GetNumber(Slider(8, range=0..100), AtLeast=1, AtMost=1, Maximum=1.797693135e+308, Minimum=-1.797693135e+308, TreeAccess=False)
block1_no_of_floors = GetNumber(Slider(3, range=0..10), AtLeast=1, AtMost=1, Maximum=1.797693135e+308, Minimum=-1.797693135e+308, TreeAccess=False)
block1_floor_height = GetNumber(Slider(3, range=0..10), AtLeast=1, AtMost=1, Maximum=1.797693135e+308, Minimum=-1.797693135e+308, TreeAccess=False)
block_width = Data(block1_width)
no_of_floors = Data(block1_no_of_floors)
floor_height = Data(block1_floor_height)
division = Division(A=block_width, B="2")
multiplication = Multiplication(A=floor_height, B=no_of_floors)
series = Series(Start=floor_height, Step=floor_height, Count=no_of_floors)
neg = Negative(Value=division)
Z = UnitZ(Factor=series)
offset_2 = OffsetCurve(Curve=block1_curve, Distance=[division, neg], Corners=1)
pshift = ShiftPaths(Data=offset_2, Offset=-1)
end = EndPoints(Curve=pshift)  # -> Start, End
item = ListItem(List=end.Start, Index=0, Wrap=True)
item_2 = ListItem(List=end.Start, Index=1, Wrap=True)
item_3 = ListItem(List=end.End, Index=0, Wrap=True)
item_4 = ListItem(List=end.End, Index=1, Wrap=True)
ln = Line(StartPoint=item, EndPoint=item_2)
ln_2 = Line(StartPoint=item_3, EndPoint=item_4)
merge = Merge(Data1=ln, Data2=ln_2, Data3=pshift)
join = JoinCurves(Curves=merge, Preserve=False)
Z_2 = UnitZ(Factor=multiplication)
srf_2 = Surface(join)
extr = Extrude(Base=srf_2, Direction=Z_2)
Z_3 = UnitZ(Factor=Slider(0.01, range=0..0.01))
move = Move(Geometry=extr, Motion=Z_3)  # -> Geometry, Transform
mcol_2 = MeshColours(Mesh=move.Geometry, Colours=graft("#fde2e2"))

block2_curve = Data(bang.Branch1)
block2_width = GetNumber(Slider(8, range=0..100), AtLeast=1, AtMost=1, Maximum=1.797693135e+308, Minimum=-1.797693135e+308, TreeAccess=False)
block2_no_of_floors = GetNumber(Slider(3, range=0..10), AtLeast=1, AtMost=1, Maximum=1.797693135e+308, Minimum=-1.797693135e+308, TreeAccess=False)
block2_floor_height = GetNumber(Slider(3, range=0..10), AtLeast=1, AtMost=1, Maximum=1.797693135e+308, Minimum=-1.797693135e+308, TreeAccess=False)
block_width_2 = Data(block2_width)
no_of_floors_2 = Data(block2_no_of_floors)
floor_height_2 = Data(block2_floor_height)
division_2 = Division(A=block_width_2, B="2")
multiplication_2 = Multiplication(A=floor_height_2, B=no_of_floors_2)
series_2 = Series(Start=floor_height_2, Step=floor_height_2, Count=no_of_floors_2)
neg_2 = Negative(Value=division_2)
Z_4 = UnitZ(Factor=series_2)
offset_3 = OffsetCurve(Curve=block2_curve, Distance=[division_2, neg_2], Corners=1)
pshift_2 = ShiftPaths(Data=offset_3, Offset=-1)
end_2 = EndPoints(Curve=pshift_2)  # -> Start, End
item_5 = ListItem(List=end_2.Start, Index=0, Wrap=True)
item_6 = ListItem(List=end_2.Start, Index=1, Wrap=True)
item_7 = ListItem(List=end_2.End, Index=0, Wrap=True)
item_8 = ListItem(List=end_2.End, Index=1, Wrap=True)
ln_3 = Line(StartPoint=item_5, EndPoint=item_6)
ln_4 = Line(StartPoint=item_7, EndPoint=item_8)
merge_2 = Merge(Data1=ln_3, Data2=ln_4, Data3=pshift_2)
join_2 = JoinCurves(Curves=merge_2, Preserve=False)
Z_5 = UnitZ(Factor=multiplication_2)
srf_3 = Surface(join_2)
extr_2 = Extrude(Base=srf_3, Direction=Z_5)
Z_6 = UnitZ(Factor=Slider(0.01, range=0..0.01))
move_2 = Move(Geometry=extr_2, Motion=Z_6)  # -> Geometry, Transform
mcol_3 = MeshColours(Mesh=move_2.Geometry, Colours=graft("#e3f2fd"))

block3_curve = Data(bang.Branch2)
block3_width = GetNumber(Slider(8, range=0..100), AtLeast=1, AtMost=1, Maximum=1.797693135e+308, Minimum=-1.797693135e+308, TreeAccess=False)
block3_no_of_floors = GetNumber(Slider(3, range=0..10), AtLeast=1, AtMost=1, Maximum=1.797693135e+308, Minimum=-1.797693135e+308, TreeAccess=False)
block3_floor_height = GetNumber(Slider(3, range=0..10), AtLeast=1, AtMost=1, Maximum=1.797693135e+308, Minimum=-1.797693135e+308, TreeAccess=False)
block_width_3 = Data(block3_width)
no_of_floors_3 = Data(block3_no_of_floors)
floor_height_3 = Data(block3_floor_height)
division_3 = Division(A=block_width_3, B="2")
multiplication_3 = Multiplication(A=floor_height_3, B=no_of_floors_3)
series_3 = Series(Start=floor_height_3, Step=floor_height_3, Count=no_of_floors_3)
neg_3 = Negative(Value=division_3)
Z_7 = UnitZ(Factor=series_3)
offset_4 = OffsetCurve(Curve=block3_curve, Distance=[division_3, neg_3], Corners=1)
pshift_3 = ShiftPaths(Data=offset_4, Offset=-1)
end_3 = EndPoints(Curve=pshift_3)  # -> Start, End
item_9 = ListItem(List=end_3.Start, Index=0, Wrap=True)
item_10 = ListItem(List=end_3.Start, Index=1, Wrap=True)
item_11 = ListItem(List=end_3.End, Index=0, Wrap=True)
item_12 = ListItem(List=end_3.End, Index=1, Wrap=True)
ln_5 = Line(StartPoint=item_9, EndPoint=item_10)
ln_6 = Line(StartPoint=item_11, EndPoint=item_12)
merge_3 = Merge(Data1=ln_5, Data2=ln_6, Data3=pshift_3)
join_3 = JoinCurves(Curves=merge_3, Preserve=False)
Z_8 = UnitZ(Factor=multiplication_3)
srf_4 = Surface(join_3)
extr_3 = Extrude(Base=srf_4, Direction=Z_8)
Z_9 = UnitZ(Factor=Slider(0.01, range=0..0.01))
move_3 = Move(Geometry=extr_3, Motion=Z_9)  # -> Geometry, Transform
mcol_4 = MeshColours(Mesh=move_3.Geometry, Colours=graft("#fbe9e7"))

block4_curve = Data(bang.Branch3)
block4_width = GetNumber(Slider(8, range=0..100), AtLeast=1, AtMost=1, Maximum=1.797693135e+308, Minimum=-1.797693135e+308, TreeAccess=False)
block4_no_of_floors = GetNumber(Slider(3, range=0..10), AtLeast=1, AtMost=1, Maximum=1.797693135e+308, Minimum=-1.797693135e+308, TreeAccess=False)
block4_floor_height = GetNumber(Slider(3, range=0..10), AtLeast=1, AtMost=1, Maximum=1.797693135e+308, Minimum=-1.797693135e+308, TreeAccess=False)
block_width_4 = Data(block4_width)
no_of_floors_4 = Data(block4_no_of_floors)
floor_height_4 = Data(block4_floor_height)
division_4 = Division(A=block_width_4, B="2")
multiplication_4 = Multiplication(A=floor_height_4, B=no_of_floors_4)
series_4 = Series(Start=floor_height_4, Step=floor_height_4, Count=no_of_floors_4)
neg_4 = Negative(Value=division_4)
Z_10 = UnitZ(Factor=series_4)
offset_5 = OffsetCurve(Curve=block4_curve, Distance=[division_4, neg_4], Corners=1)
pshift_4 = ShiftPaths(Data=offset_5, Offset=-1)
end_4 = EndPoints(Curve=pshift_4)  # -> Start, End
item_13 = ListItem(List=end_4.Start, Index=0, Wrap=True)
item_14 = ListItem(List=end_4.Start, Index=1, Wrap=True)
item_15 = ListItem(List=end_4.End, Index=0, Wrap=True)
item_16 = ListItem(List=end_4.End, Index=1, Wrap=True)
ln_7 = Line(StartPoint=item_13, EndPoint=item_14)
ln_8 = Line(StartPoint=item_15, EndPoint=item_16)
merge_4 = Merge(Data1=ln_7, Data2=ln_8, Data3=pshift_4)
join_4 = JoinCurves(Curves=merge_4, Preserve=False)
Z_11 = UnitZ(Factor=multiplication_4)
srf_5 = Surface(join_4)
extr_4 = Extrude(Base=srf_5, Direction=Z_11)
Z_12 = UnitZ(Factor=Slider(0.01, range=0..0.01))
move_4 = Move(Geometry=extr_4, Motion=Z_12)  # -> Geometry, Transform
mcol_5 = MeshColours(Mesh=move_4.Geometry, Colours=graft("#e8eaf6"))

block5_curve = Data(bang.Branch4)
block5_width = GetNumber(Slider(8, range=0..100), AtLeast=1, AtMost=1, Maximum=1.797693135e+308, Minimum=-1.797693135e+308, TreeAccess=False)
block5_no_of_floors = GetNumber(Slider(3, range=0..10), AtLeast=1, AtMost=1, Maximum=1.797693135e+308, Minimum=-1.797693135e+308, TreeAccess=False)
block5_floor_height = GetNumber(Slider(3, range=0..10), AtLeast=1, AtMost=1, Maximum=1.797693135e+308, Minimum=-1.797693135e+308, TreeAccess=False)
block_width_5 = Data(block5_width)
no_of_floors_5 = Data(block5_no_of_floors)
floor_height_5 = Data(block5_floor_height)
division_5 = Division(A=block_width_5, B="2")
multiplication_5 = Multiplication(A=floor_height_5, B=no_of_floors_5)
series_5 = Series(Start=floor_height_5, Step=floor_height_5, Count=no_of_floors_5)
neg_5 = Negative(Value=division_5)
Z_13 = UnitZ(Factor=series_5)
offset_6 = OffsetCurve(Curve=block5_curve, Distance=[division_5, neg_5], Corners=1)
pshift_5 = ShiftPaths(Data=offset_6, Offset=-1)
end_5 = EndPoints(Curve=pshift_5)  # -> Start, End
item_17 = ListItem(List=end_5.Start, Index=0, Wrap=True)
item_18 = ListItem(List=end_5.Start, Index=1, Wrap=True)
item_19 = ListItem(List=end_5.End, Index=0, Wrap=True)
item_20 = ListItem(List=end_5.End, Index=1, Wrap=True)
ln_9 = Line(StartPoint=item_17, EndPoint=item_18)
ln_10 = Line(StartPoint=item_19, EndPoint=item_20)
merge_5 = Merge(Data1=ln_9, Data2=ln_10, Data3=pshift_5)
join_5 = JoinCurves(Curves=merge_5, Preserve=False)
Z_14 = UnitZ(Factor=multiplication_5)
srf_6 = Surface(join_5)
extr_5 = Extrude(Base=srf_6, Direction=Z_14)
Z_15 = UnitZ(Factor=Slider(0.01, range=0..0.01))
move_5 = Move(Geometry=extr_5, Motion=Z_15)  # -> Geometry, Transform
mcol_6 = MeshColours(Mesh=move_5.Geometry, Colours=graft("#f1f8e9"))

merge_6 = Merge(Data1=mcol_2, Data2=mcol_3, Data3=mcol_4, Data4=mcol_5, Data5=mcol_6)
mjoin = MeshJoin(Meshes=flatten([mcol, merge_6]))

# ---- group: RH_OUT:meshout
mesh = Mesh(mjoin)
