# Grasshopper definition test_main_3.gh (Grasshopper 1.0.8)
# plug-ins: Pufferfish, PlanFinderGH, ShapeDiverForGrasshopper

sddp = ShapeDiverDocumentPayload({AbsoluteTolerance=0, AngleTolerance=0, DistanceDisplayPrecision=0, GltfVersion="Gltf2", GrasshopperVersion="1.0.0008", InputGroups="{}", OutputGroups="{}", RelativeTolerance=0, RhinoVersion="8.14.24345.15001", UnitSystem=0, VersionCreated="1.26.0.0", VersionSaved="1.26.0.0"})

# ---- group: Getting all block vertices
panel = Panel("15.502,6.225,0.000;24.764,66.287,0.000/30.297,6.495,0.000;69.197,-2.978,0.000/68.814,12.691,0.000;77.334,51.550,0.000/66.474,52.697,0.000;42.235,57.528,0.000")
envelope_block_vertices = GetString(panel, AtLeast=1, AtMost=1, TreeAccess=False)
block_vertices = Data(envelope_block_vertices)
tmatch = MatchText(Text=block_vertices, Pattern="0", Case=True)
gate = StreamGate(Stream=block_vertices, Gate=tmatch)  # -> Target0, Target1
split = TextSplit(Text=gate.Target0, Separators="/")
split_2 = TextSplit(Text=split, Separators=";")
pline = PolyLine(Vertices=split_2, Closed=False)

# ----
envelope_mode = GetNumber(Slider(1, range=0..4), AtLeast=1, AtMost=1, Maximum=1.797693135e+308, Minimum=-1.797693135e+308, TreeAccess=False)
massing_mode = Equality(FirstNumber=envelope_mode, SecondNumber="0")  # -> Equality, Inequality
unitmix = Equality(FirstNumber=envelope_mode, SecondNumber="1")  # -> Equality, Inequality
floorplan = Equality(FirstNumber=envelope_mode, SecondNumber="2")  # -> Equality, Inequality
basement = Equality(FirstNumber=envelope_mode, SecondNumber="3")  # -> Equality, Inequality
facade = Equality(FirstNumber=envelope_mode, SecondNumber="4")  # -> Equality, Inequality
bang = ExplodeTree(Data=pline)  # -> Branch0, Branch1, Branch2, Branch3, Branch4, Branch5, Branch6, Branch7, Branch8, Branch9
massing_mode_2 = Boolean(massing_mode.Equality)
block1_corridoor = GetNumber(Slider(2, range=2..4), AtLeast=1, AtMost=1, Maximum=1.797693135e+308, Minimum=-1.797693135e+308, TreeAccess=False)
block3_type = GetNumber(Slider(0, range=0..1), AtLeast=1, AtMost=1, Maximum=1.797693135e+308, Minimum=-1.797693135e+308, TreeAccess=False)
block4_type = GetNumber(Slider(0, range=0..1), AtLeast=1, AtMost=1, Maximum=1.797693135e+308, Minimum=-1.797693135e+308, TreeAccess=False)
block5_type = GetNumber(Slider(0, range=0..1), AtLeast=1, AtMost=1, Maximum=1.797693135e+308, Minimum=-1.797693135e+308, TreeAccess=False)
activate_license = Activate(FullName="tej", Company="tej", EmailAddress="krishnatejjami@gmail.com")
unitmix_2 = Boolean(unitmix.Equality)

fsettings = FitSettings(
    WidthInterior=100,
    WidthExterior=200,
    DownScaling=Slider(0.7, range=0..1),
    UpScaling=1.05,
    ThresholdScore=0,
    AmountOptions=Slider(0, range=0..10),
    UnitSystem=4)

fsettings_2 = FitSettings(
    WidthInterior=100,
    WidthExterior=200,
    DownScaling=Slider(0.7, range=0..1),
    UpScaling=1.05,
    ThresholdScore=0,
    AmountOptions=Slider(0, range=0..10),
    UnitSystem=4)

fsettings_3 = FitSettings(
    WidthInterior=100,
    WidthExterior=200,
    DownScaling=Slider(0.7, range=0..1),
    UpScaling=1.05,
    ThresholdScore=0,
    AmountOptions=Slider(0, range=0..10),
    UnitSystem=4)

# ---- group: Handling site geometry
panel_2 = Panel("0.000,0.000,0.000;28.489,70.204,0.000;83.940,54.433,0.000;66.134,-19.840,0.000;0.000,0.000,0.000")
envelope_vertices = GetString(panel_2, AtLeast=1, AtMost=1, TreeAccess=False)
envelope_setback = GetNumber(Slider(6, range=2..10), AtLeast=1, AtMost=1, Maximum=1.797693135e+308, Minimum=-1.797693135e+308, TreeAccess=False)
envelope_vertices_2 = Data(envelope_vertices)
envelope_setback_2 = Data(envelope_setback)
tmatch_2 = MatchText(Text=envelope_vertices_2, Pattern="0", Case=True)
gate_2 = StreamGate(Stream=envelope_vertices_2, Gate=tmatch_2)  # -> Target0, Target1
split_3 = TextSplit(Text=gate_2.Target0, Separators=";")
pline_2 = PolyLine(Vertices=split_3, Closed=True)
srf = Surface(pline_2)
offset = OffsetCurve(Curve=pline_2, Distance=expr("-x", envelope_setback_2), Corners=1)
srfsplit = SurfaceSplit(Surface=srf, Curves=offset)

# ----
gate_3 = StreamGate(Stream=srf, Gate=massing_mode_2)  # -> Target0, Target1

# ---- group: Handling site geometry (continued)
mcol = MeshColours(Mesh=gate_3.Target1, Colours=ColourSwatch(SwatchColor=RGB(161, 171, 145)))
merge = Merge(Data2=mcol)

# ----
block2_curve = Data(bang.Branch1)
block2_width = GetNumber(Slider(8, range=0..100), AtLeast=1, AtMost=1, Maximum=1.797693135e+308, Minimum=-1.797693135e+308, TreeAccess=False)
block2_no_of_floors = GetNumber(Slider(3, range=0..10), AtLeast=1, AtMost=1, Maximum=1.797693135e+308, Minimum=-1.797693135e+308, TreeAccess=False)
block2_floor_height = GetNumber(Slider(3, range=0..10), AtLeast=1, AtMost=1, Maximum=1.797693135e+308, Minimum=-1.797693135e+308, TreeAccess=False)
no_of_floors = Data(block2_no_of_floors)
block_width = Data(block2_width)
floor_height = Data(block2_floor_height)
division = Division(A=block_width, B="2")
multiplication = Multiplication(A=floor_height, B=no_of_floors)
series = Series(Start=floor_height, Step=floor_height, Count=no_of_floors)
neg = Negative(Value=division)
Z = UnitZ(Factor=series)
offset_2 = OffsetCurve(Curve=block2_curve, Distance=[division, neg], Corners=1)
pshift = ShiftPaths(Data=offset_2, Offset=-1)
end = EndPoints(Curve=pshift)  # -> Start, End
item = ListItem(List=end.Start, Index=0, Wrap=True)
item_2 = ListItem(List=end.Start, Index=1, Wrap=True)
item_3 = ListItem(List=end.End, Index=0, Wrap=True)
item_4 = ListItem(List=end.End, Index=1, Wrap=True)
ln = Line(StartPoint=item, EndPoint=item_2)
ln_2 = Line(StartPoint=item_3, EndPoint=item_4)
merge_2 = Merge(Data1=ln, Data2=ln_2, Data3=pshift)
join = JoinCurves(Curves=merge_2, Preserve=False)
Z_2 = UnitZ(Factor=multiplication)
srf_2 = Surface(join)
gate_4 = StreamGate(Stream=srf_2, Gate=massing_mode_2)  # -> Target0, Target1
block2_type = GetNumber(Slider(0, range=0..1), AtLeast=1, AtMost=1, Maximum=1.797693135e+308, Minimum=-1.797693135e+308, TreeAccess=False)
extr = Extrude(Base=gate_4.Target1, Direction=Z_2)
Z_3 = UnitZ(Factor=Slider(0.01, range=0..0.01))
move = Move(Geometry=extr, Motion=Z_3)  # -> Geometry, Transform

block3_curve = Data(bang.Branch2)
block3_width = GetNumber(Slider(8, range=0..100), AtLeast=1, AtMost=1, Maximum=1.797693135e+308, Minimum=-1.797693135e+308, TreeAccess=False)
block3_no_of_floors = GetNumber(Slider(3, range=0..10), AtLeast=1, AtMost=1, Maximum=1.797693135e+308, Minimum=-1.797693135e+308, TreeAccess=False)
block3_floor_height = GetNumber(Slider(3, range=0..10), AtLeast=1, AtMost=1, Maximum=1.797693135e+308, Minimum=-1.797693135e+308, TreeAccess=False)
no_of_floors_2 = Data(block3_no_of_floors)
block_width_2 = Data(block3_width)
floor_height_2 = Data(block3_floor_height)
division_2 = Division(A=block_width_2, B="2")
multiplication_2 = Multiplication(A=floor_height_2, B=no_of_floors_2)
series_2 = Series(Start=floor_height_2, Step=floor_height_2, Count=no_of_floors_2)
neg_2 = Negative(Value=division_2)
Z_4 = UnitZ(Factor=series_2)
offset_3 = OffsetCurve(Curve=block3_curve, Distance=[division_2, neg_2], Corners=1)
pshift_2 = ShiftPaths(Data=offset_3, Offset=-1)
end_2 = EndPoints(Curve=pshift_2)  # -> Start, End
item_5 = ListItem(List=end_2.Start, Index=0, Wrap=True)
item_6 = ListItem(List=end_2.Start, Index=1, Wrap=True)
item_7 = ListItem(List=end_2.End, Index=0, Wrap=True)
item_8 = ListItem(List=end_2.End, Index=1, Wrap=True)
ln_3 = Line(StartPoint=item_5, EndPoint=item_6)
ln_4 = Line(StartPoint=item_7, EndPoint=item_8)
merge_3 = Merge(Data1=ln_3, Data2=ln_4, Data3=pshift_2)
join_2 = JoinCurves(Curves=merge_3, Preserve=False)
Z_5 = UnitZ(Factor=multiplication_2)
srf_3 = Surface(join_2)
gate_5 = StreamGate(Stream=srf_3, Gate=massing_mode_2)  # -> Target0, Target1
extr_2 = Extrude(Base=gate_5.Target1, Direction=Z_5)
Z_6 = UnitZ(Factor=Slider(0.01, range=0..0.01))
move_2 = Move(Geometry=extr_2, Motion=Z_6)  # -> Geometry, Transform

block4_curve = Data(bang.Branch3)
block4_width = GetNumber(Slider(8, range=0..100), AtLeast=1, AtMost=1, Maximum=1.797693135e+308, Minimum=-1.797693135e+308, TreeAccess=False)
block4_no_of_floors = GetNumber(Slider(3, range=0..10), AtLeast=1, AtMost=1, Maximum=1.797693135e+308, Minimum=-1.797693135e+308, TreeAccess=False)
block4_floor_height = GetNumber(Slider(3, range=0..10), AtLeast=1, AtMost=1, Maximum=1.797693135e+308, Minimum=-1.797693135e+308, TreeAccess=False)
block_width_3 = Data(block4_width)
no_of_floors_3 = Data(block4_no_of_floors)
floor_height_3 = Data(block4_floor_height)
division_3 = Division(A=block_width_3, B="2")
multiplication_3 = Multiplication(A=floor_height_3, B=no_of_floors_3)
series_3 = Series(Start=floor_height_3, Step=floor_height_3, Count=no_of_floors_3)
neg_3 = Negative(Value=division_3)
Z_7 = UnitZ(Factor=series_3)
offset_4 = OffsetCurve(Curve=block4_curve, Distance=[division_3, neg_3], Corners=1)
pshift_3 = ShiftPaths(Data=offset_4, Offset=-1)
end_3 = EndPoints(Curve=pshift_3)  # -> Start, End
item_9 = ListItem(List=end_3.Start, Index=0, Wrap=True)
item_10 = ListItem(List=end_3.Start, Index=1, Wrap=True)
item_11 = ListItem(List=end_3.End, Index=0, Wrap=True)
item_12 = ListItem(List=end_3.End, Index=1, Wrap=True)
ln_5 = Line(StartPoint=item_9, EndPoint=item_10)
ln_6 = Line(StartPoint=item_11, EndPoint=item_12)
merge_4 = Merge(Data1=ln_5, Data2=ln_6, Data3=pshift_3)
join_3 = JoinCurves(Curves=merge_4, Preserve=False)
Z_8 = UnitZ(Factor=multiplication_3)
srf_4 = Surface(join_3)
gate_6 = StreamGate(Stream=srf_4, Gate=massing_mode_2)  # -> Target0, Target1
extr_3 = Extrude(Base=gate_6.Target1, Direction=Z_8)
Z_9 = UnitZ(Factor=Slider(0.01, range=0..0.01))
move_3 = Move(Geometry=extr_3, Motion=Z_9)  # -> Geometry, Transform

block5_curve = Data(bang.Branch4)
block5_width = GetNumber(Slider(8, range=0..100), AtLeast=1, AtMost=1, Maximum=1.797693135e+308, Minimum=-1.797693135e+308, TreeAccess=False)
block5_no_of_floors = GetNumber(Slider(3, range=0..10), AtLeast=1, AtMost=1, Maximum=1.797693135e+308, Minimum=-1.797693135e+308, TreeAccess=False)
block5_floor_height = GetNumber(Slider(3, range=0..10), AtLeast=1, AtMost=1, Maximum=1.797693135e+308, Minimum=-1.797693135e+308, TreeAccess=False)
block_width_4 = Data(block5_width)
no_of_floors_4 = Data(block5_no_of_floors)
floor_height_4 = Data(block5_floor_height)
division_4 = Division(A=block_width_4, B="2")
multiplication_4 = Multiplication(A=floor_height_4, B=no_of_floors_4)
series_4 = Series(Start=floor_height_4, Step=floor_height_4, Count=no_of_floors_4)
neg_4 = Negative(Value=division_4)
Z_10 = UnitZ(Factor=series_4)
offset_5 = OffsetCurve(Curve=block5_curve, Distance=[division_4, neg_4], Corners=1)
pshift_4 = ShiftPaths(Data=offset_5, Offset=-1)
end_4 = EndPoints(Curve=pshift_4)  # -> Start, End
item_13 = ListItem(List=end_4.Start, Index=0, Wrap=True)
item_14 = ListItem(List=end_4.Start, Index=1, Wrap=True)
item_15 = ListItem(List=end_4.End, Index=0, Wrap=True)
item_16 = ListItem(List=end_4.End, Index=1, Wrap=True)
ln_7 = Line(StartPoint=item_13, EndPoint=item_14)
ln_8 = Line(StartPoint=item_15, EndPoint=item_16)
merge_5 = Merge(Data1=ln_7, Data2=ln_8, Data3=pshift_4)
join_4 = JoinCurves(Curves=merge_5, Preserve=False)
Z_11 = UnitZ(Factor=multiplication_4)
srf_5 = Surface(join_4)
gate_7 = StreamGate(Stream=srf_5, Gate=massing_mode_2)  # -> Target0, Target1
extr_4 = Extrude(Base=gate_7.Target1, Direction=Z_11)
Z_12 = UnitZ(Factor=Slider(0.01, range=0..0.01))
move_4 = Move(Geometry=extr_4, Motion=Z_12)  # -> Geometry, Transform

block1_curve = Data(bang.Branch0)
block1_width = GetNumber(Slider(20, range=8..20), AtLeast=1, AtMost=1, Maximum=1.797693135e+308, Minimum=-1.797693135e+308, TreeAccess=False)
block1_no_of_floors = GetNumber(Slider(3, range=0..10), AtLeast=1, AtMost=1, Maximum=1.797693135e+308, Minimum=-1.797693135e+308, TreeAccess=False)
block1_floor_height = GetNumber(Slider(3, range=0..10), AtLeast=1, AtMost=1, Maximum=1.797693135e+308, Minimum=-1.797693135e+308, TreeAccess=False)
block_width_5 = Data(block1_width)
no_of_floors_5 = Data(block1_no_of_floors)
floor_height_5 = Data(block1_floor_height)
division_5 = Division(A=block_width_5, B="2")
multiplication_5 = Multiplication(A=floor_height_5, B=no_of_floors_5)
series_5 = Series(Start=floor_height_5, Step=floor_height_5, Count=no_of_floors_5)
neg_5 = Negative(Value=division_5)
Z_13 = UnitZ(Factor=series_5)
offset_6 = OffsetCurve(Curve=block1_curve, Distance=[division_5, neg_5], Corners=1)
pshift_5 = ShiftPaths(Data=offset_6, Offset=-1)
end_5 = EndPoints(Curve=pshift_5)  # -> Start, End
item_17 = ListItem(List=end_5.Start, Index=0, Wrap=True)
item_18 = ListItem(List=end_5.Start, Index=1, Wrap=True)
item_19 = ListItem(List=end_5.End, Index=0, Wrap=True)
item_20 = ListItem(List=end_5.End, Index=1, Wrap=True)
ln_9 = Line(StartPoint=item_17, EndPoint=item_18)
ln_10 = Line(StartPoint=item_19, EndPoint=item_20)
merge_6 = Merge(Data1=ln_9, Data2=ln_10, Data3=pshift_5)
join_5 = JoinCurves(Curves=merge_6, Preserve=False)
Z_14 = UnitZ(Factor=multiplication_5)
srf_6 = Surface(join_5)
gate_8 = StreamGate(Stream=srf_6, Gate=massing_mode_2)  # -> Target0, Target1
extr_5 = Extrude(Base=gate_8.Target1, Direction=Z_14)
Z_15 = UnitZ(Factor=Slider(0.01, range=0..0.01))
move_5 = Move(Geometry=extr_5, Motion=Z_15)  # -> Geometry, Transform

filter = StreamFilter(Gate=block2_type, Stream0="#276FBF", Stream1="#83B692")
mcol_2 = MeshColours(Mesh=move.Geometry, Colours=graft(filter))

filter_2 = StreamFilter(Gate=block3_type, Stream0="#276FBF", Stream1="#83B692")
filter_3 = StreamFilter(Gate=block4_type, Stream0="#276FBF", Stream1="#83B692")
filter_4 = StreamFilter(Gate=block5_type, Stream0="#276FBF", Stream1="#83B692")

mcol_3 = MeshColours(Mesh=move_2.Geometry, Colours=graft(filter_2))

mcol_4 = MeshColours(Mesh=move_3.Geometry, Colours=graft(filter_3))

mcol_5 = MeshColours(Mesh=move_4.Geometry, Colours=graft(filter_4))

gate_9 = StreamGate(Stream=block1_curve, Gate=unitmix_2)  # -> Target0, Target1

unitmix_block1_noofunitstarget = GetNumber(Slider(8, range=5..20), AtLeast=1, AtMost=1, Maximum=1.797693135e+308, Minimum=-1.797693135e+308, TreeAccess=False)
unitmix_block1__studio = GetNumber(Slider(66, range=5..100), AtLeast=1, AtMost=1, Maximum=1.797693135e+308, Minimum=-1.797693135e+308, TreeAccess=False)
unitmix_block1__2bhk = GetNumber(Slider(1, range=1..100), AtLeast=1, AtMost=1, Maximum=1.797693135e+308, Minimum=-1.797693135e+308, TreeAccess=False)
unitmix_block1__3bhk = GetNumber(Slider(48, range=1..100), AtLeast=1, AtMost=1, Maximum=1.797693135e+308, Minimum=-1.797693135e+308, TreeAccess=False)
block_width_6 = Data(block_width_5)
unitmix_width_of_studio = GetNumber(Slider(4, range=4..7), AtLeast=1, AtMost=1, Maximum=1.797693135e+308, Minimum=-1.797693135e+308, TreeAccess=False)
corridoor_width = Data(block1_corridoor)
larger = LargerThan(FirstNumber=block_width_6, SecondNumber="11")  # -> LargerThan, OrEqualTo
srf_7 = Surface(gate_8.Target0)
centerline = Curve(gate_9.Target1)
noofunits = Data(unitmix_block1_noofunitstarget)
studio = Data(unitmix_block1__studio)
_2bhk = Data(unitmix_block1__2bhk)
_3bhk = Data(unitmix_block1__3bhk)
sum = Addition(A=studio, B=_2bhk, C=_3bhk)
division_6 = Division(A=block_width_6, B=2)
gate_10 = StreamGate(Stream=centerline, Gate=larger.LargerThan)  # -> Target0, Target1
cp = ControlPoints(Curve=centerline)  # -> Points, Weights, Knots
lng = ListLength(List=cp.Points)
panel_3 = Panel("""0
-1""")
larger_2 = LargerThan(FirstNumber=lng, SecondNumber="2")  # -> LargerThan, OrEqualTo
division_7 = Division(A=block_width_6, B=2)
division_8 = Division(A=corridoor_width, B=2)
neg_6 = Negative(Value=division_6)
studioratio = Division(A=studio, B=sum)
_2bhkratio = Division(A=_2bhk, B=sum)
_3bhkratio = Division(A=_3bhk, B=sum)
cull_i = CullIndex(List=cp.Points, Indices=panel_3, Wrap=True)
filter_5 = StreamFilter(Gate=larger_2.LargerThan, Stream0=centerline)
neg_7 = Negative(Value=division_8)
offset_7 = OffsetCurve(Curve=graft(filter_5), Distance=[neg_6, division_6], Corners=1)
neg_8 = Negative(Value=division_7)
studiocount = Multiplication(A=noofunits, B=studioratio)
_2bhkcount = Multiplication(A=noofunits, B=_2bhkratio)
_3bhkcount = Multiplication(A=noofunits, B=_3bhkratio)
cir = Circle(Plane=cull_i, Radius=division_6)
offset_8 = OffsetCurve(Curve=gate_10.Target0, Distance=[neg_8, division_7], Corners=1)  # -> flatten(Curve)
offset_9 = OffsetCurve(Curve=gate_10.Target1, Distance=[neg_7, division_8], Corners=1)
end_6 = EndPoints(Curve=offset_7)  # -> Start, End
studiocount_2 = Round(Number=studiocount)  # -> Nearest, Floor, Ceiling
_2bhkcount_2 = Round(Number=_2bhkcount)  # -> Nearest, Floor, Ceiling
_3bhkcount_2 = Round(Number=_3bhkcount)  # -> Nearest, Floor, Ceiling
bang_2 = ExplodeTree(Data=end_6.Start)  # -> _00000, _00001, Branch2, Branch3, Branch4, Branch5, Branch6, Branch7
bang_3 = ExplodeTree(Data=end_6.End)  # -> _00000, _00001, Branch2, Branch3, Branch4, Branch5, Branch6, Branch7
trim = TrimWithRegion(Curve=centerline, Region=cir)  # -> Inside, Outside
end_7 = EndPoints(Curve=offset_9)  # -> Start, End
item_21 = ListItem(List=offset_8, Index=Slider(0, range=0..1), Wrap=True)
bang_4 = ExplodeTree(Data=end_7.Start)  # -> _0000, _0001
bang_5 = ExplodeTree(Data=end_7.End)  # -> _0000, _0001
studioweight = Multiplication(A="25", B=studiocount_2.Nearest)
_2bhkweight = Multiplication(A="50", B=_2bhkcount_2.Nearest)
_3bhkweight = Multiplication(A="75", B=_3bhkcount_2.Nearest)
ln_11 = Line(StartPoint=bang_2._00000, EndPoint=bang_2._00001)
ln_12 = Line(StartPoint=bang_2.Branch2, EndPoint=bang_2.Branch3)
ln_13 = Line(StartPoint=bang_2.Branch4, EndPoint=bang_2.Branch5)
ln_14 = Line(StartPoint=bang_2.Branch6, EndPoint=bang_2.Branch7)
ln_15 = Line(StartPoint=bang_3._00000, EndPoint=bang_3._00001)
ln_16 = Line(StartPoint=bang_3.Branch2, EndPoint=bang_3.Branch3)
ln_17 = Line(StartPoint=bang_3.Branch4, EndPoint=bang_3.Branch5)
ln_18 = Line(StartPoint=bang_3.Branch6, EndPoint=bang_3.Branch7)
neg_9 = Negative(Value=corridoor_width)
ln_19 = Line(StartPoint=bang_4._0000, EndPoint=bang_4._0001)
ln_20 = Line(StartPoint=bang_5._0000, EndPoint=bang_5._0001)
totalweight = Addition(A=studioweight, B=_2bhkweight, C=_3bhkweight)
merge_7 = Merge(
    Data1=flatten(ln_11),
    Data2=flatten(ln_12),
    Data3=flatten(ln_15),
    Data4=flatten(ln_16),
    Data5=flatten(offset_7),
    Data6=flatten(ln_17),
    Data7=flatten(ln_18),
    Data8=flatten(ln_13),
    Data9=flatten(ln_14))
offset_10 = OffsetCurve(Curve=item_21, Distance=[neg_9, corridoor_width], Corners=1)
merge_8 = Merge(Data1=ln_11, Data2=ln_18, Data3=ln_15, Data4=ln_12, Data5=ln_16, Data6=ln_14, Data7=ln_17)  # -> flatten(Result)
entwine = Entwine(Branch00=ln_19, Branch01=ln_20, Branch02=offset_9, FlattenInputs=True)  # -> flatten(Result)
merge_9 = Merge(Data1=ln_11, Data2=ln_18)  # -> flatten(Result)
larger_3 = LargerThan(FirstNumber=lng, SecondNumber="2")  # -> LargerThan, OrEqualTo
division_9 = Division(A=studioweight, B=totalweight)
division_10 = Division(A=_2bhkweight, B=totalweight)
division_11 = Division(A=_3bhkweight, B=totalweight)
midpt = CurveMiddle(Curve=offset_10)
len = Length(Curve=centerline)
join_6 = JoinCurves(Curves=merge_7, Preserve=False)
join_7 = JoinCurves(Curves=entwine, Preserve=False)
striplength_studio = Multiplication(A=len, B=division_9)
striplength_2bhk = Multiplication(A=len, B=division_10)
striplength_3bhk = Multiplication(A=len, B=division_11)
incurve = PointInCurve(Point=midpt, Curve=srf_7)  # -> Relationship, Point
filter_6 = StreamFilter(Gate=larger_3.LargerThan, Stream0=merge_8)
panel_4 = Panel(filter_6)
cull = CullPattern(List=offset_10, CullPattern=incurve.Relationship)
division_12 = Division(A=striplength_studio, B=len)
division_13 = Division(A=striplength_2bhk, B=len)
division_14 = Division(A=striplength_3bhk, B=len)
end_8 = EndPoints(Curve=cull)  # -> Start, End
end_9 = EndPoints(Curve=item_21)  # -> Start, End
addition = Addition(A=division_12, B=division_13)
addition_2 = Addition(A=addition, B=division_14)
ln_21 = Line(StartPoint=end_8.Start, EndPoint=end_9.Start)
ln_22 = Line(StartPoint=end_8.End, EndPoint=end_9.End)
merge_10 = Merge(Data1=division_12, Data2=addition, Data3=addition_2)  # -> flatten(Result)
entwine_2 = Entwine(Branch00=ln_21, Branch01=ln_22, Branch02=cull, Branch03=item_21, FlattenInputs=True)  # -> flatten(Result)
twnthrucrvscrv = TweenThroughCurvesAlongCurve(Curves=filter_6, Guide1=centerline, Factor=merge_10, Normalized=True, Equalized=False, Refit=0, PointSample=0)
panel_5 = Panel(merge_10)
join_8 = JoinCurves(Curves=entwine_2, Preserve=False)
flip = FlipMatrix(Data=twnthrucrvscrv)
bang_6 = ExplodeTree(Data=flip)  # -> _0000, _0001, _0002
number_slider = Slider(3, range=0..10)
item_22 = ListItem(List=filter_6, Index=0, Wrap=True)
item_23 = ListItem(List=filter_6, Index=1, Wrap=True)
merge_11 = Merge(Data1=item_22, Data2=bang_6._0000)  # -> flatten(Result)
merge_12 = Merge(Data1=bang_6._0000, Data2=bang_6._0001)  # -> flatten(Result)
merge_13 = Merge(Data1=bang_6._0001, Data2=item_23)  # -> flatten(Result)
midpt_2 = CurveMiddle(Curve=merge_13)
midpt_3 = CurveMiddle(Curve=merge_11)
midpt_4 = CurveMiddle(Curve=merge_12)
series_6 = Series(Start=0, Step=1, Count=expr("x+1", studiocount_2.Nearest))
pline_3 = PolyLine(Vertices=midpt_2, Closed=False)
pline_4 = PolyLine(Vertices=midpt_3, Closed=False)
series_7 = Series(Start=0, Step=1, Count=expr("x+1", _3bhkcount_2.Nearest))
series_8 = Series(Start=0, Step=1, Count=expr("x+1", _2bhkcount_2.Nearest))
pline_5 = PolyLine(Vertices=midpt_4, Closed=False)
bnd = Bounds(Numbers=series_6)
dom = ConstructDomain(DomainStart=0, DomainEnd=1)
bnd_2 = Bounds(Numbers=series_8)
bnd_3 = Bounds(Numbers=series_7)
dom_2 = ConstructDomain(DomainStart=0, DomainEnd=1)
dom_3 = ConstructDomain(DomainStart=0, DomainEnd=1)
remap = RemapNumbers(Value=series_6, Source=bnd, Target=dom)  # -> Mapped, Clipped
remap_2 = RemapNumbers(Value=series_8, Source=bnd_2, Target=dom_2)  # -> Mapped, Clipped
remap_3 = RemapNumbers(Value=series_7, Source=bnd_3, Target=dom_3)  # -> Mapped, Clipped
twnthrucrvscrv_2 = TweenThroughCurvesAlongCurve(Curves=merge_11, Guide1=pline_4, Factor=remap.Mapped, Normalized=True, Equalized=False, Refit=0, PointSample=0)
twnthrucrvscrv_3 = TweenThroughCurvesAlongCurve(Curves=merge_12, Guide1=pline_5, Factor=remap_2.Mapped, Normalized=True, Equalized=True, Refit=0, PointSample=0)
twnthrucrvscrv_4 = TweenThroughCurvesAlongCurve(Curves=merge_13, Guide1=pline_3, Factor=remap_3.Mapped, Normalized=True, Equalized=True, Refit=0, PointSample=0)
merge_14 = Merge(Data1=join_7, Data2=join_8)
merge_15 = Merge(
    Data1=flatten(twnthrucrvscrv_2),
    Data2=flatten(twnthrucrvscrv_3),
    Data3=flatten(twnthrucrvscrv_4),
    Data4=flatten(merge_14))
srfsplit_2 = SurfaceSplit(Surface=join_6, Curves=merge_15)
area = Area(Geometry=srfsplit_2)  # -> Area, Centroid
incurve_2 = PointInCurve(Point=area.Centroid, Curve=merge_14)  # -> Relationship, Point
cull_2 = CullPattern(List=srfsplit_2, CullPattern=invert(incurve_2.Relationship))
debrep = DeconstructBrep(Brep=cull_2)  # -> Faces, Edges, Vertices
midpt_5 = CurveMiddle(Curve=debrep.Edges)
offset_11 = OffsetCurve(Curve=merge_14, Distance=1, Corners=1)
incurve_3 = PointInCurve(Point=midpt_5, Curve=offset_11)  # -> Relationship, Point
cull_3 = CullPattern(List=midpt_5, CullPattern=incurve_3.Relationship)  # -> flatten(List)
crv = Curve(cull_2)
pt = Point(cull_3)
area_2 = Area(Geometry=crv)  # -> Area, Centroid
dom_4 = ConstructDomain(DomainStart=0, DomainEnd=1)
bnd_4 = Bounds(Numbers=area_2.Area)
remap_4 = RemapNumbers(Value=area_2.Area, Source=bnd_4, Target=dom_4)  # -> Mapped, Clipped
number_slider_2 = Slider(0.05, range=0..0.1)
larger_4 = LargerThan(FirstNumber=remap_4.Mapped, SecondNumber=Slider(0.9, range=0..1))  # -> LargerThan, OrEqualTo
smaller = SmallerThan(FirstNumber=remap_4.Mapped, SecondNumber=Slider(0.1, range=0..0.1))  # -> SmallerThan, OrEqualTo
addition_3 = Addition(A=smaller.SmallerThan, B=larger_4.LargerThan)
cull_4 = CullPattern(List=crv, CullPattern=larger_4.LargerThan)
cull_5 = CullPattern(List=crv, CullPattern=smaller.SmallerThan)
cull_6 = CullPattern(List=crv, CullPattern=invert(addition_3))
offset_12 = OffsetCurve(Curve=merge_14, Distance=expr("-x", number_slider_2), Corners=1)
offset_13 = OffsetCurve(Curve=cull_5, Distance=expr("-x", number_slider_2), Corners=1)
offset_14 = OffsetCurve(Curve=cull_6, Distance=expr("-x", number_slider_2), Corners=1)
offset_15 = OffsetCurve(Curve=cull_4, Distance=expr("-x", number_slider_2), Corners=1)
mcol_6 = MeshColours(Mesh=offset_12, Colours="#B8B8D1")
mcol_7 = MeshColours(Mesh=offset_13, Colours="#FFC145")
mcol_8 = MeshColours(Mesh=offset_14, Colours="#FF6B6C")
mcol_9 = MeshColours(Mesh=offset_15, Colours="#5B5F97")
mjoin = MeshJoin(Meshes=flatten([mcol_6, mcol_7, mcol_8, mcol_9]))
pt_2 = Point(pt)
studio_surfaces = Surface(cull_5)
_3bhk_surfaces = Surface(cull_4)
cull_7 = CullPattern(List=pt_2, CullPattern=invert(addition_3))
_2bhk_syrfaces = Surface(cull_6)
cull_8 = CullPattern(List=pt_2, CullPattern=larger_4.LargerThan)
cull_9 = CullPattern(List=pt_2, CullPattern=smaller.SmallerThan)
srf_8 = Surface(offset_12)
preview = CustomPreview(Geometry=_3bhk_surfaces, Material="#5B5F97")
preview_2 = CustomPreview(Geometry=_2bhk_syrfaces, Material="#FF6B6C")
preview_3 = CustomPreview(Geometry=srf_8, Material="#B8B8D1")
preview_4 = CustomPreview(Geometry=studio_surfaces, Material="#FFC145")
Z_16 = UnitZ(Factor=Slider(3, range=0..10))
Z_17 = UnitZ(Factor=Slider(3, range=0..10))
Z_18 = UnitZ(Factor=Slider(3, range=0..10))

filter_7 = StreamFilter(Gate=larger.LargerThan, Stream0="#276FBF", Stream1="#83B692")
mcol_10 = MeshColours(Mesh=move_5.Geometry, Colours=graft(filter_7))

# ---- group: Massing stage
merge_16 = Merge(Data1=mcol_10, Data2=mcol_2, Data3=mcol_3, Data4=mcol_4, Data5=mcol_5)

# ----
entrance_point = Point(simplify(graft(cull_9)))
unit_curves = Curve(simplify(graft(studio_surfaces)))
fit = PlanFit(
    Boundary=unit_curves,
    EntranceS=entrance_point,
    Beds=Slider(1, range=0..10),
    Baths=-1,
    Country=26,
    FitSettings=fsettings,
    InHousePlans=False)

entrance_point_2 = Point(simplify(graft(cull_7)))
unit_curves_2 = Curve(simplify(graft(_2bhk_syrfaces)))
fit_2 = PlanFit(
    Boundary=unit_curves_2,
    EntranceS=entrance_point_2,
    Beds=Slider(1, range=0..10),
    Baths=-1,
    Country=26,
    FitSettings=fsettings_2,
    InHousePlans=False)

entrance_point_3 = Point(simplify(graft(cull_8)))
unit_curves_3 = Curve(simplify(graft(_3bhk_surfaces)))
fit_3 = PlanFit(
    Boundary=unit_curves_3,
    EntranceS=entrance_point_3,
    Beds=Slider(2, range=0..10),
    Baths=-1,
    Country=26,
    FitSettings=fsettings_3,
    InHousePlans=False)

clean = CleanTree(RemoveNulls=True, RemoveInvalid=True, RemoveEmpty=True, Tree=fit)
clean_2 = CleanTree(RemoveNulls=True, RemoveInvalid=True, RemoveEmpty=True, Tree=fit_2)
clean_3 = CleanTree(RemoveNulls=True, RemoveInvalid=True, RemoveEmpty=True, Tree=fit_3)

item_24 = ListItem(List=clean, Index=Slider(0, range=0..5), Wrap=True)
deplan = DeconstructPlan(Plan=item_24)  # -> InteriorWalls, ExteriorWalls, DoorCurves, Glass, WindowFrames, Furniture, Score, Rooms

item_25 = ListItem(List=clean_2, Index=Slider(0, range=0..5), Wrap=True)
deplan_2 = DeconstructPlan(Plan=item_25)  # -> InteriorWalls, ExteriorWalls, DoorCurves, Glass, WindowFrames, Furniture, Score, Rooms

item_26 = ListItem(List=clean_3, Index=Slider(0, range=0..5), Wrap=True)
deplan_3 = DeconstructPlan(Plan=item_26)  # -> InteriorWalls, ExteriorWalls, DoorCurves, Glass, WindowFrames, Furniture, Score, Rooms

crv_2 = Curve([deplan_2.Furniture, deplan_2.InteriorWalls, deplan_2.ExteriorWalls, deplan_2.DoorCurves])
crv_3 = Curve([deplan_3.Furniture, deplan_3.InteriorWalls, deplan_3.ExteriorWalls, deplan_3.DoorCurves])
crv_4 = Curve([deplan.Furniture, deplan.InteriorWalls, deplan.ExteriorWalls, deplan.DoorCurves])
crv_5 = Curve(deplan.InteriorWalls)
crv_6 = Curve(deplan.ExteriorWalls)
crv_7 = Curve(deplan_2.ExteriorWalls)
crv_8 = Curve(deplan_2.InteriorWalls)
crv_9 = Curve(deplan_3.ExteriorWalls)
crv_10 = Curve(deplan_3.InteriorWalls)
extr_6 = Extrude(Base=[crv_5, crv_6], Direction=Z_16)
extr_7 = Extrude(Base=[crv_8, crv_7], Direction=Z_17)
merge_17 = Merge(Data1=crv_4, Data2=crv_2, Data3=crv_3)
extr_8 = Extrude(Base=[crv_10, crv_9], Direction=Z_18)
mjoin_2 = MeshJoin(Meshes=[extr_6, extr_7, extr_8])
mcol_11 = MeshColours(Mesh=mjoin_2, Colours=ColourSwatch(SwatchColor=RGBA(150, 150, 150, 78)))

mjoin_3 = MeshJoin(Meshes=flatten([merge, merge_16, mcol_11]))

# ---- group: RH_OUT:meshout
mesh = Mesh(mjoin_3)
