# Grasshopper definition test_main_4.gh (Grasshopper 1.0.8)
# plug-ins: Pufferfish, Fologram For Grasshopper Utilities, PlanFinderGH

# ---- group: Getting all block vertices
panel = Panel("27.002,64.256,0.000;81.973,50.097,0.000/20.721,37.189,0.000;70.938,24.284,0.000")
envelope_block_vertices = GetString(panel, AtLeast=1, AtMost=1, TreeAccess=False)
block_vertices = Data(envelope_block_vertices)
tmatch = MatchText(Text=block_vertices, Pattern="0", Case=True)
gate = StreamGate(Stream=block_vertices, Gate=tmatch)  # -> Target0, Target1
split = TextSplit(Text=gate.Target0, Separators="/")
split_2 = TextSplit(Text=split, Separators=";")
pline = PolyLine(Vertices=split_2, Closed=False)

# ----
activate_license = Activate(FullName="J", Company="J", EmailAddress="test3@gmail.com")
envelope_mode = GetNumber(Slider(2, range=0..4), AtLeast=1, AtMost=1, Maximum=1.797693135e+308, Minimum=-1.797693135e+308, TreeAccess=False)
massing_mode = Equality(FirstNumber=envelope_mode, SecondNumber="0")  # -> Equality, Inequality
floorplan = Equality(FirstNumber=envelope_mode, SecondNumber="1")  # -> Equality, Inequality
facade = Equality(FirstNumber=envelope_mode, SecondNumber="2")  # -> Equality, Inequality
stucture = Equality(FirstNumber=envelope_mode, SecondNumber="3")  # -> Equality, Inequality
data = Data(floorplan.Equality)
massing_mode_2 = Boolean(massing_mode.Equality)
bang = ExplodeTree(Data=pline)  # -> Branch0, Branch1, Branch2, Branch3, Branch4, Branch5, Branch6, Branch7, Branch8, Branch9
number_slider = Slider(2, range=0..10)
number_slider_2 = Slider(2, range=0..10)
number_slider_3 = Slider(2, range=0..10)

block4_width = GetNumber(Slider(9, range=0..100), AtLeast=1, AtMost=1, Maximum=1.797693135e+308, Minimum=-1.797693135e+308, TreeAccess=False)
block4_no_of_floors = GetNumber(Slider(3, range=0..10), AtLeast=1, AtMost=1, Maximum=1.797693135e+308, Minimum=-1.797693135e+308, TreeAccess=False)
block4_floor_height = GetNumber(Slider(3, range=0..10), AtLeast=1, AtMost=1, Maximum=1.797693135e+308, Minimum=-1.797693135e+308, TreeAccess=False)
block4_curve = Data(bang.Branch3)
block_width = Data(block4_width)
no_of_floors = Data(block4_no_of_floors)
floor_height = Data(block4_floor_height)
division = Division(A=block_width, B="2")
multiplication = Multiplication(A=floor_height, B=no_of_floors)
series = Series(Start=floor_height, Step=floor_height, Count=no_of_floors)
neg = Negative(Value=division)
Z = UnitZ(Factor=series)
offset = OffsetCurve(Curve=block4_curve, Distance=[division, neg], Corners=1)
pshift = ShiftPaths(Data=offset, Offset=-1)
end = EndPoints(Curve=pshift)  # -> Start, End
item = ListItem(List=end.Start, Index=0, Wrap=True)
item_2 = ListItem(List=end.Start, Index=1, Wrap=True)
item_3 = ListItem(List=end.End, Index=0, Wrap=True)
item_4 = ListItem(List=end.End, Index=1, Wrap=True)
ln = Line(StartPoint=item, EndPoint=item_2)
ln_2 = Line(StartPoint=item_3, EndPoint=item_4)
merge = Merge(Data1=ln, Data2=ln_2, Data3=pshift)
join = JoinCurves(Curves=merge, Preserve=False)
Z_2 = UnitZ(Factor=multiplication)
srf = Surface(join)
gate_2 = StreamGate(Stream=srf, Gate=massing_mode_2)  # -> Target0, Target1
extr = Extrude(Base=gate_2.Target1, Direction=Z_2)
Z_3 = UnitZ(Factor=Slider(0.01, range=0..0.01))
move = Move(Geometry=extr, Motion=Z_3)  # -> Geometry, Transform
mcol = MeshColours(Mesh=move.Geometry, Colours=graft(ColourSwatch(SwatchColor=RGBA(255, 173, 254, 99))))

height = Data(multiplication)
width = Data(block_width)
debrep = DeconstructBrep(Brep=srf)  # -> Faces, Edges, Vertices
area = Area(Geometry=debrep.Faces)  # -> Area, Centroid
scale = Scale(Geometry=debrep.Faces, Center=area.Centroid, Factor=Slider(1.3, range=0..10))  # -> Geometry, Transform
scale_2 = Scale(Geometry=debrep.Faces, Center=area.Centroid, Factor=Slider(1.6, range=0..10))  # -> Geometry, Transform
debrep_2 = DeconstructBrep(Brep=scale.Geometry)  # -> Faces, Edges, Vertices
debrep_3 = DeconstructBrep(Brep=scale_2.Geometry)  # -> Faces, Edges, Vertices
item_5 = ListItem(List=debrep_2.Edges, Index=number_slider_2, Wrap=True)
item_6 = ListItem(List=debrep_3.Edges, Index=number_slider_2, Wrap=True)
concat = Concatenate(FragmentA="Height:", FragmentB=height, FragmentC="m", FragmentD="/", FragmentE="Width:", FragmentF=width, FragmentG="m")
textsrf = TextOnSurface(
    Text="Block - 4",
    Font="Poppins",
    Height=Slider(1.361, range=0..10),
    Depth=Slider(0, range=0..0.1),
    BaseLine=item_5,
    BaseSurface=debrep.Faces)
textsrf_2 = TextOnSurface(
    Text=concat,
    Font="Poppins",
    Height=Slider(0.8, range=0..1),
    Depth=Slider(0, range=0..0.1),
    BaseLine=item_6,
    BaseSurface=debrep.Faces)
Z_4 = UnitZ(Factor=Slider(0.4, range=0..1))
move_2 = Move(Geometry=[textsrf, textsrf_2], Motion=Z_4)  # -> Geometry, Transform
mcol_2 = MeshColours(Mesh=move_2.Geometry, Colours=graft(ColourSwatch(SwatchColor=RGB(0, 0, 0))))

block5_width = GetNumber(Slider(8, range=0..100), AtLeast=1, AtMost=1, Maximum=1.797693135e+308, Minimum=-1.797693135e+308, TreeAccess=False)
block5_no_of_floors = GetNumber(Slider(3, range=0..10), AtLeast=1, AtMost=1, Maximum=1.797693135e+308, Minimum=-1.797693135e+308, TreeAccess=False)
block5_floor_height = GetNumber(Slider(3, range=0..10), AtLeast=1, AtMost=1, Maximum=1.797693135e+308, Minimum=-1.797693135e+308, TreeAccess=False)
block5_curve = Data(bang.Branch4)
block_width_2 = Data(block5_width)
no_of_floors_2 = Data(block5_no_of_floors)
floor_height_2 = Data(block5_floor_height)
division_2 = Division(A=block_width_2, B="2")
multiplication_2 = Multiplication(A=floor_height_2, B=no_of_floors_2)
series_2 = Series(Start=floor_height_2, Step=floor_height_2, Count=no_of_floors_2)
neg_2 = Negative(Value=division_2)
Z_5 = UnitZ(Factor=series_2)
offset_2 = OffsetCurve(Curve=block5_curve, Distance=[division_2, neg_2], Corners=1)
pshift_2 = ShiftPaths(Data=offset_2, Offset=-1)
end_2 = EndPoints(Curve=pshift_2)  # -> Start, End
item_7 = ListItem(List=end_2.Start, Index=0, Wrap=True)
item_8 = ListItem(List=end_2.Start, Index=1, Wrap=True)
item_9 = ListItem(List=end_2.End, Index=0, Wrap=True)
item_10 = ListItem(List=end_2.End, Index=1, Wrap=True)
ln_3 = Line(StartPoint=item_7, EndPoint=item_8)
ln_4 = Line(StartPoint=item_9, EndPoint=item_10)
merge_2 = Merge(Data1=ln_3, Data2=ln_4, Data3=pshift_2)
join_2 = JoinCurves(Curves=merge_2, Preserve=False)
Z_6 = UnitZ(Factor=multiplication_2)
srf_2 = Surface(join_2)
gate_3 = StreamGate(Stream=srf_2, Gate=massing_mode_2)  # -> Target0, Target1
extr_2 = Extrude(Base=gate_3.Target1, Direction=Z_6)
Z_7 = UnitZ(Factor=Slider(0.01, range=0..0.01))
move_3 = Move(Geometry=extr_2, Motion=Z_7)  # -> Geometry, Transform
mcol_3 = MeshColours(Mesh=move_3.Geometry, Colours=graft(ColourSwatch(SwatchColor=RGBA(217, 252, 231, 152))))

block2_width = GetNumber(Slider(15, range=8..20), AtLeast=1, AtMost=1, Maximum=1.797693135e+308, Minimum=-1.797693135e+308, TreeAccess=False)
block2_no_of_floors = GetNumber(Slider(3, range=0..10), AtLeast=1, AtMost=1, Maximum=1.797693135e+308, Minimum=-1.797693135e+308, TreeAccess=False)
block2_floor_height = GetNumber(Slider(3, range=0..10), AtLeast=1, AtMost=1, Maximum=1.797693135e+308, Minimum=-1.797693135e+308, TreeAccess=False)
block2_curve = Data(bang.Branch1)
block_width_3 = Data(block2_width)
no_of_floors_3 = Data(block2_no_of_floors)
floor_height_3 = Data(block2_floor_height)
division_3 = Division(A=block_width_3, B="2")
multiplication_3 = Multiplication(A=floor_height_3, B=no_of_floors_3)
series_3 = Series(Start=floor_height_3, Step=floor_height_3, Count=no_of_floors_3)
neg_3 = Negative(Value=division_3)
Z_8 = UnitZ(Factor=series_3)
offset_3 = OffsetCurve(Curve=block2_curve, Distance=[division_3, neg_3], Corners=1)
pshift_3 = ShiftPaths(Data=offset_3, Offset=-1)
end_3 = EndPoints(Curve=pshift_3)  # -> Start, End
item_11 = ListItem(List=end_3.Start, Index=0, Wrap=True)
item_12 = ListItem(List=end_3.Start, Index=1, Wrap=True)
item_13 = ListItem(List=end_3.End, Index=0, Wrap=True)
item_14 = ListItem(List=end_3.End, Index=1, Wrap=True)
ln_5 = Line(StartPoint=item_11, EndPoint=item_12)
ln_6 = Line(StartPoint=item_13, EndPoint=item_14)
merge_3 = Merge(Data1=ln_5, Data2=ln_6, Data3=pshift_3)
join_3 = JoinCurves(Curves=merge_3, Preserve=False)
Z_9 = UnitZ(Factor=multiplication_3)
srf_3 = Surface(join_3)
gate_4 = StreamGate(Stream=srf_3, Gate=massing_mode_2)  # -> Target0, Target1
extr_3 = Extrude(Base=gate_4.Target1, Direction=Z_9)
Z_10 = UnitZ(Factor=Slider(0.01, range=0..0.01))
move_4 = Move(Geometry=extr_3, Motion=Z_10)  # -> Geometry, Transform
mcol_4 = MeshColours(Mesh=move_4.Geometry, Colours=graft(ColourSwatch(SwatchColor=RGBA(255, 255, 122, 102))))

height_2 = Data(multiplication_3)
width_2 = Data(block_width_3)
debrep_4 = DeconstructBrep(Brep=srf_3)  # -> Faces, Edges, Vertices
area_2 = Area(Geometry=debrep_4.Faces)  # -> Area, Centroid
scale_3 = Scale(Geometry=debrep_4.Faces, Center=area_2.Centroid, Factor=Slider(1.8, range=0..10))  # -> Geometry, Transform
scale_4 = Scale(Geometry=debrep_4.Faces, Center=area_2.Centroid, Factor=Slider(1.6, range=0..10))  # -> Geometry, Transform
debrep_5 = DeconstructBrep(Brep=scale_3.Geometry)  # -> Faces, Edges, Vertices
debrep_6 = DeconstructBrep(Brep=scale_4.Geometry)  # -> Faces, Edges, Vertices
item_15 = ListItem(List=debrep_5.Edges, Index=2, Wrap=True)
item_16 = ListItem(List=debrep_6.Edges, Index=2, Wrap=True)
concat_2 = Concatenate(
    FragmentA="Height:",
    FragmentB=height_2,
    FragmentC="m",
    FragmentD="/",
    FragmentE="Width:",
    FragmentF=width_2,
    FragmentG="m")
textsrf_3 = TextOnSurface(
    Text="Block - 2",
    Font="Poppins",
    Height=Slider(1.361, range=0..10),
    Depth=Slider(0, range=0..0.1),
    BaseLine=item_15,
    BaseSurface=debrep_4.Faces)
textsrf_4 = TextOnSurface(
    Text=concat_2,
    Font="Poppins",
    Height=Slider(0.8, range=0..1),
    Depth=Slider(0, range=0..0.1),
    BaseLine=item_16,
    BaseSurface=debrep_4.Faces)
Z_11 = UnitZ(Factor=Slider(0.4, range=0..1))
move_5 = Move(Geometry=[textsrf_3, textsrf_4], Motion=Z_11)  # -> Geometry, Transform
mcol_5 = MeshColours(Mesh=move_5.Geometry, Colours=graft(ColourSwatch(SwatchColor=RGB(0, 0, 0))))

block3_width = GetNumber(Slider(9, range=8..20), AtLeast=1, AtMost=1, Maximum=1.797693135e+308, Minimum=-1.797693135e+308, TreeAccess=False)
block3_no_of_floors = GetNumber(Slider(6, range=0..10), AtLeast=1, AtMost=1, Maximum=1.797693135e+308, Minimum=-1.797693135e+308, TreeAccess=False)
block3_floor_height = GetNumber(Slider(3, range=0..10), AtLeast=1, AtMost=1, Maximum=1.797693135e+308, Minimum=-1.797693135e+308, TreeAccess=False)
block3_curve = Data(bang.Branch2)
block_width_4 = Data(block3_width)
no_of_floors_4 = Data(block3_no_of_floors)
floor_height_4 = Data(block3_floor_height)
division_4 = Division(A=block_width_4, B="2")
multiplication_4 = Multiplication(A=floor_height_4, B=no_of_floors_4)
series_4 = Series(Start=floor_height_4, Step=floor_height_4, Count=no_of_floors_4)
neg_4 = Negative(Value=division_4)
Z_12 = UnitZ(Factor=series_4)
offset_4 = OffsetCurve(Curve=block3_curve, Distance=[division_4, neg_4], Corners=1)
pshift_4 = ShiftPaths(Data=offset_4, Offset=-1)
end_4 = EndPoints(Curve=pshift_4)  # -> Start, End
item_17 = ListItem(List=end_4.Start, Index=0, Wrap=True)
item_18 = ListItem(List=end_4.Start, Index=1, Wrap=True)
item_19 = ListItem(List=end_4.End, Index=0, Wrap=True)
item_20 = ListItem(List=end_4.End, Index=1, Wrap=True)
ln_7 = Line(StartPoint=item_17, EndPoint=item_18)
ln_8 = Line(StartPoint=item_19, EndPoint=item_20)
merge_4 = Merge(Data1=ln_7, Data2=ln_8, Data3=pshift_4)
join_4 = JoinCurves(Curves=merge_4, Preserve=False)
Z_13 = UnitZ(Factor=multiplication_4)
srf_4 = Surface(join_4)
gate_5 = StreamGate(Stream=srf_4, Gate=massing_mode_2)  # -> Target0, Target1
extr_4 = Extrude(Base=gate_5.Target1, Direction=Z_13)
Z_14 = UnitZ(Factor=Slider(0.01, range=0..0.01))
move_6 = Move(Geometry=extr_4, Motion=Z_14)  # -> Geometry, Transform
mcol_6 = MeshColours(Mesh=move_6.Geometry, Colours=graft(ColourSwatch(SwatchColor=RGBA(217, 252, 231, 152))))

height_3 = Data(multiplication_4)
width_3 = Data(block_width_4)
debrep_7 = DeconstructBrep(Brep=srf_4)  # -> Faces, Edges, Vertices
area_3 = Area(Geometry=debrep_7.Faces)  # -> Area, Centroid
scale_5 = Scale(Geometry=debrep_7.Faces, Center=area_3.Centroid, Factor=Slider(1.8, range=0..10))  # -> Geometry, Transform
scale_6 = Scale(Geometry=debrep_7.Faces, Center=area_3.Centroid, Factor=Slider(1.6, range=0..10))  # -> Geometry, Transform
debrep_8 = DeconstructBrep(Brep=scale_5.Geometry)  # -> Faces, Edges, Vertices
debrep_9 = DeconstructBrep(Brep=scale_6.Geometry)  # -> Faces, Edges, Vertices
item_21 = ListItem(List=debrep_8.Edges, Index=number_slider_3, Wrap=True)
item_22 = ListItem(List=debrep_9.Edges, Index=number_slider_3, Wrap=True)
concat_3 = Concatenate(
    FragmentA="Height:",
    FragmentB=height_3,
    FragmentC="m",
    FragmentD="/",
    FragmentE="Width:",
    FragmentF=width_3,
    FragmentG="m")
textsrf_5 = TextOnSurface(
    Text="Block - 3",
    Font="Poppins",
    Height=Slider(1.361, range=0..10),
    Depth=Slider(0, range=0..0.1),
    BaseLine=item_21,
    BaseSurface=debrep_7.Faces)
textsrf_6 = TextOnSurface(
    Text=concat_3,
    Font="Poppins",
    Height=Slider(0.8, range=0..1),
    Depth=Slider(0, range=0..0.1),
    BaseLine=item_22,
    BaseSurface=debrep_7.Faces)
Z_15 = UnitZ(Factor=Slider(0.4, range=0..1))
move_7 = Move(Geometry=[textsrf_5, textsrf_6], Motion=Z_15)  # -> Geometry, Transform
mcol_7 = MeshColours(Mesh=move_7.Geometry, Colours=graft(ColourSwatch(SwatchColor=RGB(0, 0, 0))))

block1_width = GetNumber(Slider(15, range=8..20), AtLeast=1, AtMost=1, Maximum=1.797693135e+308, Minimum=-1.797693135e+308, TreeAccess=False)
block1_no_of_floors = GetNumber(Slider(5, range=2..10), AtLeast=1, AtMost=1, Maximum=1.797693135e+308, Minimum=-1.797693135e+308, TreeAccess=False)
block1_floor_height = GetNumber(Slider(3, range=3..5), AtLeast=1, AtMost=1, Maximum=1.797693135e+308, Minimum=-1.797693135e+308, TreeAccess=False)
floor_height_5 = Data(block1_floor_height)
block1_curve = Data(bang.Branch0)
block_width_5 = Data(block1_width)
no_of_floors_5 = Data(block1_no_of_floors)
multiplication_5 = Multiplication(A=floor_height_5, B=no_of_floors_5)
division_5 = Division(A=block_width_5, B="2")
series_5 = Series(Start=floor_height_5, Step=floor_height_5, Count=no_of_floors_5)
neg_5 = Negative(Value=division_5)
Z_16 = UnitZ(Factor=series_5)
offset_5 = OffsetCurve(Curve=block1_curve, Distance=[division_5, neg_5], Corners=1)
pshift_5 = ShiftPaths(Data=offset_5, Offset=-1)
end_5 = EndPoints(Curve=pshift_5)  # -> Start, End
item_23 = ListItem(List=end_5.Start, Index=0, Wrap=True)
item_24 = ListItem(List=end_5.Start, Index=1, Wrap=True)
item_25 = ListItem(List=end_5.End, Index=0, Wrap=True)
item_26 = ListItem(List=end_5.End, Index=1, Wrap=True)
ln_9 = Line(StartPoint=item_23, EndPoint=item_24)
ln_10 = Line(StartPoint=item_25, EndPoint=item_26)
merge_5 = Merge(Data1=ln_9, Data2=ln_10, Data3=pshift_5)
join_5 = JoinCurves(Curves=merge_5, Preserve=False)
Z_17 = UnitZ(Factor=multiplication_5)
srf_5 = Surface(join_5)
gate_6 = StreamGate(Stream=srf_5, Gate=massing_mode_2)  # -> Target0, Target1, Target2
extr_5 = Extrude(Base=gate_6.Target1, Direction=Z_17)
Z_18 = UnitZ(Factor=Slider(0.01, range=0..0.01))
move_8 = Move(Geometry=extr_5, Motion=Z_18)  # -> Geometry, Transform
mcol_8 = MeshColours(Mesh=move_8.Geometry, Colours=graft(ColourSwatch(SwatchColor=RGBA(253, 226, 226, 152))))

height_4 = Data(multiplication_5)
width_4 = Data(block1_width)
debrep_10 = DeconstructBrep(Brep=srf_5)  # -> Faces, Edges, Vertices
area_4 = Area(Geometry=debrep_10.Faces)  # -> Area, Centroid
scale_7 = Scale(Geometry=debrep_10.Faces, Center=area_4.Centroid, Factor=Slider(1.8, range=0..10))  # -> Geometry, Transform
scale_8 = Scale(Geometry=debrep_10.Faces, Center=area_4.Centroid, Factor=Slider(1.6, range=0..10))  # -> Geometry, Transform
debrep_11 = DeconstructBrep(Brep=scale_7.Geometry)  # -> Faces, Edges, Vertices
debrep_12 = DeconstructBrep(Brep=scale_8.Geometry)  # -> Faces, Edges, Vertices
item_27 = ListItem(List=debrep_11.Edges, Index=number_slider, Wrap=True)
item_28 = ListItem(List=debrep_12.Edges, Index=number_slider, Wrap=True)
concat_4 = Concatenate(
    FragmentA="Height:",
    FragmentB=height_4,
    FragmentC="m",
    FragmentD="/",
    FragmentE="Width:",
    FragmentF=width_4,
    FragmentG="m")
textsrf_7 = TextOnSurface(
    Text="Block - 1",
    Font="Poppins",
    Height=Slider(1.361, range=0..10),
    Depth=Slider(0, range=0..0.1),
    BaseLine=item_27,
    BaseSurface=debrep_10.Faces)
textsrf_8 = TextOnSurface(
    Text=concat_4,
    Font="Poppins",
    Height=Slider(0.8, range=0..1),
    Depth=Slider(0, range=0..0.1),
    BaseLine=item_28,
    BaseSurface=debrep_10.Faces)
Z_19 = UnitZ(Factor=Slider(0.4, range=0..1))
move_9 = Move(Geometry=[textsrf_7, textsrf_8], Motion=Z_19)  # -> Geometry, Transform
mcol_9 = MeshColours(Mesh=move_9.Geometry, Colours=graft(ColourSwatch(SwatchColor=RGB(0, 0, 0))))

mjoin = MeshJoin(Meshes=[mcol_9, mcol_5, mcol_7, mcol_2])

# ---- group: Massing stage
merge_6 = Merge(Data1=mcol_8, Data2=mcol_4, Data3=mcol_6, Data4=mcol, Data5=mcol_3)

# ----
gate_7 = StreamGate(Stream=multiplication_5, Gate=stucture.Equality)  # -> Target0, Target1
gate_8 = StreamGate(Stream=multiplication_3, Gate=stucture.Equality)  # -> Target0, Target1
gate_9 = StreamGate(Stream=multiplication_4, Gate=stucture.Equality)  # -> Target0, Target1

fsettings = FitSettings(
    WidthInterior=100,
    WidthExterior=200,
    DownScaling=Slider(0.5, range=0..1),
    UpScaling=1.05,
    ThresholdScore=0,
    AmountOptions=Slider(1, range=0..10),
    UnitSystem=4)

fsettings_2 = FitSettings(
    WidthInterior=100,
    WidthExterior=200,
    DownScaling=Slider(0.5, range=0..1),
    UpScaling=1.05,
    ThresholdScore=0,
    AmountOptions=Slider(1, range=0..10),
    UnitSystem=4)

fsettings_3 = FitSettings(
    WidthInterior=100,
    WidthExterior=200,
    DownScaling=Slider(0.5, range=0..1),
    UpScaling=1.05,
    ThresholdScore=0,
    AmountOptions=Slider(1, range=0..10),
    UnitSystem=4)

# ---- group: Handling site geometry
panel_2 = Panel("0.000,0.000,0.000;19.332,80.378,0.000;96.658,59.012,0.000;77.835,-20.349,0.000;0.000,0.000,0.000")
envelope_vertices = GetString(panel_2, AtLeast=1, AtMost=1, TreeAccess=False)
envelope_setback = GetNumber(Slider(6, range=2..10), AtLeast=1, AtMost=1, Maximum=1.797693135e+308, Minimum=-1.797693135e+308, TreeAccess=False)
envelope_vertices_2 = Data(envelope_vertices)
envelope_setback_2 = Data(envelope_setback)
tmatch_2 = MatchText(Text=envelope_vertices_2, Pattern="0", Case=True)
gate_10 = StreamGate(Stream=envelope_vertices_2, Gate=tmatch_2)  # -> Target0, Target1
split_3 = TextSplit(Text=gate_10.Target0, Separators=";")
pline_2 = PolyLine(Vertices=split_3, Closed=True)
srf_6 = Surface(pline_2)
offset_6 = OffsetCurve(Curve=pline_2, Distance=expr("-x", envelope_setback_2), Corners=1)
srfsplit = SurfaceSplit(Surface=srf_6, Curves=offset_6)

# ----
gate_11 = StreamGate(Stream=srf_6, Gate=massing_mode_2)  # -> Target0, Target1

# ---- group: Handling site geometry (continued)
mcol_10 = MeshColours(Mesh=gate_11.Target1, Colours=ColourSwatch(SwatchColor=RGBA(161, 171, 145, 135)))
merge_7 = Merge(Data2=mcol_10)

# ----
gate_12 = StreamGate(Stream=pline_2, Gate=facade.Equality)  # -> Target0, Target1
merge_8 = Merge(Data1=srf_5, Data2=srf_3, Data3=srf_4, Data4=srf)
site_polyline = Data(gate_12.Target1)
area_5 = Area(Geometry=merge_8)  # -> Area, Centroid
building_polyline = Data(merge_8)
area_6 = Area(Geometry=site_polyline)  # -> Area, Centroid
offset_7 = OffsetCurve(Curve=building_polyline, Distance=Slider(2, range=0..10), Corners=1)  # -> flatten(Curve)
pop2d = Populate2D(Region=site_polyline, Count=100, Seed=1)
offset_8 = OffsetCurve(Curve=site_polyline, Distance=expr("-x", Slider(2, range=0..10)), Corners=1)
ln_11 = Line(StartPoint=area_6.Centroid, EndPoint=area_5.Centroid)
incurves = PointInCurves(Point=pop2d, Curves=offset_7)  # -> Relationship, Index, Point
dom = ConstructDomain(DomainStart=Slider(2, range=0..100), DomainEnd=Slider(3, range=0..10))
Z_20 = UnitZ(Factor=Slider(0.1, range=0..0.1))
cull = CullPattern(List=pop2d, CullPattern=invert(incurves.Relationship))
lng = ListLength(List=cull)
random = Random(Range=dom, Number=lng, Seed=2)
extr_6 = Extrude(Base=offset_7, Direction=Z_20)
Z_21 = UnitZ(Factor=random)
neg_6 = Negative(Value="1")
cap = CapHoles(Brep=extr_6)
move_10 = Move(Geometry=cull, Motion=Z_21)  # -> Geometry, Transform
number_slider_4 = Slider(0.02, range=0..0.02)
offset_9 = OffsetCurve(Curve=ln_11, Distance=["1", neg_6], Corners=1)
division_6 = Division(A=random, B=Slider(2.5, range=0..10))
pshift_6 = ShiftPaths(Data=offset_9, Offset=-1)
rectangle = Rectangle(Plane=cull, XSize=number_slider_4, YSize=number_slider_4, Radius=0)  # -> Rectangle, Length
division_7 = Division(A=Z_21, B=Slider(1.3, range=0..10))
end_6 = EndPoints(Curve=pshift_6)  # -> Start, End
extr_7 = Extrude(Base=rectangle.Rectangle, Direction=division_7)
item_29 = ListItem(List=end_6.Start, Index=0, Wrap=True)
item_30 = ListItem(List=end_6.Start, Index=1, Wrap=True)
item_31 = ListItem(List=end_6.End, Index=0, Wrap=True)
item_32 = ListItem(List=end_6.End, Index=1, Wrap=True)
sph = Sphere(Base=move_10.Geometry, Radius=division_6)
ln_12 = Line(StartPoint=item_29, EndPoint=item_30)
ln_13 = Line(StartPoint=item_31, EndPoint=item_32)
merge_9 = Merge(Data1=ln_12, Data2=ln_13, Data3=pshift_6)
join_6 = JoinCurves(Curves=merge_9, Preserve=False)
Z_22 = UnitZ(Factor=Slider(0.1, range=0..0.1))
extr_8 = Extrude(Base=join_6, Direction=Z_22)
cap_2 = CapHoles(Brep=extr_8)
swatch = ColourSwatch(SwatchColor=RGB(125, 125, 125))
mcol_11 = MeshColours(Mesh=cap_2, Colours=swatch)
mcol_12 = MeshColours(Mesh=cap, Colours=swatch)
mcol_13 = MeshColours(Mesh=offset_8, Colours=ColourSwatch(SwatchColor=RGBA(147, 178, 145, 170)))
mcol_14 = MeshColours(Mesh=cap, Colours=swatch)
mcol_15 = MeshColours(Mesh=sph, Colours=ColourSwatch(SwatchColor=RGBA(73, 130, 69, 170)))
mcol_16 = MeshColours(Mesh=extr_7, Colours=swatch)
mjoin_2 = MeshJoin(Meshes=[mcol_11, mcol_12, mcol_13, mcol_14, mcol_15, mcol_16])

filter = StreamFilter(Gate=facade.Equality, Stream1=mjoin_2)

block2_corridoor = GetNumber(Slider(2, range=2..4), AtLeast=1, AtMost=1, Maximum=1.797693135e+308, Minimum=-1.797693135e+308, TreeAccess=False)
centerline = Curve(block2_curve)
block_width_6 = Data(block_width_3)
corridoor_width = Data(block2_corridoor)
srf_7 = Surface(gate_4.Target0)
larger = LargerThan(FirstNumber=block_width_6, SecondNumber="11")  # -> LargerThan, OrEqualTo
division_8 = Division(A=block_width_6, B=2)
gate_13 = StreamGate(Stream=centerline, Gate=larger.LargerThan)  # -> Target0, Target1
cp = ControlPoints(Curve=centerline)  # -> Points, Weights, Knots
lng_2 = ListLength(List=cp.Points)
panel_3 = Panel("""0
-1""")
larger_2 = LargerThan(FirstNumber=lng_2, SecondNumber="2")  # -> LargerThan, OrEqualTo
division_9 = Division(A=block_width_6, B=2)
division_10 = Division(A=corridoor_width, B=2)
neg_7 = Negative(Value=division_8)
cull_i = CullIndex(List=cp.Points, Indices=panel_3, Wrap=True)
filter_2 = StreamFilter(Gate=larger_2.LargerThan, Stream0=centerline)
neg_8 = Negative(Value=division_10)
offset_10 = OffsetCurve(Curve=graft(filter_2), Distance=[neg_7, division_8], Corners=1)
neg_9 = Negative(Value=division_9)
cir = Circle(Plane=cull_i, Radius=division_8)
offset_11 = OffsetCurve(Curve=gate_13.Target0, Distance=[neg_9, division_9], Corners=1)  # -> flatten(Curve)
offset_12 = OffsetCurve(Curve=gate_13.Target1, Distance=[neg_8, division_10], Corners=1)
end_7 = EndPoints(Curve=offset_10)  # -> Start, End
trim = TrimWithRegion(Curve=centerline, Region=cir)  # -> Inside, Outside
bang_2 = ExplodeTree(Data=end_7.Start)  # -> _00100, _00101, Branch2, Branch3, Branch4, Branch5, Branch6, Branch7
bang_3 = ExplodeTree(Data=end_7.End)  # -> _00100, _00101, Branch2, Branch3, Branch4, Branch5, Branch6, Branch7
end_8 = EndPoints(Curve=offset_12)  # -> Start, End
item_33 = ListItem(List=offset_11, Index=Slider(0, range=0..1), Wrap=True)
bang_4 = ExplodeTree(Data=end_8.Start)  # -> _0010, _0011
bang_5 = ExplodeTree(Data=end_8.End)  # -> _0010, _0011
ln_14 = Line(StartPoint=bang_2._00100, EndPoint=bang_2._00101)
ln_15 = Line(StartPoint=bang_2.Branch2, EndPoint=bang_2.Branch3)
ln_16 = Line(StartPoint=bang_2.Branch4, EndPoint=bang_2.Branch5)
ln_17 = Line(StartPoint=bang_2.Branch6, EndPoint=bang_2.Branch7)
ln_18 = Line(StartPoint=bang_3._00100, EndPoint=bang_3._00101)
ln_19 = Line(StartPoint=bang_3.Branch2, EndPoint=bang_3.Branch3)
ln_20 = Line(StartPoint=bang_3.Branch4, EndPoint=bang_3.Branch5)
ln_21 = Line(StartPoint=bang_3.Branch6, EndPoint=bang_3.Branch7)
neg_10 = Negative(Value=corridoor_width)
ln_22 = Line(StartPoint=bang_4._0010, EndPoint=bang_4._0011)
ln_23 = Line(StartPoint=bang_5._0010, EndPoint=bang_5._0011)
merge_10 = Merge(
    Data1=flatten(ln_14),
    Data2=flatten(ln_15),
    Data3=flatten(ln_18),
    Data4=flatten(ln_19),
    Data5=flatten(offset_10),
    Data6=flatten(ln_20),
    Data7=flatten(ln_21),
    Data8=flatten(ln_16),
    Data9=flatten(ln_17))
offset_13 = OffsetCurve(Curve=item_33, Distance=[neg_10, corridoor_width], Corners=1)
merge_11 = Merge(Data1=ln_14, Data2=ln_21, Data3=ln_18, Data4=ln_15, Data5=ln_19, Data6=ln_17, Data7=ln_20)  # -> flatten(Result)
entwine = Entwine(Branch00=ln_22, Branch01=ln_23, Branch02=offset_12, FlattenInputs=True)  # -> flatten(Result)
merge_12 = Merge(Data1=ln_14, Data2=ln_21)  # -> flatten(Result)
larger_3 = LargerThan(FirstNumber=lng_2, SecondNumber="2")  # -> LargerThan, OrEqualTo
midpt = CurveMiddle(Curve=offset_13)
join_7 = JoinCurves(Curves=merge_10, Preserve=False)
join_8 = JoinCurves(Curves=entwine, Preserve=False)
incurve = PointInCurve(Point=midpt, Curve=srf_7)  # -> Relationship, Point
filter_3 = StreamFilter(Gate=larger_3.LargerThan, Stream0=merge_11)
cull_2 = CullPattern(List=offset_13, CullPattern=incurve.Relationship)
end_9 = EndPoints(Curve=cull_2)  # -> Start, End
end_10 = EndPoints(Curve=item_33)  # -> Start, End
ln_24 = Line(StartPoint=end_9.Start, EndPoint=end_10.Start)
ln_25 = Line(StartPoint=end_9.End, EndPoint=end_10.End)
entwine_2 = Entwine(Branch00=ln_24, Branch01=ln_25, Branch02=cull_2, Branch03=item_33, FlattenInputs=True)  # -> flatten(Result)
join_9 = JoinCurves(Curves=entwine_2, Preserve=False)
flip = FlipMatrix(Data=filter_3)
bang_6 = ExplodeTree(Data=flip)  # -> Branch0, Branch1, Branch2
number_slider_5 = Slider(3, range=0..10)
item_34 = ListItem(List=filter_3, Index=0, Wrap=True)
item_35 = ListItem(List=filter_3, Index=1, Wrap=True)
block2_noofunits = GetNumber(Slider(8, range=5..20), AtLeast=1, AtMost=1, Maximum=1.797693135e+308, Minimum=-1.797693135e+308, TreeAccess=False)
merge_13 = Merge(Data1=item_34, Data2=bang_6.Branch0)  # -> flatten(Result)
merge_14 = Merge(Data1=bang_6.Branch0, Data2=bang_6.Branch1)  # -> flatten(Result)
merge_15 = Merge(Data1=bang_6.Branch1, Data2=item_35)  # -> flatten(Result)
midpt_2 = CurveMiddle(Curve=merge_15)
midpt_3 = CurveMiddle(Curve=merge_13)
midpt_4 = CurveMiddle(Curve=merge_14)
series_6 = Series(Start=0, Step=1, Count=expr("x+1", block2_noofunits))
pline_3 = PolyLine(Vertices=midpt_2, Closed=False)
pline_4 = PolyLine(Vertices=midpt_3, Closed=False)
series_7 = Series(Start=0, Step=1, Count=expr("x+1", block2_noofunits))
series_8 = Series(Start=0, Step=1, Count=expr("x+1", block2_noofunits))
bnd = Bounds(Numbers=series_6)
dom_2 = ConstructDomain(DomainStart=0, DomainEnd=1)
pline_5 = PolyLine(Vertices=midpt_4, Closed=False)
bnd_2 = Bounds(Numbers=series_8)
bnd_3 = Bounds(Numbers=series_7)
dom_3 = ConstructDomain(DomainStart=0, DomainEnd=1)
dom_4 = ConstructDomain(DomainStart=0, DomainEnd=1)
remap = RemapNumbers(Value=series_6, Source=bnd, Target=dom_2)  # -> Mapped, Clipped
remap_2 = RemapNumbers(Value=series_8, Source=bnd_2, Target=dom_3)  # -> Mapped, Clipped
remap_3 = RemapNumbers(Value=series_7, Source=bnd_3, Target=dom_4)  # -> Mapped, Clipped
twnthrucrvscrv = TweenThroughCurvesAlongCurve(Curves=merge_13, Guide1=pline_4, Factor=remap.Mapped, Normalized=True, Equalized=False, Refit=0, PointSample=0)
twnthrucrvscrv_2 = TweenThroughCurvesAlongCurve(Curves=merge_14, Guide1=pline_5, Factor=remap_2.Mapped, Normalized=True, Equalized=True, Refit=0, PointSample=0)
twnthrucrvscrv_3 = TweenThroughCurvesAlongCurve(Curves=merge_15, Guide1=pline_3, Factor=remap_3.Mapped, Normalized=True, Equalized=True, Refit=0, PointSample=0)
corridor_srf = Merge(Data1=join_8, Data2=join_9)
merge_16 = Merge(
    Data1=flatten(twnthrucrvscrv),
    Data2=flatten(twnthrucrvscrv_2),
    Data3=flatten(twnthrucrvscrv_3),
    Data4=flatten(corridor_srf))
srfsplit_2 = SurfaceSplit(Surface=join_7, Curves=merge_16)
area_7 = Area(Geometry=srfsplit_2)  # -> Area, Centroid
incurve_2 = PointInCurve(Point=area_7.Centroid, Curve=corridor_srf)  # -> Relationship, Point
filter_4 = StreamFilter(Gate=larger.LargerThan, Stream0="2.3", Stream1="2.5")
cull_3 = CullPattern(List=srfsplit_2, CullPattern=invert(incurve_2.Relationship))
number_slider_6 = Slider(7, range=0..10)
debrep_13 = DeconstructBrep(Brep=cull_3)  # -> Faces, Edges, Vertices
division_11 = Division(A=block_width_6, B=filter_4)
midpt_5 = CurveMiddle(Curve=debrep_13.Edges)
offset_14 = OffsetCurve(Curve=corridor_srf, Distance=1, Corners=1)
offset_15 = OffsetCurve(Curve=corridor_srf, Distance=division_11, Corners=1)
incurve_3 = PointInCurve(Point=midpt_5, Curve=offset_15)  # -> Relationship, Point
incurve_4 = PointInCurve(Point=midpt_5, Curve=offset_14)  # -> Relationship, Point
cull_4 = CullPattern(List=debrep_13.Edges, CullPattern=incurve_4.Relationship)  # -> flatten(List)
equals = Equality(FirstNumber=incurve_3.Relationship, SecondNumber="0")  # -> Equality, Inequality
cull_5 = CullPattern(List=debrep_13.Edges, CullPattern=equals.Equality)  # -> flatten(List)
midpt_6 = CurveMiddle(Curve=cull_4)
midpt_7 = CurveMiddle(Curve=cull_5)
room = Curve(flatten(cull_3))
entrance = Point(flatten(midpt_6))
facade_2 = Curve(flatten(cull_5))
facade_curves = Curve(simplify(graft(facade_2)))
panel_4 = Panel("0")
ln_26 = Line(StartPoint=midpt_6, EndPoint=midpt_7)
Z_23 = UnitZ(Factor=1)

gate_14 = StreamGate(Stream=merge_16, Gate=stucture.Equality)  # -> Target0, Target1
gate_15 = StreamGate(Stream=facade_2, Gate=stucture.Equality)  # -> Target0, Target1
gate_16 = StreamGate(Stream=room, Gate=stucture.Equality)  # -> Target0, Target1

height_5 = Data(gate_8.Target1)
edges = Curve(flatten(gate_14.Target1))
facade_3 = Curve(flatten(gate_15.Target1))
room_2 = Curve(flatten(gate_16.Target1))
debrep_14 = DeconstructBrep(Brep=room_2)  # -> Faces, Edges, Vertices
number_slider_7 = Slider(0.3, range=0..1)
item_36 = ListItem(List=facade_3, Index=0, Wrap=True)
cullpt = CullDuplicates(Points=flatten(debrep_14.Vertices), Tolerance=Slider(1, range=0..1), CullMode=3)  # -> Points, Indices, Valence
pl = ConstructPlane(Origin=cullpt.Points, XAxis=item_36, YAxis=Vector(0, 1, 0))
rectangle_2 = Rectangle(Plane=pl, XSize=number_slider_7, YSize=number_slider_7, Radius=0)  # -> Rectangle, Length
area_8 = Area(Geometry=rectangle_2.Rectangle)  # -> Area, Centroid
vec2pt = Vector2Pt(PointA=area_8.Centroid, PointB=cullpt.Points, Unitize=False)  # -> Vector, Length
move_11 = Move(Geometry=rectangle_2.Rectangle, Motion=vec2pt.Vector)  # -> Geometry, Transform
mpipe = MeshPipe(Polylines=[edges, facade_3], NumberOfSides=4, Tolerance=0.1, Radius=Slider(0.2, range=0..1), Cap=False, Join=False)
Z_24 = UnitZ(Factor=height_5)
Z_25 = UnitZ(Factor=1)
extr_9 = Extrude(Base=move_11.Geometry, Direction=Z_24)
group = Group(Geometry=mpipe)
mesh = Mesh(extr_9)
move_12 = Move(Geometry=flatten(group), Motion=Z_8)  # -> Geometry, Transform
ungroup = Ungroup(Group=move_12.Geometry)
mcol_17 = MeshColours(Mesh=mesh, Colours=ColourSwatch(SwatchColor=RGB(0, 0, 255)))
mcol_18 = MeshColours(Mesh=ungroup, Colours=ColourSwatch(SwatchColor=RGB(255, 0, 204)))
mjoin_3 = MeshJoin(Meshes=[mcol_18, mcol_17])

mcol_19 = MeshColours(Mesh=corridor_srf, Colours=ColourSwatch(SwatchColor=RGBA(169, 160, 184, 151)))

block3_corridoor = GetNumber(Slider(2, range=2..4), AtLeast=1, AtMost=1, Maximum=1.797693135e+308, Minimum=-1.797693135e+308, TreeAccess=False)
centerline_2 = Curve(block3_curve)
block_width_7 = Data(block_width_4)
corridoor_width_2 = Data(block3_corridoor)
srf_8 = Surface(gate_5.Target0)
larger_4 = LargerThan(FirstNumber=block_width_7, SecondNumber="11")  # -> LargerThan, OrEqualTo
division_12 = Division(A=block_width_7, B=2)
gate_17 = StreamGate(Stream=centerline_2, Gate=larger_4.LargerThan)  # -> Target0, Target1
cp_2 = ControlPoints(Curve=centerline_2)  # -> Points, Weights, Knots
lng_3 = ListLength(List=cp_2.Points)
panel_5 = Panel("""0
-1""")
larger_5 = LargerThan(FirstNumber=lng_3, SecondNumber="2")  # -> LargerThan, OrEqualTo
division_13 = Division(A=block_width_7, B=2)
division_14 = Division(A=corridoor_width_2, B=2)
neg_11 = Negative(Value=division_12)
cull_i_2 = CullIndex(List=cp_2.Points, Indices=panel_5, Wrap=True)
filter_5 = StreamFilter(Gate=larger_5.LargerThan, Stream0=centerline_2)
neg_12 = Negative(Value=division_14)
offset_16 = OffsetCurve(Curve=graft(filter_5), Distance=[neg_11, division_12], Corners=1)
neg_13 = Negative(Value=division_13)
cir_2 = Circle(Plane=cull_i_2, Radius=division_12)
offset_17 = OffsetCurve(Curve=gate_17.Target0, Distance=[neg_13, division_13], Corners=1)  # -> flatten(Curve)
offset_18 = OffsetCurve(Curve=gate_17.Target1, Distance=[neg_12, division_14], Corners=1)
end_11 = EndPoints(Curve=offset_16)  # -> Start, End
trim_2 = TrimWithRegion(Curve=centerline_2, Region=cir_2)  # -> Inside, Outside
bang_7 = ExplodeTree(Data=end_11.Start)  # -> Branch0, Branch1, Branch2, Branch3, Branch4, Branch5, Branch6, Branch7
bang_8 = ExplodeTree(Data=end_11.End)  # -> Branch0, Branch1, Branch2, Branch3, Branch4, Branch5, Branch6, Branch7
end_12 = EndPoints(Curve=offset_18)  # -> Start, End
item_37 = ListItem(List=offset_17, Index=Slider(0, range=0..1), Wrap=True)
bang_9 = ExplodeTree(Data=end_12.Start)  # -> Branch0, Branch1
bang_10 = ExplodeTree(Data=end_12.End)  # -> Branch0, Branch1
ln_27 = Line(StartPoint=bang_7.Branch0, EndPoint=bang_7.Branch1)
ln_28 = Line(StartPoint=bang_7.Branch2, EndPoint=bang_7.Branch3)
ln_29 = Line(StartPoint=bang_7.Branch4, EndPoint=bang_7.Branch5)
ln_30 = Line(StartPoint=bang_7.Branch6, EndPoint=bang_7.Branch7)
ln_31 = Line(StartPoint=bang_8.Branch0, EndPoint=bang_8.Branch1)
ln_32 = Line(StartPoint=bang_8.Branch2, EndPoint=bang_8.Branch3)
ln_33 = Line(StartPoint=bang_8.Branch4, EndPoint=bang_8.Branch5)
ln_34 = Line(StartPoint=bang_8.Branch6, EndPoint=bang_8.Branch7)
neg_14 = Negative(Value=corridoor_width_2)
ln_35 = Line(StartPoint=bang_9.Branch0, EndPoint=bang_9.Branch1)
ln_36 = Line(StartPoint=bang_10.Branch0, EndPoint=bang_10.Branch1)
merge_17 = Merge(
    Data1=flatten(ln_27),
    Data2=flatten(ln_28),
    Data3=flatten(ln_31),
    Data4=flatten(ln_32),
    Data5=flatten(offset_16),
    Data6=flatten(ln_33),
    Data7=flatten(ln_34),
    Data8=flatten(ln_29),
    Data9=flatten(ln_30))
offset_19 = OffsetCurve(Curve=item_37, Distance=[neg_14, corridoor_width_2], Corners=1)
merge_18 = Merge(Data1=ln_27, Data2=ln_34, Data3=ln_31, Data4=ln_28, Data5=ln_32, Data6=ln_30, Data7=ln_33)  # -> flatten(Result)
entwine_3 = Entwine(Branch00=ln_35, Branch01=ln_36, Branch02=offset_18, FlattenInputs=True)  # -> flatten(Result)
merge_19 = Merge(Data1=ln_27, Data2=ln_34)  # -> flatten(Result)
larger_6 = LargerThan(FirstNumber=lng_3, SecondNumber="2")  # -> LargerThan, OrEqualTo
midpt_8 = CurveMiddle(Curve=offset_19)
join_10 = JoinCurves(Curves=merge_17, Preserve=False)
join_11 = JoinCurves(Curves=entwine_3, Preserve=False)
incurve_5 = PointInCurve(Point=midpt_8, Curve=srf_8)  # -> Relationship, Point
filter_6 = StreamFilter(Gate=larger_6.LargerThan, Stream0=merge_18)
cull_6 = CullPattern(List=offset_19, CullPattern=incurve_5.Relationship)
end_13 = EndPoints(Curve=cull_6)  # -> Start, End
end_14 = EndPoints(Curve=item_37)  # -> Start, End
ln_37 = Line(StartPoint=end_13.Start, EndPoint=end_14.Start)
ln_38 = Line(StartPoint=end_13.End, EndPoint=end_14.End)
entwine_4 = Entwine(Branch00=ln_37, Branch01=ln_38, Branch02=cull_6, Branch03=item_37, FlattenInputs=True)  # -> flatten(Result)
join_12 = JoinCurves(Curves=entwine_4, Preserve=False)
flip_2 = FlipMatrix(Data=filter_6)
bang_11 = ExplodeTree(Data=flip_2)  # -> Branch0, Branch1, Branch2
number_slider_8 = Slider(3, range=0..10)
item_38 = ListItem(List=filter_6, Index=0, Wrap=True)
item_39 = ListItem(List=filter_6, Index=1, Wrap=True)
block3_noofunits = GetNumber(Slider(8, range=5..20), AtLeast=1, AtMost=1, Maximum=1.797693135e+308, Minimum=-1.797693135e+308, TreeAccess=False)
merge_20 = Merge(Data1=item_38, Data2=bang_11.Branch0)  # -> flatten(Result)
merge_21 = Merge(Data1=bang_11.Branch0, Data2=bang_11.Branch1)  # -> flatten(Result)
merge_22 = Merge(Data1=bang_11.Branch1, Data2=item_39)  # -> flatten(Result)
midpt_9 = CurveMiddle(Curve=merge_22)
midpt_10 = CurveMiddle(Curve=merge_20)
midpt_11 = CurveMiddle(Curve=merge_21)
series_9 = Series(Start=0, Step=1, Count=expr("x+1", block3_noofunits))
pline_6 = PolyLine(Vertices=midpt_9, Closed=False)
pline_7 = PolyLine(Vertices=midpt_10, Closed=False)
series_10 = Series(Start=0, Step=1, Count=expr("x+1", block3_noofunits))
series_11 = Series(Start=0, Step=1, Count=expr("x+1", block3_noofunits))
bnd_4 = Bounds(Numbers=series_9)
dom_5 = ConstructDomain(DomainStart=0, DomainEnd=1)
pline_8 = PolyLine(Vertices=midpt_11, Closed=False)
bnd_5 = Bounds(Numbers=series_11)
bnd_6 = Bounds(Numbers=series_10)
dom_6 = ConstructDomain(DomainStart=0, DomainEnd=1)
dom_7 = ConstructDomain(DomainStart=0, DomainEnd=1)
remap_4 = RemapNumbers(Value=series_9, Source=bnd_4, Target=dom_5)  # -> Mapped, Clipped
remap_5 = RemapNumbers(Value=series_11, Source=bnd_5, Target=dom_6)  # -> Mapped, Clipped
remap_6 = RemapNumbers(Value=series_10, Source=bnd_6, Target=dom_7)  # -> Mapped, Clipped
twnthrucrvscrv_4 = TweenThroughCurvesAlongCurve(Curves=merge_20, Guide1=pline_7, Factor=remap_4.Mapped, Normalized=True, Equalized=False, Refit=0, PointSample=0)
twnthrucrvscrv_5 = TweenThroughCurvesAlongCurve(Curves=merge_21, Guide1=pline_8, Factor=remap_5.Mapped, Normalized=True, Equalized=True, Refit=0, PointSample=0)
twnthrucrvscrv_6 = TweenThroughCurvesAlongCurve(Curves=merge_22, Guide1=pline_6, Factor=remap_6.Mapped, Normalized=True, Equalized=True, Refit=0, PointSample=0)
corridor_srf_2 = Merge(Data1=join_11, Data2=join_12)
merge_23 = Merge(
    Data1=flatten(twnthrucrvscrv_4),
    Data2=flatten(twnthrucrvscrv_5),
    Data3=flatten(twnthrucrvscrv_6),
    Data4=flatten(corridor_srf_2))
srfsplit_3 = SurfaceSplit(Surface=join_10, Curves=merge_23)
area_9 = Area(Geometry=srfsplit_3)  # -> Area, Centroid
incurve_6 = PointInCurve(Point=area_9.Centroid, Curve=corridor_srf_2)  # -> Relationship, Point
filter_7 = StreamFilter(Gate=larger_4.LargerThan, Stream0="2.3", Stream1="2.5")
cull_7 = CullPattern(List=srfsplit_3, CullPattern=invert(incurve_6.Relationship))
number_slider_9 = Slider(7, range=0..10)
debrep_15 = DeconstructBrep(Brep=cull_7)  # -> Faces, Edges, Vertices
division_15 = Division(A=block_width_7, B=filter_7)
midpt_12 = CurveMiddle(Curve=debrep_15.Edges)
offset_20 = OffsetCurve(Curve=corridor_srf_2, Distance=1, Corners=1)
offset_21 = OffsetCurve(Curve=corridor_srf_2, Distance=division_15, Corners=1)
incurve_7 = PointInCurve(Point=midpt_12, Curve=offset_21)  # -> Relationship, Point
incurve_8 = PointInCurve(Point=midpt_12, Curve=offset_20)  # -> Relationship, Point
cull_8 = CullPattern(List=debrep_15.Edges, CullPattern=incurve_8.Relationship)  # -> flatten(List)
equals_2 = Equality(FirstNumber=incurve_7.Relationship, SecondNumber="0")  # -> Equality, Inequality
cull_9 = CullPattern(List=debrep_15.Edges, CullPattern=equals_2.Equality)  # -> flatten(List)
midpt_13 = CurveMiddle(Curve=cull_8)
midpt_14 = CurveMiddle(Curve=cull_9)
room_3 = Curve(flatten(cull_7))
entrance_2 = Point(flatten(midpt_13))
facade_4 = Curve(flatten(cull_9))
facade_curves_2 = Curve(simplify(graft(facade_4)))
ln_39 = Line(StartPoint=midpt_13, EndPoint=midpt_14)
Z_26 = UnitZ(Factor=1)

gate_18 = StreamGate(Stream=merge_23, Gate=stucture.Equality)  # -> Target0, Target1
gate_19 = StreamGate(Stream=facade_4, Gate=stucture.Equality)  # -> Target0, Target1
gate_20 = StreamGate(Stream=room_3, Gate=stucture.Equality)  # -> Target0, Target1

height_6 = Data(gate_9.Target1)
edges_2 = Curve(flatten(gate_18.Target1))
facade_5 = Curve(flatten(gate_19.Target1))
room_4 = Curve(flatten(gate_20.Target1))
debrep_16 = DeconstructBrep(Brep=room_4)  # -> Faces, Edges, Vertices
number_slider_10 = Slider(0.3, range=0..1)
item_40 = ListItem(List=facade_5, Index=0, Wrap=True)
cullpt_2 = CullDuplicates(Points=flatten(debrep_16.Vertices), Tolerance=Slider(1, range=0..1), CullMode=3)  # -> Points, Indices, Valence
pl_2 = ConstructPlane(Origin=cullpt_2.Points, XAxis=item_40, YAxis=Vector(0, 1, 0))
rectangle_3 = Rectangle(Plane=pl_2, XSize=number_slider_10, YSize=number_slider_10, Radius=0)  # -> Rectangle, Length
area_10 = Area(Geometry=rectangle_3.Rectangle)  # -> Area, Centroid
vec2pt_2 = Vector2Pt(PointA=area_10.Centroid, PointB=cullpt_2.Points, Unitize=False)  # -> Vector, Length
move_13 = Move(Geometry=rectangle_3.Rectangle, Motion=vec2pt_2.Vector)  # -> Geometry, Transform
mpipe_2 = MeshPipe(Polylines=[edges_2, facade_5], NumberOfSides=4, Tolerance=0.1, Radius=Slider(0.2, range=0..1), Cap=False, Join=False)
Z_27 = UnitZ(Factor=height_6)
Z_28 = UnitZ(Factor=1)
extr_10 = Extrude(Base=move_13.Geometry, Direction=Z_27)
group_2 = Group(Geometry=mpipe_2)
mesh_2 = Mesh(extr_10)
move_14 = Move(Geometry=flatten(group_2), Motion=Z_12)  # -> Geometry, Transform
ungroup_2 = Ungroup(Group=move_14.Geometry)
mcol_20 = MeshColours(Mesh=mesh_2, Colours=ColourSwatch(SwatchColor=RGB(0, 0, 255)))
mcol_21 = MeshColours(Mesh=ungroup_2, Colours=ColourSwatch(SwatchColor=RGB(255, 0, 204)))
mjoin_4 = MeshJoin(Meshes=[mcol_21, mcol_20])

mcol_22 = MeshColours(Mesh=corridor_srf_2, Colours=ColourSwatch(SwatchColor=RGBA(169, 160, 184, 151)))

block1_corridoor = GetNumber(Slider(2, range=2..4), AtLeast=1, AtMost=1, Maximum=1.797693135e+308, Minimum=-1.797693135e+308, TreeAccess=False)
srf_9 = Surface(gate_6.Target0)
centerline_3 = Curve(block1_curve)
corridoor_width_3 = Data(block1_corridoor)
block_width_8 = Data(block_width_5)
larger_7 = LargerThan(FirstNumber=block_width_8, SecondNumber="11")  # -> LargerThan, OrEqualTo
division_16 = Division(A=block_width_8, B=2)
gate_21 = StreamGate(Stream=centerline_3, Gate=larger_7.LargerThan)  # -> Target0, Target1
cp_3 = ControlPoints(Curve=centerline_3)  # -> Points, Weights, Knots
lng_4 = ListLength(List=cp_3.Points)
panel_7 = Panel("""0
-1""")
larger_8 = LargerThan(FirstNumber=lng_4, SecondNumber="2")  # -> LargerThan, OrEqualTo
division_17 = Division(A=block_width_8, B=2)
division_18 = Division(A=corridoor_width_3, B=2)
neg_15 = Negative(Value=division_16)
cull_i_3 = CullIndex(List=cp_3.Points, Indices=panel_7, Wrap=True)
filter_8 = StreamFilter(Gate=larger_8.LargerThan, Stream0=centerline_3)
neg_16 = Negative(Value=division_18)
offset_22 = OffsetCurve(Curve=graft(filter_8), Distance=[neg_15, division_16], Corners=1)
neg_17 = Negative(Value=division_17)
cir_3 = Circle(Plane=cull_i_3, Radius=division_16)
offset_23 = OffsetCurve(Curve=gate_21.Target0, Distance=[neg_17, division_17], Corners=1)  # -> flatten(Curve)
offset_24 = OffsetCurve(Curve=gate_21.Target1, Distance=[neg_16, division_18], Corners=1)
end_15 = EndPoints(Curve=offset_22)  # -> Start, End
trim_3 = TrimWithRegion(Curve=centerline_3, Region=cir_3)  # -> Inside, Outside
bang_12 = ExplodeTree(Data=end_15.Start)  # -> _00000, _00001, Branch2, Branch3, Branch4, Branch5, Branch6, Branch7
bang_13 = ExplodeTree(Data=end_15.End)  # -> _00000, _00001, Branch2, Branch3, Branch4, Branch5, Branch6, Branch7
end_16 = EndPoints(Curve=offset_24)  # -> Start, End
item_41 = ListItem(List=offset_23, Index=Slider(0, range=0..1), Wrap=True)
bang_14 = ExplodeTree(Data=end_16.Start)  # -> _0000, _0001
bang_15 = ExplodeTree(Data=end_16.End)  # -> _0000, _0001
ln_40 = Line(StartPoint=bang_12._00000, EndPoint=bang_12._00001)
ln_41 = Line(StartPoint=bang_12.Branch2, EndPoint=bang_12.Branch3)
ln_42 = Line(StartPoint=bang_12.Branch4, EndPoint=bang_12.Branch5)
ln_43 = Line(StartPoint=bang_12.Branch6, EndPoint=bang_12.Branch7)
ln_44 = Line(StartPoint=bang_13._00000, EndPoint=bang_13._00001)
ln_45 = Line(StartPoint=bang_13.Branch2, EndPoint=bang_13.Branch3)
ln_46 = Line(StartPoint=bang_13.Branch4, EndPoint=bang_13.Branch5)
ln_47 = Line(StartPoint=bang_13.Branch6, EndPoint=bang_13.Branch7)
neg_18 = Negative(Value=corridoor_width_3)
ln_48 = Line(StartPoint=bang_14._0000, EndPoint=bang_14._0001)
ln_49 = Line(StartPoint=bang_15._0000, EndPoint=bang_15._0001)
merge_24 = Merge(
    Data1=flatten(ln_40),
    Data2=flatten(ln_41),
    Data3=flatten(ln_44),
    Data4=flatten(ln_45),
    Data5=flatten(offset_22),
    Data6=flatten(ln_46),
    Data7=flatten(ln_47),
    Data8=flatten(ln_42),
    Data9=flatten(ln_43))
offset_25 = OffsetCurve(Curve=item_41, Distance=[neg_18, corridoor_width_3], Corners=1)
merge_25 = Merge(Data1=ln_40, Data2=ln_47, Data3=ln_44, Data4=ln_41, Data5=ln_45, Data6=ln_43, Data7=ln_46)  # -> flatten(Result)
entwine_5 = Entwine(Branch00=ln_48, Branch01=ln_49, Branch02=offset_24, FlattenInputs=True)  # -> flatten(Result)
larger_9 = LargerThan(FirstNumber=lng_4, SecondNumber="2")  # -> LargerThan, OrEqualTo
midpt_15 = CurveMiddle(Curve=offset_25)
join_13 = JoinCurves(Curves=merge_24, Preserve=False)
incurve_9 = PointInCurve(Point=midpt_15, Curve=srf_9)  # -> Relationship, Point
filter_9 = StreamFilter(Gate=larger_9.LargerThan, Stream0=merge_25)
cull_10 = CullPattern(List=offset_25, CullPattern=incurve_9.Relationship)
end_17 = EndPoints(Curve=cull_10)  # -> Start, End
end_18 = EndPoints(Curve=item_41)  # -> Start, End
ln_50 = Line(StartPoint=end_17.Start, EndPoint=end_18.Start)
ln_51 = Line(StartPoint=end_17.End, EndPoint=end_18.End)
entwine_6 = Entwine(Branch00=ln_50, Branch01=ln_51, Branch02=cull_10, Branch03=item_41, FlattenInputs=True)  # -> flatten(Result)
join_14 = JoinCurves(Curves=entwine_6, Preserve=False)
flip_3 = FlipMatrix(Data=filter_9)
join_15 = JoinCurves(Curves=entwine_5, Preserve=False)
bang_16 = ExplodeTree(Data=flip_3)  # -> Branch0, Branch1, Branch2
number_slider_11 = Slider(3, range=0..10)
item_42 = ListItem(List=filter_9, Index=0, Wrap=True)
item_43 = ListItem(List=filter_9, Index=1, Wrap=True)
block1_noofunits = GetNumber(Slider(10, range=5..20), AtLeast=1, AtMost=1, Maximum=1.797693135e+308, Minimum=-1.797693135e+308, TreeAccess=False)
merge_26 = Merge(Data1=item_42, Data2=bang_16.Branch0)  # -> flatten(Result)
merge_27 = Merge(Data1=bang_16.Branch0, Data2=bang_16.Branch1)  # -> flatten(Result)
merge_28 = Merge(Data1=bang_16.Branch1, Data2=item_43)  # -> flatten(Result)
midpt_16 = CurveMiddle(Curve=merge_28)
midpt_17 = CurveMiddle(Curve=merge_26)
midpt_18 = CurveMiddle(Curve=merge_27)
series_12 = Series(Start=0, Step=1, Count=expr("x+1", block1_noofunits))
pline_9 = PolyLine(Vertices=midpt_16, Closed=False)
pline_10 = PolyLine(Vertices=midpt_17, Closed=False)
series_13 = Series(Start=0, Step=1, Count=expr("x+1", block1_noofunits))
series_14 = Series(Start=0, Step=1, Count=expr("x+1", block1_noofunits))
bnd_7 = Bounds(Numbers=series_12)
dom_8 = ConstructDomain(DomainStart=0, DomainEnd=1)
pline_11 = PolyLine(Vertices=midpt_18, Closed=False)
bnd_8 = Bounds(Numbers=series_14)
bnd_9 = Bounds(Numbers=series_13)
dom_9 = ConstructDomain(DomainStart=0, DomainEnd=1)
dom_10 = ConstructDomain(DomainStart=0, DomainEnd=1)
remap_7 = RemapNumbers(Value=series_12, Source=bnd_7, Target=dom_8)  # -> Mapped, Clipped
remap_8 = RemapNumbers(Value=series_14, Source=bnd_8, Target=dom_9)  # -> Mapped, Clipped
remap_9 = RemapNumbers(Value=series_13, Source=bnd_9, Target=dom_10)  # -> Mapped, Clipped
twnthrucrvscrv_7 = TweenThroughCurvesAlongCurve(Curves=merge_26, Guide1=pline_10, Factor=remap_7.Mapped, Normalized=True, Equalized=False, Refit=0, PointSample=0)
twnthrucrvscrv_8 = TweenThroughCurvesAlongCurve(Curves=merge_27, Guide1=pline_11, Factor=remap_8.Mapped, Normalized=True, Equalized=True, Refit=0, PointSample=0)
twnthrucrvscrv_9 = TweenThroughCurvesAlongCurve(Curves=merge_28, Guide1=pline_9, Factor=remap_9.Mapped, Normalized=True, Equalized=True, Refit=0, PointSample=0)
corridor_srf_3 = Merge(Data1=join_15, Data2=join_14)
merge_29 = Merge(
    Data1=flatten(twnthrucrvscrv_7),
    Data2=flatten(twnthrucrvscrv_8),
    Data3=flatten(twnthrucrvscrv_9),
    Data4=flatten(corridor_srf_3))
srfsplit_4 = SurfaceSplit(Surface=join_13, Curves=merge_29)
area_11 = Area(Geometry=srfsplit_4)  # -> Area, Centroid
incurve_10 = PointInCurve(Point=area_11.Centroid, Curve=corridor_srf_3)  # -> Relationship, Point
filter_10 = StreamFilter(Gate=larger_7.LargerThan, Stream0="2.3", Stream1="2.5")
cull_11 = CullPattern(List=srfsplit_4, CullPattern=invert(incurve_10.Relationship))
number_slider_12 = Slider(7, range=0..10)
debrep_17 = DeconstructBrep(Brep=cull_11)  # -> Faces, Edges, Vertices
division_19 = Division(A=block_width_8, B=filter_10)
midpt_19 = CurveMiddle(Curve=debrep_17.Edges)
offset_26 = OffsetCurve(Curve=corridor_srf_3, Distance=1, Corners=1)
offset_27 = OffsetCurve(Curve=corridor_srf_3, Distance=division_19, Corners=1)
incurve_11 = PointInCurve(Point=midpt_19, Curve=offset_27)  # -> Relationship, Point
incurve_12 = PointInCurve(Point=midpt_19, Curve=offset_26)  # -> Relationship, Point
cull_12 = CullPattern(List=debrep_17.Edges, CullPattern=incurve_12.Relationship)  # -> flatten(List)
equals_3 = Equality(FirstNumber=incurve_11.Relationship, SecondNumber="0")  # -> Equality, Inequality
cull_13 = CullPattern(List=debrep_17.Edges, CullPattern=equals_3.Equality)  # -> flatten(List)
midpt_20 = CurveMiddle(Curve=cull_12)
midpt_21 = CurveMiddle(Curve=cull_13)
room_5 = Curve(flatten(cull_11))
entrance_3 = Point(flatten(midpt_20))
facade_6 = Curve(flatten(cull_13))
facade_curves_3 = Curve(simplify(graft(facade_6)))
ln_52 = Line(StartPoint=midpt_20, EndPoint=midpt_21)
Z_29 = UnitZ(Factor=1)

gate_22 = StreamGate(Stream=merge_29, Gate=stucture.Equality)  # -> Target0, Target1
gate_23 = StreamGate(Stream=facade_6, Gate=stucture.Equality)  # -> Target0, Target1
gate_24 = StreamGate(Stream=room_5, Gate=stucture.Equality)  # -> Target0, Target1

height_7 = Data(gate_7.Target1)
edges_3 = Curve(flatten(gate_22.Target1))
facade_7 = Curve(flatten(gate_23.Target1))
room_6 = Curve(flatten(gate_24.Target1))
debrep_18 = DeconstructBrep(Brep=room_6)  # -> Faces, Edges, Vertices
number_slider_13 = Slider(0.3, range=0..1)
item_44 = ListItem(List=facade_7, Index=0, Wrap=True)
cullpt_3 = CullDuplicates(Points=flatten(debrep_18.Vertices), Tolerance=Slider(1, range=0..1), CullMode=3)  # -> Points, Indices, Valence
pl_3 = ConstructPlane(Origin=cullpt_3.Points, XAxis=item_44, YAxis=Vector(0, 1, 0))
rectangle_4 = Rectangle(Plane=pl_3, XSize=number_slider_13, YSize=number_slider_13, Radius=0)  # -> Rectangle, Length
area_12 = Area(Geometry=rectangle_4.Rectangle)  # -> Area, Centroid
vec2pt_3 = Vector2Pt(PointA=area_12.Centroid, PointB=cullpt_3.Points, Unitize=False)  # -> Vector, Length
move_15 = Move(Geometry=rectangle_4.Rectangle, Motion=vec2pt_3.Vector)  # -> Geometry, Transform
mpipe_3 = MeshPipe(Polylines=[edges_3, facade_7], NumberOfSides=4, Tolerance=0.1, Radius=Slider(0.2, range=0..1), Cap=False, Join=False)
Z_30 = UnitZ(Factor=height_7)
Z_31 = UnitZ(Factor=1)
extr_11 = Extrude(Base=move_15.Geometry, Direction=Z_30)
group_3 = Group(Geometry=mpipe_3)
mesh_3 = Mesh(extr_11)
move_16 = Move(Geometry=flatten(group_3), Motion=Z_16)  # -> Geometry, Transform
ungroup_3 = Ungroup(Group=move_16.Geometry)
mcol_23 = MeshColours(Mesh=mesh_3, Colours=ColourSwatch(SwatchColor=RGB(0, 0, 255)))
mcol_24 = MeshColours(Mesh=ungroup_3, Colours=ColourSwatch(SwatchColor=RGB(255, 0, 204)))
mjoin_5 = MeshJoin(Meshes=[mcol_24, mcol_23])

mjoin_6 = MeshJoin(Meshes=flatten([mjoin_3, mjoin_4, mjoin_5]))  # -> flatten(Mesh)
mcol_25 = MeshColours(Mesh=corridor_srf_3, Colours=ColourSwatch(SwatchColor=RGBA(169, 160, 184, 151)))

unit_curves = Curve(simplify(graft(room)))
entrance_point = Point(simplify(graft(entrance)))
fit = PlanFit(
    Boundary=unit_curves,
    EntranceS=entrance_point,
    FacadeS=facade_curves,
    Beds=Slider(1, range=0..10),
    Baths=-1,
    Country=26,
    FitSettings=fsettings,
    InHousePlans=False)

unit_curves_2 = Curve(simplify(graft(room_3)))
entrance_point_2 = Point(simplify(graft(entrance_2)))
fit_2 = PlanFit(
    Boundary=unit_curves_2,
    EntranceS=entrance_point_2,
    FacadeS=facade_curves_2,
    Beds=Slider(1, range=0..10),
    Baths=-1,
    Country=26,
    FitSettings=fsettings_2,
    InHousePlans=False)

unit_curves_3 = Curve(simplify(graft(room_5)))
entrance_point_3 = Point(simplify(graft(entrance_3)))
fit_3 = PlanFit(
    Boundary=unit_curves_3,
    EntranceS=entrance_point_3,
    FacadeS=facade_curves_3,
    Beds=Slider(1, range=0..10),
    Baths=-1,
    Country=26,
    FitSettings=fsettings_3,
    InHousePlans=False)

clean = CleanTree(RemoveNulls=True, RemoveInvalid=True, RemoveEmpty=True, Tree=fit)

item_45 = ListItem(List=clean, Index=Slider(0, range=0..5), Wrap=True)
deplan = DeconstructPlan(Plan=item_45)  # -> InteriorWalls, ExteriorWalls, DoorCurves, Glass, WindowFrames, Furniture, Score, Rooms

group_4 = NamedGroup(Geometry=deplan.InteriorWalls, Name="IW")  # -> Group, Geometry, Name
group_5 = NamedGroup(Geometry=deplan.ExteriorWalls, Name="EW")  # -> Group, Geometry, Name
group_6 = NamedGroup(Geometry=deplan.WindowFrames, Name="W")  # -> Group, Geometry, Name
group_7 = NamedGroup(Geometry=deplan.Furniture, Name="F")  # -> Group, Geometry, Name
group_8 = NamedGroup(Geometry=deplan.DoorCurves, Name="D")  # -> Group, Geometry, Name
group_9 = Group(Geometry=[group_4.Group, group_5.Group, group_8.Group, group_6.Group, group_7.Group])
lng_5 = ListLength(List=flatten(group_9))
series_15 = Series(Start=0, Step=1, Count=lng_5)
mod = Modulus(A=series_15, B="2")
dispatch = Dispatch(List=flatten(group_9), DispatchPattern=mod)  # -> ListA, ListB
dispatch_2 = Dispatch(List=flatten(ln_26), DispatchPattern=mod)  # -> ListA, ListB
data_2 = Data(dispatch.ListA)
x = Data(dispatch_2.ListA)
midpt_22 = CurveMiddle(Curve=dispatch_2.ListA)
pl_4 = ConstructPlane(Origin=midpt_22, XAxis=x, YAxis=Z_23)
data_3 = Data(dispatch.ListB)
mirror = Mirror(Geometry=data_2, Plane=pl_4)  # -> Geometry, Transform

clean_2 = CleanTree(RemoveNulls=True, RemoveInvalid=True, RemoveEmpty=True, Tree=fit_2)

item_46 = ListItem(List=clean_2, Index=Slider(0, range=0..5), Wrap=True)
deplan_2 = DeconstructPlan(Plan=item_46)  # -> InteriorWalls, ExteriorWalls, DoorCurves, Glass, WindowFrames, Furniture, Score, Rooms

group_10 = NamedGroup(Geometry=deplan_2.InteriorWalls, Name="IW")  # -> Group, Geometry, Name
group_11 = NamedGroup(Geometry=deplan_2.ExteriorWalls, Name="EW")  # -> Group, Geometry, Name
group_12 = NamedGroup(Geometry=deplan_2.WindowFrames, Name="W")  # -> Group, Geometry, Name
group_13 = NamedGroup(Geometry=deplan_2.Furniture, Name="F")  # -> Group, Geometry, Name
group_14 = NamedGroup(Geometry=deplan_2.DoorCurves, Name="D")  # -> Group, Geometry, Name
group_15 = Group(Geometry=[group_10.Group, group_11.Group, group_14.Group, group_12.Group, group_13.Group])
lng_6 = ListLength(List=flatten(group_15))
series_16 = Series(Start=0, Step=1, Count=lng_6)
mod_2 = Modulus(A=series_16, B="2")
dispatch_3 = Dispatch(List=flatten(group_15), DispatchPattern=mod_2)  # -> ListA, ListB
dispatch_4 = Dispatch(List=flatten(ln_39), DispatchPattern=mod_2)  # -> ListA, ListB
data_4 = Data(dispatch_3.ListA)
x_2 = Data(dispatch_4.ListA)
midpt_23 = CurveMiddle(Curve=dispatch_4.ListA)
pl_5 = ConstructPlane(Origin=midpt_23, XAxis=x_2, YAxis=Z_26)
data_5 = Data(dispatch_3.ListB)
mirror_2 = Mirror(Geometry=data_4, Plane=pl_5)  # -> Geometry, Transform

clean_3 = CleanTree(RemoveNulls=True, RemoveInvalid=True, RemoveEmpty=True, Tree=fit_3)

item_47 = ListItem(List=clean_3, Index=Slider(0, range=0..5), Wrap=True)
deplan_3 = DeconstructPlan(Plan=item_47)  # -> InteriorWalls, ExteriorWalls, DoorCurves, Glass, WindowFrames, Furniture, Score, Rooms

group_16 = NamedGroup(Geometry=deplan_3.InteriorWalls, Name="IW")  # -> Group, Geometry, Name
group_17 = NamedGroup(Geometry=deplan_3.ExteriorWalls, Name="EW")  # -> Group, Geometry, Name
group_18 = NamedGroup(Geometry=deplan_3.WindowFrames, Name="W")  # -> Group, Geometry, Name
group_19 = NamedGroup(Geometry=deplan_3.Furniture, Name="F")  # -> Group, Geometry, Name
group_20 = NamedGroup(Geometry=deplan_3.DoorCurves, Name="D")  # -> Group, Geometry, Name
group_21 = Group(Geometry=[group_16.Group, group_17.Group, group_20.Group, group_18.Group, group_19.Group])
lng_7 = ListLength(List=flatten(group_21))
series_17 = Series(Start=0, Step=1, Count=lng_7)
mod_3 = Modulus(A=series_17, B="2")
dispatch_5 = Dispatch(List=flatten(group_21), DispatchPattern=mod_3)  # -> ListA, ListB
dispatch_6 = Dispatch(List=flatten(ln_52), DispatchPattern=mod_3)  # -> ListA, ListB
midpt_24 = CurveMiddle(Curve=dispatch_6.ListA)
x_3 = Data(dispatch_6.ListA)
data_6 = Data(dispatch_5.ListA)
pl_6 = ConstructPlane(Origin=midpt_24, XAxis=x_3, YAxis=Z_29)
mirror_3 = Mirror(Geometry=data_6, Plane=pl_6)  # -> Geometry, Transform
data_7 = Data(dispatch_5.ListB)

ungroup_4 = Ungroup(Group=data_7)
ungroup_5 = Ungroup(Group=mirror_3.Geometry)
item_48 = ListItem(List=ungroup_4, Index=0, Wrap=True)  # -> Item, Item1, Item2, Item3, Item4
item_49 = ListItem(List=ungroup_5, Index=0, Wrap=True)  # -> Item, Item1, Item2, Item3, Item4
ungroup_6 = Ungroup(Group=item_48.Item)
ungroup_7 = Ungroup(Group=item_48.Item1)
ungroup_8 = Ungroup(Group=item_48.Item3)
ungroup_9 = Ungroup(Group=item_48.Item4)
ungroup_10 = Ungroup(Group=item_48.Item2)
ungroup_11 = Ungroup(Group=item_49.Item2)
ungroup_12 = Ungroup(Group=item_49.Item4)
ungroup_13 = Ungroup(Group=item_49.Item)
ungroup_14 = Ungroup(Group=item_49.Item1)
ungroup_15 = Ungroup(Group=item_49.Item3)
mcol_26 = MeshColours(Mesh=ungroup_6, Colours=ColourSwatch(SwatchColor=RGBA(0, 0, 0, 184)))
mcol_27 = MeshColours(Mesh=ungroup_7, Colours=ColourSwatch(SwatchColor=RGBA(0, 0, 0, 213)))
mcol_28 = MeshColours(Mesh=ungroup_8, Colours=ColourSwatch(SwatchColor=RGBA(28, 236, 255, 129)))
mcol_29 = MeshColours(Mesh=ungroup_15, Colours=ColourSwatch(SwatchColor=RGBA(28, 236, 255, 129)))
mcol_30 = MeshColours(Mesh=ungroup_13, Colours=ColourSwatch(SwatchColor=RGBA(0, 0, 0, 176)))
mcol_31 = MeshColours(Mesh=ungroup_14, Colours=ColourSwatch(SwatchColor=RGBA(0, 0, 0, 189)))

cls = Closed(Curve=ungroup_9)  # -> Closed, Periodic
cls_2 = Closed(Curve=ungroup_10)  # -> Closed, Periodic
cls_3 = Closed(Curve=ungroup_11)  # -> Closed, Periodic
cull_14 = CullPattern(List=ungroup_9, CullPattern=cls.Closed)
cls_4 = Closed(Curve=ungroup_12)  # -> Closed, Periodic
cull_15 = CullPattern(List=ungroup_10, CullPattern=cls_2.Closed)
cull_16 = CullPattern(List=ungroup_11, CullPattern=cls_3.Closed)
cull_17 = CullPattern(List=ungroup_12, CullPattern=cls_4.Closed)

mesh_4 = Mesh(cull_14)
mesh_5 = Mesh(cull_15)
mcol_32 = MeshColours(Mesh=mesh_4, Colours=ColourSwatch(SwatchColor=RGBA(153, 153, 153, 103)))
mcol_33 = MeshColours(Mesh=mesh_5, Colours=ColourSwatch(SwatchColor=RGB(255, 28, 28)))
mesh_6 = Mesh(cull_17)
mcol_34 = MeshColours(Mesh=cull_16, Colours=ColourSwatch(SwatchColor=RGB(255, 28, 28)))
mcol_35 = MeshColours(Mesh=mesh_6, Colours=ColourSwatch(SwatchColor=RGBA(153, 153, 153, 103)))
mjoin_7 = MeshJoin(Meshes=[mcol_33, mcol_26, mcol_27, mcol_28, mcol_32, mcol_30, mcol_31, mcol_29, mcol_35, mcol_34, mcol_25])

ungroup_16 = Ungroup(Group=mirror_2.Geometry)
ungroup_17 = Ungroup(Group=data_5)
item_50 = ListItem(List=ungroup_16, Index=0, Wrap=True)  # -> Item, Item1, Item2, Item3, Item4
item_51 = ListItem(List=ungroup_17, Index=0, Wrap=True)  # -> Item, Item1, Item2, Item3, Item4
ungroup_18 = Ungroup(Group=item_50.Item4)
ungroup_19 = Ungroup(Group=item_50.Item)
ungroup_20 = Ungroup(Group=item_50.Item1)
ungroup_21 = Ungroup(Group=item_50.Item3)
ungroup_22 = Ungroup(Group=item_50.Item2)
ungroup_23 = Ungroup(Group=item_51.Item2)
ungroup_24 = Ungroup(Group=item_51.Item)
ungroup_25 = Ungroup(Group=item_51.Item1)
ungroup_26 = Ungroup(Group=item_51.Item3)
ungroup_27 = Ungroup(Group=item_51.Item4)
mcol_36 = MeshColours(Mesh=ungroup_19, Colours=ColourSwatch(SwatchColor=RGBA(0, 0, 0, 184)))
mcol_37 = MeshColours(Mesh=ungroup_20, Colours=ColourSwatch(SwatchColor=RGB(0, 0, 0)))
mcol_38 = MeshColours(Mesh=ungroup_21, Colours=ColourSwatch(SwatchColor=RGBA(28, 236, 255, 129)))
mcol_39 = MeshColours(Mesh=ungroup_26, Colours=ColourSwatch(SwatchColor=RGBA(28, 236, 255, 129)))
mcol_40 = MeshColours(Mesh=ungroup_24, Colours=ColourSwatch(SwatchColor=RGBA(0, 0, 0, 184)))
mcol_41 = MeshColours(Mesh=ungroup_25, Colours=ColourSwatch(SwatchColor=RGB(0, 0, 0)))

cls_5 = Closed(Curve=ungroup_23)  # -> Closed, Periodic
cls_6 = Closed(Curve=ungroup_18)  # -> Closed, Periodic
cls_7 = Closed(Curve=ungroup_22)  # -> Closed, Periodic
cull_18 = CullPattern(List=ungroup_23, CullPattern=cls_5.Closed)
cull_19 = CullPattern(List=ungroup_18, CullPattern=cls_6.Closed)
cull_20 = CullPattern(List=ungroup_22, CullPattern=cls_7.Closed)
cls_8 = Closed(Curve=ungroup_27)  # -> Closed, Periodic
cull_21 = CullPattern(List=ungroup_27, CullPattern=cls_8.Closed)

mesh_7 = Mesh(cull_19)
mesh_8 = Mesh(cull_20)
mesh_9 = Mesh(cull_18)
mesh_10 = Mesh(cull_21)
mcol_42 = MeshColours(Mesh=mesh_7, Colours=ColourSwatch(SwatchColor=RGBA(153, 153, 153, 103)))
mcol_43 = MeshColours(Mesh=mesh_8, Colours=ColourSwatch(SwatchColor=RGB(255, 28, 28)))
mcol_44 = MeshColours(Mesh=mesh_9, Colours=ColourSwatch(SwatchColor=RGB(255, 28, 28)))
mcol_45 = MeshColours(Mesh=mesh_10, Colours=ColourSwatch(SwatchColor=RGBA(153, 153, 153, 103)))
mjoin_8 = MeshJoin(Meshes=[mcol_43, mcol_36, mcol_37, mcol_38, mcol_42, mcol_40, mcol_41, mcol_39, mcol_45, mcol_44, mcol_22])

ungroup_28 = Ungroup(Group=mirror.Geometry)
ungroup_29 = Ungroup(Group=data_3)
item_52 = ListItem(List=ungroup_28, Index=0, Wrap=True)  # -> Item, Item1, Item2, Item3, Item4
item_53 = ListItem(List=ungroup_29, Index=0, Wrap=True)  # -> Item, Item1, Item2, Item3, Item4
ungroup_30 = Ungroup(Group=item_52.Item)
ungroup_31 = Ungroup(Group=item_52.Item1)
ungroup_32 = Ungroup(Group=item_52.Item3)
ungroup_33 = Ungroup(Group=item_52.Item4)
ungroup_34 = Ungroup(Group=item_52.Item2)
ungroup_35 = Ungroup(Group=item_53.Item2)
ungroup_36 = Ungroup(Group=item_53.Item)
ungroup_37 = Ungroup(Group=item_53.Item1)
ungroup_38 = Ungroup(Group=item_53.Item3)
ungroup_39 = Ungroup(Group=item_53.Item4)
mcol_46 = MeshColours(Mesh=ungroup_30, Colours=ColourSwatch(SwatchColor=RGBA(0, 0, 0, 184)))
mcol_47 = MeshColours(Mesh=ungroup_31, Colours=ColourSwatch(SwatchColor=RGB(0, 0, 0)))
mcol_48 = MeshColours(Mesh=ungroup_32, Colours=ColourSwatch(SwatchColor=RGBA(28, 236, 255, 129)))
mcol_49 = MeshColours(Mesh=ungroup_38, Colours=ColourSwatch(SwatchColor=RGBA(28, 236, 255, 129)))
mcol_50 = MeshColours(Mesh=ungroup_36, Colours=ColourSwatch(SwatchColor=RGBA(0, 0, 0, 184)))
mcol_51 = MeshColours(Mesh=ungroup_37, Colours=ColourSwatch(SwatchColor=RGB(0, 0, 0)))

cls_9 = Closed(Curve=ungroup_35)  # -> Closed, Periodic
cls_10 = Closed(Curve=ungroup_33)  # -> Closed, Periodic
cls_11 = Closed(Curve=ungroup_34)  # -> Closed, Periodic
cls_12 = Closed(Curve=ungroup_39)  # -> Closed, Periodic
cull_22 = CullPattern(List=ungroup_35, CullPattern=cls_9.Closed)
cull_23 = CullPattern(List=ungroup_33, CullPattern=cls_10.Closed)
cull_24 = CullPattern(List=ungroup_34, CullPattern=cls_11.Closed)
cull_25 = CullPattern(List=ungroup_39, CullPattern=cls_12.Closed)

mesh_11 = Mesh(cull_23)
mesh_12 = Mesh(cull_24)
mesh_13 = Mesh(cull_25)
mesh_14 = Mesh(cull_22)
mcol_52 = MeshColours(Mesh=mesh_11, Colours=ColourSwatch(SwatchColor=RGBA(153, 153, 153, 103)))
mcol_53 = MeshColours(Mesh=mesh_12, Colours=ColourSwatch(SwatchColor=RGB(255, 28, 28)))
mcol_54 = MeshColours(Mesh=mesh_13, Colours=ColourSwatch(SwatchColor=RGBA(153, 153, 153, 103)))
mcol_55 = MeshColours(Mesh=mesh_14, Colours=ColourSwatch(SwatchColor=RGB(255, 28, 28)))
mjoin_9 = MeshJoin(Meshes=[mcol_53, mcol_46, mcol_47, mcol_48, mcol_52, mcol_50, mcol_51, mcol_49, mcol_54, mcol_55, mcol_19])

filter_11 = StreamFilter(Gate=data, Stream1=[mjoin_9, mjoin_8, mjoin_7])

floor_height_6 = Data(floor_height_5)
total_floor_height = Data(multiplication_5)
floor_height_7 = Data(Z_16)
glass_windows = Data([ungroup_8, ungroup_15])
merge_30 = Merge(Data1=ungroup_6, Data2=ungroup_7, Data3=ungroup_13, Data4=ungroup_14)
foorrplate = Data(srf_9)
Z_32 = UnitZ(Factor=total_floor_height)
Z_33 = UnitZ(Factor=Slider(0.15, range=0..1))
facade_curves_4 = Data(facade_6)
debrep_19 = DeconstructBrep(Brep=glass_windows)  # -> Faces, Edges, Vertices
extr_12 = Extrude(Base=foorrplate, Direction=Z_33)
cull_i_4 = CullIndex(List=floor_height_7, Indices="-1", Wrap=True)
number_slider_14 = Slider(0.05, range=0..0.1)
facade_block1_balconywidth = GetNumber(Slider(1.6, range=0..2), AtLeast=1, AtMost=1, Maximum=1.797693135e+308, Minimum=-1.797693135e+308, TreeAccess=False)
facade_block1_balconytype = GetNumber(Slider(3, range=0..4), AtLeast=1, AtMost=1, Maximum=1.797693135e+308, Minimum=-1.797693135e+308, TreeAccess=False)
extr_13 = Extrude(Base=merge_30, Direction=Z_32)
move_17 = Move(Geometry=extr_12, Motion=floor_height_7)  # -> Geometry, Transform
move_18 = Move(Geometry=facade_curves_4, Motion=graft(cull_i_4))  # -> Geometry, Transform
gate_25 = StreamGate(Stream=move_18.Geometry, Gate=facade_block1_balconytype)  # -> Target0, Target1, Target2, Target3, Target4
facade_curves_5 = Data(gate_25.Target3)
facade_curves_6 = Data(gate_25.Target4)
offset_28 = OffsetCurve(Curve=facade_curves_5, Distance=expr("-x", facade_block1_balconywidth), Corners=1)
offset_29 = OffsetCurve(Curve=facade_curves_6, Distance=expr("-x", facade_block1_balconywidth), Corners=1)
number_slider_15 = Slider(5, range=0..10)
number_slider_16 = Slider(5, range=0..10)
number_slider_17 = Slider(5, range=0..10)
number_slider_18 = Slider(4, range=0..10)
divide = DivideCurve(Curve=offset_28, Count=number_slider_16, Kinks=False)  # -> Points, Tangents, Parameters
divide_2 = DivideCurve(Curve=facade_curves_5, Count=number_slider_16, Kinks=False)  # -> Points, Tangents, Parameters
divide_3 = DivideCurve(Curve=offset_29, Count=number_slider_18, Kinks=False)  # -> Points, Tangents, Parameters
divide_4 = DivideCurve(Curve=facade_curves_6, Count=number_slider_18, Kinks=False)  # -> Points, Tangents, Parameters
swatch_2 = ColourSwatch(SwatchColor=RGB(204, 204, 204))
item_54 = ListItem(List=divide.Points, Index=0, Wrap=True)  # -> Item, Item1, Item2, Item3, Item4, Item5
item_55 = ListItem(List=divide_2.Points, Index=0, Wrap=True)  # -> Item, Item1, Item2, Item3, Item4, Item5
item_56 = ListItem(List=divide_3.Points, Index=0, Wrap=True)  # -> Item, Item1, Item2, Item3, Item4, Item5
item_57 = ListItem(List=divide_4.Points, Index=0, Wrap=True)  # -> Item, Item1, Item2, Item3, Item4, Item5
facade_curves_7 = Data(gate_25.Target2)
ln_53 = Line(StartPoint=item_54.Item, EndPoint=item_54.Item1)
ln_54 = Line(StartPoint=item_54.Item3, EndPoint=item_54.Item4)
ln_55 = Line(StartPoint=item_55.Item, EndPoint=item_55.Item1)
ln_56 = Line(StartPoint=item_55.Item3, EndPoint=item_55.Item4)
ln_57 = Line(StartPoint=item_56.Item, EndPoint=item_56.Item1)
ln_58 = Line(StartPoint=item_56.Item3, EndPoint=item_56.Item4)
offset_30 = OffsetCurve(Curve=facade_curves_7, Distance=expr("-x", facade_block1_balconywidth), Corners=1)
ln_59 = Line(StartPoint=item_57.Item, EndPoint=item_57.Item1)
ln_60 = Line(StartPoint=item_57.Item3, EndPoint=item_57.Item4)
end_19 = EndPoints(Curve=ln_55)  # -> Start, End
end_20 = EndPoints(Curve=ln_56)  # -> Start, End
end_21 = EndPoints(Curve=ln_53)  # -> Start, End
end_22 = EndPoints(Curve=ln_54)  # -> Start, End
end_23 = EndPoints(Curve=ln_59)  # -> Start, End
end_24 = EndPoints(Curve=ln_60)  # -> Start, End
end_25 = EndPoints(Curve=ln_57)  # -> Start, End
end_26 = EndPoints(Curve=ln_58)  # -> Start, End
end_27 = EndPoints(Curve=facade_curves_7)  # -> Start, End
midpt_25 = CurveMiddle(Curve=offset_30)
pshift_7 = ShiftPaths(Data=midpt_25, Offset=-1)
srf4pt = _4PointSurface(CornerA=end_19.Start, CornerB=end_19.End, CornerC=end_21.End, CornerD=end_21.Start)
srf4pt_2 = _4PointSurface(CornerA=end_20.Start, CornerB=end_20.End, CornerC=end_22.End, CornerD=end_22.Start)
srf4pt_3 = _4PointSurface(CornerA=end_23.Start, CornerB=end_23.End, CornerC=end_25.End, CornerD=end_25.Start)
srf4pt_4 = _4PointSurface(CornerA=end_24.Start, CornerB=end_24.End, CornerC=end_26.End, CornerD=end_26.Start)
debrep_20 = DeconstructBrep(Brep=srf4pt_2)  # -> Faces, Edges, Vertices
debrep_21 = DeconstructBrep(Brep=srf4pt)  # -> Faces, Edges, Vertices
ln_61 = Line(StartPoint=pshift_7, EndPoint=end_27.End)
ln_62 = Line(StartPoint=pshift_7, EndPoint=end_27.Start)
debrep_22 = DeconstructBrep(Brep=srf4pt_4)  # -> Faces, Edges, Vertices
debrep_23 = DeconstructBrep(Brep=srf4pt_3)  # -> Faces, Edges, Vertices
item_58 = ListItem(List=debrep_20.Edges, Index=0, Wrap=True)  # -> Item, Item1, Item2, Item3
item_59 = ListItem(List=debrep_21.Edges, Index=0, Wrap=True)  # -> Item, Item1, Item2, Item3
item_60 = ListItem(List=debrep_22.Edges, Index=0, Wrap=True)  # -> Item, Item1, Item2, Item3
item_61 = ListItem(List=debrep_23.Edges, Index=0, Wrap=True)  # -> Item, Item1, Item2, Item3
join_16 = JoinCurves(Curves=[ln_61, ln_62], Preserve=False)
Z_34 = UnitZ(Factor=1)
Z_35 = UnitZ(Factor=1)
Z_36 = UnitZ(Factor=1)
Z_37 = UnitZ(Factor=1)
Z_38 = UnitZ(Factor=1)
extr_14 = Extrude(Base=[item_58.Item1, item_58.Item2, item_58.Item3], Direction=Z_34)
extr_15 = Extrude(Base=[item_59.Item1, item_59.Item2, item_59.Item3], Direction=Z_35)
extr_16 = Extrude(Base=[item_60.Item1, item_60.Item2, item_60.Item3], Direction=Z_36)
extr_17 = Extrude(Base=[item_61.Item1, item_61.Item2, item_61.Item3], Direction=Z_37)
extr_18 = Extrude(Base=join_16, Direction=Z_38)
Z_39 = UnitZ(Factor="-0.15")
mcol_56 = MeshColours(Mesh=[srf4pt, srf4pt_2], Colours=ColourSwatch(SwatchColor=RGB(204, 204, 204)))
mcol_57 = MeshColours(Mesh=[srf4pt_3, srf4pt_4], Colours=ColourSwatch(SwatchColor=RGB(204, 204, 204)))
mcol_58 = MeshColours(Mesh=[extr_15, extr_14], Colours=ColourSwatch(SwatchColor=RGBA(79, 76, 76, 155)))
mcol_59 = MeshColours(Mesh=[extr_17, extr_16], Colours=ColourSwatch(SwatchColor=RGBA(79, 76, 76, 158)))

multiplication_6 = Multiplication(A=floor_height_6, B=Slider(0.7, range=0..1))

item_62 = ListItem(List=debrep_19.Edges, Index=Slider(2, range=0..10), Wrap=True)

facade_curves_8 = Data(gate_25.Target1)
offset_31 = OffsetCurve(Curve=facade_curves_8, Distance=expr("-x", facade_block1_balconywidth), Corners=1)
midpt_26 = CurveMiddle(Curve=offset_31)
rotate = Rotate(Geometry=offset_31, Angle=degrees(Slider(16, range=-20..20)), Plane=midpt_26)  # -> Geometry, Transform
pshift_8 = ShiftPaths(Data=rotate.Geometry, Offset=-1)
end_28 = EndPoints(Curve=pshift_8)  # -> Start, End
end_29 = EndPoints(Curve=facade_curves_8)  # -> Start, End
ln_63 = Line(StartPoint=end_28.End, EndPoint=end_29.End)
ln_64 = Line(StartPoint=end_28.Start, EndPoint=end_29.Start)
join_17 = JoinCurves(Curves=[ln_63, ln_64, pshift_8], Preserve=False)
Z_40 = UnitZ(Factor=1)
extr_19 = Extrude(Base=join_17, Direction=Z_40)

facade_curves_9 = Data(gate_25.Target0)
offset_32 = OffsetCurve(Curve=facade_curves_9, Distance=expr("-x", facade_block1_balconywidth), Corners=1)
pshift_9 = ShiftPaths(Data=offset_32, Offset=-1)
end_30 = EndPoints(Curve=pshift_9)  # -> Start, End
end_31 = EndPoints(Curve=facade_curves_9)  # -> Start, End
ln_65 = Line(StartPoint=end_30.End, EndPoint=end_31.End)
ln_66 = Line(StartPoint=end_30.Start, EndPoint=end_31.Start)
join_18 = JoinCurves(Curves=[ln_65, ln_66, pshift_9, facade_curves_9], Preserve=False)
cls_13 = Closed(Curve=join_18)  # -> Closed, Periodic
join_19 = JoinCurves(Curves=[ln_65, ln_66, pshift_9], Preserve=False)
cull_26 = CullPattern(List=join_18, CullPattern=cls_13.Closed)
Z_41 = UnitZ(Factor=1)
extr_20 = Extrude(Base=join_19, Direction=Z_41)
srf_10 = Surface(cull_26)

Z_42 = UnitZ(Factor=multiplication_6)
extr_21 = Extrude(Base=item_62, Direction=Z_42)  # -> flatten(Extrusion)
divide_5 = DivideCurve(Curve=item_62, Count=Slider(4, range=0..10), Kinks=False)  # -> Points, Tangents, Parameters
pline_12 = PolyLine(Vertices=divide_5.Points, Closed=False)
pl_7 = ConstructPlane(Origin=divide_5.Points, XAxis=item_62, YAxis=Vector(0, 1, 0))
move_19 = Move(Geometry=extr_21, Motion=graft(cull_i_4))  # -> Geometry, Transform
debrep_24 = DeconstructBrep(Brep=[move_19.Geometry, extr_21])  # -> Faces, Edges, Vertices
rectangle_5 = Rectangle(Plane=pl_7, XSize=number_slider_14, YSize=number_slider_14, Radius=0)  # -> Rectangle, Length
item_63 = ListItem(List=debrep_24.Edges, Index=Slider(1, range=0..10), Wrap=True)
subtraction = Subtraction(A=floor_height_6, B=multiplication_6)
Z_43 = UnitZ(Factor=subtraction)
extr_22 = Extrude(Base=rectangle_5.Rectangle, Direction=Z_42)  # -> flatten(Extrusion)
extr_23 = Extrude(Base=item_63, Direction=Z_43)
move_20 = Move(Geometry=extr_22, Motion=graft(cull_i_4))  # -> Geometry, Transform
mcol_60 = MeshColours(Mesh=[move_17.Geometry, extr_23], Colours=swatch_2)
mcol_61 = MeshColours(Mesh=[move_19.Geometry, extr_21], Colours=ColourSwatch(SwatchColor=RGBA(138, 201, 207, 46)))
mcol_62 = MeshColours(Mesh=[move_20.Geometry, extr_22], Colours=ColourSwatch(SwatchColor=RGBA(0, 0, 0, 63)))
cp_4 = ControlPoints(Curve=[join_16, join_17, join_19, srf4pt, srf4pt_2])  # -> Points, Weights, Knots
pline_13 = PolyLine(Vertices=cp_4.Points, Closed=True)
extr_24 = Extrude(Base=pline_13, Direction=Z_39)
mcol_63 = MeshColours(Mesh=[extr_13, extr_24], Colours=swatch_2)
mcol_64 = MeshColours(Mesh=[extr_20, extr_19, extr_18, srf_10], Colours=ColourSwatch(SwatchColor=RGBA(79, 76, 76, 160)))
mjoin_10 = MeshJoin(Meshes=[mcol_63, mcol_60, mcol_61, mcol_62, mcol_64, mcol_58, mcol_56, mcol_59, mcol_57])

floor_height_8 = Data(floor_height_3)
merge_31 = Merge(Data1=ungroup_30, Data2=ungroup_31, Data3=ungroup_36, Data4=ungroup_37)
total_floor_height_2 = Data(multiplication_3)
floor_height_9 = Data(Z_8)
glass_windows_2 = Data([ungroup_32, ungroup_38])
foorrplate_2 = Data(srf_7)
Z_44 = UnitZ(Factor=total_floor_height_2)
Z_45 = UnitZ(Factor=Slider(0.15, range=0..1))
facade_curves_10 = Data(facade_2)
debrep_25 = DeconstructBrep(Brep=glass_windows_2)  # -> Faces, Edges, Vertices
extr_25 = Extrude(Base=foorrplate_2, Direction=Z_45)
cull_i_5 = CullIndex(List=floor_height_9, Indices="-1", Wrap=True)
number_slider_19 = Slider(0.05, range=0..0.1)
facade_block2_balconywidth = GetNumber(Slider(1.6, range=0..2), AtLeast=1, AtMost=1, Maximum=1.797693135e+308, Minimum=-1.797693135e+308, TreeAccess=False)
facade_block2_balconytype = GetNumber(Slider(3, range=0..4), AtLeast=1, AtMost=1, Maximum=1.797693135e+308, Minimum=-1.797693135e+308, TreeAccess=False)
extr_26 = Extrude(Base=merge_31, Direction=Z_44)
move_21 = Move(Geometry=extr_25, Motion=floor_height_9)  # -> Geometry, Transform
move_22 = Move(Geometry=facade_curves_10, Motion=graft(cull_i_5))  # -> Geometry, Transform
gate_26 = StreamGate(Stream=move_22.Geometry, Gate=facade_block2_balconytype)  # -> Target0, Target1, Target2, Target3, Target4
facade_curves_11 = Data(gate_26.Target3)
facade_curves_12 = Data(gate_26.Target4)
offset_33 = OffsetCurve(Curve=facade_curves_11, Distance=expr("-x", facade_block2_balconywidth), Corners=1)
offset_34 = OffsetCurve(Curve=facade_curves_12, Distance=expr("-x", facade_block2_balconywidth), Corners=1)
number_slider_20 = Slider(5, range=0..10)
number_slider_21 = Slider(5, range=0..10)
number_slider_22 = Slider(5, range=0..10)
number_slider_23 = Slider(4, range=0..10)
divide_6 = DivideCurve(Curve=offset_33, Count=number_slider_21, Kinks=False)  # -> Points, Tangents, Parameters
divide_7 = DivideCurve(Curve=facade_curves_11, Count=number_slider_21, Kinks=False)  # -> Points, Tangents, Parameters
divide_8 = DivideCurve(Curve=offset_34, Count=number_slider_23, Kinks=False)  # -> Points, Tangents, Parameters
divide_9 = DivideCurve(Curve=facade_curves_12, Count=number_slider_23, Kinks=False)  # -> Points, Tangents, Parameters
swatch_3 = ColourSwatch(SwatchColor=RGB(204, 204, 204))
item_64 = ListItem(List=divide_6.Points, Index=0, Wrap=True)  # -> Item, Item1, Item2, Item3, Item4, Item5
item_65 = ListItem(List=divide_7.Points, Index=0, Wrap=True)  # -> Item, Item1, Item2, Item3, Item4, Item5
item_66 = ListItem(List=divide_8.Points, Index=0, Wrap=True)  # -> Item, Item1, Item2, Item3, Item4, Item5
item_67 = ListItem(List=divide_9.Points, Index=0, Wrap=True)  # -> Item, Item1, Item2, Item3, Item4, Item5
facade_curves_13 = Data(gate_26.Target2)
ln_67 = Line(StartPoint=item_64.Item, EndPoint=item_64.Item1)
ln_68 = Line(StartPoint=item_64.Item3, EndPoint=item_64.Item4)
ln_69 = Line(StartPoint=item_65.Item, EndPoint=item_65.Item1)
ln_70 = Line(StartPoint=item_65.Item3, EndPoint=item_65.Item4)
ln_71 = Line(StartPoint=item_66.Item, EndPoint=item_66.Item1)
ln_72 = Line(StartPoint=item_66.Item3, EndPoint=item_66.Item4)
offset_35 = OffsetCurve(Curve=facade_curves_13, Distance=expr("-x", facade_block2_balconywidth), Corners=1)
ln_73 = Line(StartPoint=item_67.Item, EndPoint=item_67.Item1)
ln_74 = Line(StartPoint=item_67.Item3, EndPoint=item_67.Item4)
end_32 = EndPoints(Curve=ln_69)  # -> Start, End
end_33 = EndPoints(Curve=ln_70)  # -> Start, End
end_34 = EndPoints(Curve=ln_67)  # -> Start, End
end_35 = EndPoints(Curve=ln_68)  # -> Start, End
end_36 = EndPoints(Curve=ln_73)  # -> Start, End
end_37 = EndPoints(Curve=ln_74)  # -> Start, End
end_38 = EndPoints(Curve=ln_71)  # -> Start, End
end_39 = EndPoints(Curve=ln_72)  # -> Start, End
end_40 = EndPoints(Curve=facade_curves_13)  # -> Start, End
midpt_27 = CurveMiddle(Curve=offset_35)
pshift_10 = ShiftPaths(Data=midpt_27, Offset=-1)
srf4pt_5 = _4PointSurface(CornerA=end_32.Start, CornerB=end_32.End, CornerC=end_34.End, CornerD=end_34.Start)
srf4pt_6 = _4PointSurface(CornerA=end_33.Start, CornerB=end_33.End, CornerC=end_35.End, CornerD=end_35.Start)
srf4pt_7 = _4PointSurface(CornerA=end_36.Start, CornerB=end_36.End, CornerC=end_38.End, CornerD=end_38.Start)
srf4pt_8 = _4PointSurface(CornerA=end_37.Start, CornerB=end_37.End, CornerC=end_39.End, CornerD=end_39.Start)
debrep_26 = DeconstructBrep(Brep=srf4pt_6)  # -> Faces, Edges, Vertices
debrep_27 = DeconstructBrep(Brep=srf4pt_5)  # -> Faces, Edges, Vertices
ln_75 = Line(StartPoint=pshift_10, EndPoint=end_40.End)
ln_76 = Line(StartPoint=pshift_10, EndPoint=end_40.Start)
debrep_28 = DeconstructBrep(Brep=srf4pt_8)  # -> Faces, Edges, Vertices
debrep_29 = DeconstructBrep(Brep=srf4pt_7)  # -> Faces, Edges, Vertices
item_68 = ListItem(List=debrep_26.Edges, Index=0, Wrap=True)  # -> Item, Item1, Item2, Item3
item_69 = ListItem(List=debrep_27.Edges, Index=0, Wrap=True)  # -> Item, Item1, Item2, Item3
item_70 = ListItem(List=debrep_28.Edges, Index=0, Wrap=True)  # -> Item, Item1, Item2, Item3
item_71 = ListItem(List=debrep_29.Edges, Index=0, Wrap=True)  # -> Item, Item1, Item2, Item3
join_20 = JoinCurves(Curves=[ln_75, ln_76], Preserve=False)
Z_46 = UnitZ(Factor=1)
Z_47 = UnitZ(Factor=1)
Z_48 = UnitZ(Factor=1)
Z_49 = UnitZ(Factor=1)
Z_50 = UnitZ(Factor=1)
extr_27 = Extrude(Base=[item_68.Item1, item_68.Item2, item_68.Item3], Direction=Z_46)
extr_28 = Extrude(Base=[item_69.Item1, item_69.Item2, item_69.Item3], Direction=Z_47)
extr_29 = Extrude(Base=[item_70.Item1, item_70.Item2, item_70.Item3], Direction=Z_48)
extr_30 = Extrude(Base=[item_71.Item1, item_71.Item2, item_71.Item3], Direction=Z_49)
extr_31 = Extrude(Base=join_20, Direction=Z_50)
Z_51 = UnitZ(Factor="-0.15")
mcol_65 = MeshColours(Mesh=[srf4pt_5, srf4pt_6], Colours=ColourSwatch(SwatchColor=RGB(204, 204, 204)))
mcol_66 = MeshColours(Mesh=[srf4pt_7, srf4pt_8], Colours=ColourSwatch(SwatchColor=RGB(204, 204, 204)))
mcol_67 = MeshColours(Mesh=[extr_28, extr_27], Colours=ColourSwatch(SwatchColor=RGBA(79, 76, 76, 151)))
mcol_68 = MeshColours(Mesh=[extr_30, extr_29], Colours=ColourSwatch(SwatchColor=RGBA(79, 76, 76, 168)))

multiplication_7 = Multiplication(A=floor_height_8, B=Slider(0.7, range=0..1))

item_72 = ListItem(List=debrep_25.Edges, Index=Slider(2, range=0..10), Wrap=True)

facade_curves_14 = Data(gate_26.Target1)
offset_36 = OffsetCurve(Curve=facade_curves_14, Distance=expr("-x", facade_block2_balconywidth), Corners=1)
midpt_28 = CurveMiddle(Curve=offset_36)
rotate_2 = Rotate(Geometry=offset_36, Angle=degrees(Slider(16, range=-20..20)), Plane=midpt_28)  # -> Geometry, Transform
pshift_11 = ShiftPaths(Data=rotate_2.Geometry, Offset=-1)
end_41 = EndPoints(Curve=pshift_11)  # -> Start, End
end_42 = EndPoints(Curve=facade_curves_14)  # -> Start, End
ln_77 = Line(StartPoint=end_41.End, EndPoint=end_42.End)
ln_78 = Line(StartPoint=end_41.Start, EndPoint=end_42.Start)
join_21 = JoinCurves(Curves=[ln_77, ln_78, pshift_11], Preserve=False)
Z_52 = UnitZ(Factor=1)
extr_32 = Extrude(Base=join_21, Direction=Z_52)

facade_curves_15 = Data(gate_26.Target0)
offset_37 = OffsetCurve(Curve=facade_curves_15, Distance=expr("-x", facade_block2_balconywidth), Corners=1)
pshift_12 = ShiftPaths(Data=offset_37, Offset=-1)
end_43 = EndPoints(Curve=pshift_12)  # -> Start, End
end_44 = EndPoints(Curve=facade_curves_15)  # -> Start, End
ln_79 = Line(StartPoint=end_43.End, EndPoint=end_44.End)
ln_80 = Line(StartPoint=end_43.Start, EndPoint=end_44.Start)
join_22 = JoinCurves(Curves=[ln_79, ln_80, pshift_12, facade_curves_15], Preserve=False)
cls_14 = Closed(Curve=join_22)  # -> Closed, Periodic
join_23 = JoinCurves(Curves=[ln_79, ln_80, pshift_12], Preserve=False)
cull_27 = CullPattern(List=join_22, CullPattern=cls_14.Closed)
Z_53 = UnitZ(Factor=1)
extr_33 = Extrude(Base=join_23, Direction=Z_53)
srf_11 = Surface(cull_27)

Z_54 = UnitZ(Factor=multiplication_7)
extr_34 = Extrude(Base=item_72, Direction=Z_54)  # -> flatten(Extrusion)
divide_10 = DivideCurve(Curve=item_72, Count=Slider(4, range=0..10), Kinks=False)  # -> Points, Tangents, Parameters
pline_14 = PolyLine(Vertices=divide_10.Points, Closed=False)
pl_8 = ConstructPlane(Origin=divide_10.Points, XAxis=item_72, YAxis=Vector(0, 1, 0))
move_23 = Move(Geometry=extr_34, Motion=graft(cull_i_5))  # -> Geometry, Transform
debrep_30 = DeconstructBrep(Brep=[move_23.Geometry, extr_34])  # -> Faces, Edges, Vertices
rectangle_6 = Rectangle(Plane=pl_8, XSize=number_slider_19, YSize=number_slider_19, Radius=0)  # -> Rectangle, Length
item_73 = ListItem(List=debrep_30.Edges, Index=Slider(1, range=0..10), Wrap=True)
subtraction_2 = Subtraction(A=floor_height_8, B=multiplication_7)
Z_55 = UnitZ(Factor=subtraction_2)
extr_35 = Extrude(Base=rectangle_6.Rectangle, Direction=Z_54)  # -> flatten(Extrusion)
extr_36 = Extrude(Base=item_73, Direction=Z_55)
move_24 = Move(Geometry=extr_35, Motion=graft(cull_i_5))  # -> Geometry, Transform
mcol_69 = MeshColours(Mesh=[move_21.Geometry, extr_36], Colours=swatch_3)
mcol_70 = MeshColours(Mesh=[move_23.Geometry, extr_34], Colours=ColourSwatch(SwatchColor=RGBA(138, 201, 207, 46)))
mcol_71 = MeshColours(Mesh=[move_24.Geometry, extr_35], Colours=ColourSwatch(SwatchColor=RGBA(0, 0, 0, 63)))
cp_5 = ControlPoints(Curve=[join_20, join_21, join_23, srf4pt_5, srf4pt_6])  # -> Points, Weights, Knots
pline_15 = PolyLine(Vertices=cp_5.Points, Closed=True)
extr_37 = Extrude(Base=pline_15, Direction=Z_51)
mcol_72 = MeshColours(Mesh=[extr_26, extr_37], Colours=swatch_3)
mcol_73 = MeshColours(Mesh=[extr_33, extr_32, extr_31, srf_11], Colours=ColourSwatch(SwatchColor=RGBA(79, 76, 76, 140)))
mjoin_11 = MeshJoin(Meshes=[mcol_72, mcol_69, mcol_70, mcol_71, mcol_73, mcol_67, mcol_65, mcol_68, mcol_66])

filter_12 = StreamFilter(Gate=facade.Equality, Stream1=[mjoin_10, mjoin_11])
mjoin_12 = MeshJoin(Meshes=flatten([merge_7, merge_6, filter_11, filter, filter_12, mjoin, mjoin_6]))

# ---- group: RH_OUT:meshout
mesh_15 = Mesh(mjoin_12)
